# Grasshopper definition 01_ros_load_and_visualization.ghx (Grasshopper 1.0.7)

number_slider = Slider(5, range=0..5)  # disabled

# ----
# 1. Load Robot From ROS
ros_connect = BooleanToggle(True)
robot_load = BooleanToggle(True)
compas_fab_ros_connect = COMPASFABROSConnect(connect=ros_connect)  # -> ros_client, is_connected; inputs port: Int32, connect: Boolean
#   port ip: The ip address ROS. Defaults to 127.0.0.1.
#   port port: The port of ROS. Defaults to 9090.
#   port connect: If True, connects to ROS. If False, disconnects from ROS. Defaults to False.
#   port ros_client: The ROS client.
#   port is_connected: True if connection established.
# ---------- compas_fab_ros_connect: Python ----------
"""
Connect or disconnect to ROS.

COMPAS FAB v1.0.2
"""

from ghpythonlib.componentbase import executingcomponent as component
from scriptcontext import sticky as st

from compas_fab.backends import RosClient
from compas_fab.ghpython.components import create_id


class ROSConnect(component):
    def RunScript(self, ip, port, connect):
        ros_client = None

        ip = ip or "127.0.0.1"
        port = port or 9090

        key = create_id(self, "ros_client")
        ros_client = st.get(key, None)

        if ros_client:
            st[key].close()
        if connect:
            st[key] = RosClient(ip, port)
            st[key].run(5)

        ros_client = st.get(key, None)
        is_connected = ros_client.is_connected if ros_client else False
        return (ros_client, is_connected)
# ---------- end compas_fab_ros_connect ----------
compas_fab_ros_robot = COMPASFABROSRobot(ros_client=compas_fab_ros_connect.ros_client, load=robot_load)  # -> robot; inputs load: Boolean
#   port ros_client: The ROS client.
#   port load: If True, loads the robot from ROS. Defaults to False.
# ---------- compas_fab_ros_robot: Python ----------
"""
Load robot directly from ROS.

COMPAS FAB v1.0.2
"""

from compas.scene import SceneObject
from ghpythonlib.componentbase import executingcomponent as component
from scriptcontext import sticky as st

from compas_fab.ghpython.components import create_id


class ROSRobot(component):
    def RunScript(self, ros_client, load):
        key = create_id(self, "robot")

        if ros_client and ros_client.is_connected and load:
            # Load URDF from ROS
            st[key] = ros_client.load_robot(load_geometry=True, precision=12)
            st[key].scene_object = SceneObject(st[key].model)

        robot = st.get(key, None)
        if robot:  # client sometimes need to be restarted, without needing to reload geometry
            robot.client = ros_client
        return robot
# ---------- end compas_fab_ros_robot ----------
robot = Data(compas_fab_ros_robot)

# ----
# 2. Attach tool and robot table
robot_2 = ValueList({"ur3": 0, "ur5": 1, "ur10e": 2, "ur20": 3}, selected="ur20")
load = BooleanToggle(True)
# Attach Elements
robot_3 = Data(robot)
ghpython_script = GhPythonScript(ee_name="piab_gripper", robot=robot_2, load=load)  # -> visual_mesh, collision_mesh, tcf_plane; inputs robot: Int32, load: Boolean
# ---------- ghpython_script: Python ----------
from compas_rhino.conversions import frame_to_rhino_plane, mesh_to_rhino
from compas.data import json_load
import os
import sys

canvas = ghenv.Component.OnPingDocument()
path = canvas.FilePath
dir_path = os.path.dirname(path)
robots = ["ur3", "ur5", "ur10e", "ur20"]
robot = robots[robot]
ee_path = os.path.join(dir_path, "fabrication", "setup", "endeffectors", robot, ee_name + ".json")
print (ee_path)

if (ee_name, robot):
    ee_dict = json_load(ee_path)
    
    tcf_plane = frame_to_rhino_plane(ee_dict["tcf"])
    c_visual_mesh = ee_dict["visual_mesh"]
    c_visual_mesh.quads_to_triangles()
    visual_mesh = mesh_to_rhino(c_visual_mesh)
    
    if 'collision_mesh' in ee_dict:
        c_collision_mesh = ee_dict["collision_mesh"]
        c_collision_mesh.quads_to_triangles()
        collision_mesh = mesh_to_rhino(ee_dict["collision_mesh"])
    else:
        collision_mesh = None

else:
    ghenv.Component.Message("Missing EE Info")
# ---------- end ghpython_script ----------
compas_fab_attached_tool = COMPASFABAttachedTool(
    robot=robot_3,
    visual_mesh=ghpython_script.visual_mesh,
    collision_mesh=ghpython_script.collision_mesh,
    tcf_plane=ghpython_script.tcf_plane)  # -> robot; inputs visual_mesh: Mesh, collision_mesh: Mesh
#   port visual_mesh: A visual mesh for the tool.
#   port collision_mesh: A collision mesh for the tool.
#   port tcf_plane: The frame of the tool in tool0 frame.
#   port group: The planning group to which the tool should be attached.
#   port connected_to: The link to which the tool should be connected to.
# ---------- compas_fab_attached_tool: Python ----------
"""
Attach a tool to the robot.

COMPAS FAB v1.0.2
"""

from compas.geometry import Frame
from compas_rhino.conversions import mesh_to_compas
from compas_rhino.conversions import plane_to_compas_frame
from ghpythonlib.componentbase import executingcomponent as component

from compas_fab.robots import Tool


class AttachToolComponent(component):
    def RunScript(self, robot, visual_mesh, collision_mesh, tcf_plane, group, connected_to):
        if robot and robot.client and robot.client.is_connected and visual_mesh:
            if not collision_mesh:
                collision_mesh = visual_mesh

            c_visual_mesh = mesh_to_compas(visual_mesh)
            c_collision_mesh = mesh_to_compas(collision_mesh)

            if not tcf_plane:
                frame = Frame.worldXY()
            else:
                frame = plane_to_compas_frame(tcf_plane)
            tool = Tool(c_visual_mesh, frame, c_collision_mesh, connected_to=connected_to)

            robot.attach_tool(tool, group)

        return robot
# ---------- end compas_fab_attached_tool ----------
robot_4 = Data(compas_fab_attached_tool)

# ----
# 2. Get Robot Zero Configuration
robot_5 = Data(compas_fab_ros_robot)
compas_fab_zero_config = COMPASFABZeroConfig(robot=robot_5)  # -> config
#   port group: If assigned, it will return the zero configuration for the given group, otherwise a full zero configuration.
#   port config: The zero configuration.
# ---------- compas_fab_zero_config: Python ----------
"""
Get a zero configuration for a robot.

COMPAS FAB v1.0.2
"""

from ghpythonlib.componentbase import executingcomponent as component


class ConfigZero(component):
    def RunScript(self, robot, group):
        if robot:
            return robot.zero_configuration(group)

        return None
# ---------- end compas_fab_zero_config ----------
zero_config = Data(compas_fab_zero_config)

base = Slider(216, range=-360..360)
shoulder = Slider(302, range=-360..360)
elbow = Slider(-135, range=-180..180)
wrist1 = Slider(319, range=-360..360)
wrist2 = Slider(75, range=-360..360)
wrist3 = Slider(-305, range=-360..360)
# 3. Define Custom Configuration
robot_6 = Data(compas_fab_ros_robot)
ghpython_script_2 = GhPythonScript(robot=robot_6, base=base, shoulder=shoulder, elbow=elbow, wrist_1=wrist1, wrist_2=wrist2, wrist_3=wrist3)  # -> out, config; inputs base: Int32, shoulder: Int32, elbow: Int32, wrist_1: Int32, wrist_2: Int32, wrist_3: Int32
# ---------- ghpython_script_2: Python ----------
from compas_robots import Configuration
import math

base_rad = math.radians(base)
shoulder_rad = math.radians(shoulder)
elbow_rad = math.radians(elbow)
wrist_1_rad = math.radians(wrist_1)
wrist_2_rad = math.radians(wrist_2)
wrist_3_rad = math.radians(wrist_3)

joint_values = [base_rad, shoulder_rad, elbow_rad, wrist_1_rad, wrist_2_rad, wrist_3_rad]
joint_names = ['shoulder_pan_joint', 'shoulder_lift_joint', 'elbow_joint', 'wrist_1_joint', 'wrist_2_joint', 'wrist_3_joint']
joint_types = [0, 0, 0, 0, 0, 0]

config = Configuration(joint_values, joint_types, joint_names)
# ---------- end ghpython_script_2 ----------
# SIMPLE TESTING
custom_config = Data(ghpython_script_2.config)

panel = Panel("C:\Users\jk6372\Desktop\00_princeton_projects\00_robotic_territories\02_Production\01_SetUp\20250105_setup_working\01_random_trajectory_testing\config_data.json")  # disabled
panel_2 = Panel("C:\Users\jk6372\Desktop\00_princeton_projects\00_robotic_territories\00_git\ur20\just_joint_values.json")  # disabled
button = Button()  # disabled
ghpython_script_3 = GhPythonScript(fp=panel_2, shift_val=number_slider)  # -> out, configurations; inputs shift_val: Int32; disabled
# ---------- ghpython_script_3: Python ----------
from compas.data import json_load
from compas_robots import Configuration

def shift_list(lst, num_shifts):
    num_shifts %= len(lst)  # Ensure it's within bounds
    return lst[num_shifts:] + lst[:num_shifts]

configurations = []
config_base_list = json_load(fp)

joint_names = ['shoulder_pan_joint', 'shoulder_lift_joint', 'elbow_joint', 'wrist_1_joint', 'wrist_2_joint', 'wrist_3_joint']
joint_types = [0, 0, 0, 0, 0, 0]

for item in config_base_list:
#    config = shift_list(item, shift_val)
#    print (item)
#    config = list(reversed(item))
#    print (config)
    config = item
    c_config = Configuration(joint_values=config,
                                    joint_types=joint_types
                                , joint_names=joint_names)
    configurations.append(c_config)
# ---------- end ghpython_script_3 ----------
compas_fab_zero_config_2 = COMPASFABZeroConfig(robot=robot_5, fp=panel, dump=button)  # -> config; inputs dump: Boolean; disabled
# ---------- compas_fab_zero_config_2: Python ----------
from compas.data import json_dump

if robot:
    robot.zero_configuration(group)

if dump:
    data = robot.zero_configuration(group).__data__
    json_dump(data, fp=fp, pretty=True)
# ---------- end compas_fab_zero_config_2 ----------
ghpython_script_4 = GhPythonScript(x=compas_fab_ros_robot)  # -> out, a; disabled
# ---------- ghpython_script_4: Python ----------
print x.zero_configuration().joint_types
# ---------- end ghpython_script_4 ----------
ghpython_script_5 = GhPythonScript(x=ghpython_script_3.configurations)  # -> out, a; inputs x: list; disabled
# ---------- ghpython_script_5: Python ----------
random = []

for key, item in enumerate(x):  # key comes first, item second
    data = {
        "joint_names": item.joint_names,
        "joint_types": item.joint_types,
        "joint_values": item.joint_values,  # Comma added
        "key": key  # Key correctly assigned
    }
    random.append(data)

#print random
# ---------- end ghpython_script_5 ----------
number_slider_2 = Slider(0, range=0..15)  # disabled
panel_3 = Panel("C:\Users\jk6372\Desktop\00_princeton_projects\00_robotic_territories\00_git\ur20\trajectories_testing_raj_fixed.json")
ghpython_script_6 = GhPythonScript(fp=panel_3)  # -> out, trajectory, configs
# ---------- ghpython_script_6: Python ----------
from compas.data import json_load

if fp:
    trajectories = json_load(fp)
    
    configs = []
    for item in trajectories:
        configs.extend(item.points)

for i,c in enumerate(configs):
    print (i, c.joint_values)
# ---------- end ghpython_script_6 ----------
list_item = ListItem(List=ghpython_script_3.configurations, Index=number_slider_2, Wrap=True)  # disabled

robot_7 = Data(robot_4)
value_list = ValueList({"0. zero config": 0, "1. custom config": 1, "2. Trajectory Configs": 2, "3. Configs again": 3}, selected="3. Configs again")

zero_config_2 = Data(zero_config)
custom_config_2 = Data(custom_config)

# ----
# Temp Testing
xy = XYPlane(Origin=Point(0, 0, 0))  # disabled
number_slider_3 = Slider(0.517, range=0..1)  # disabled
# Optitrack - Planning Transformations
pln = Plane(PlaneXY(-1.319669293, -0.3328066128, 0.7837677605))  # disabled

point = Point(Point(0.7848746076, 0.2709877356, 1.142530411))
point_2 = Point(Point(0.6177524018, -0.3682837636, 0.8933714322))
yz_plane = YZPlane(Origin=point)
yz_plane_2 = YZPlane(Origin=point_2)

pln_2 = Plane([Plane(origin=(-0.339782, -0.746000051, 1.00509739), x=(1, 0, 0), y=(0, -1.192092757e-07, -1)), Plane(origin=(-0.108781934, 0.02, 1.00509739), x=(1, 0, 0), y=(0, -1.192092757e-07, -1)), Plane(origin=(-0.152781963, 0.819000065, 1.00509739), x=(1, 0, 0), y=(0, -1.192092757e-07, -1))])  # disabled
panel_4 = Panel("C:\Users\jk6372\Desktop\00_princeton_projects\00_robotic_territories\00_git\ur20\ros_trajectory_test.json")
python = GhPythonScript(x=pln_2)  # -> out, frames; inputs x: list of Plane; disabled
# ---------- python: Python ----------
from compas_rhino.conversions import plane_to_compas_frame

frames = []

for plane in x:
    frame = plane_to_compas_frame(plane)
    frames.append(frame)
# ---------- end python ----------

merge = Merge(Data1=yz_plane_2, Data2=yz_plane)

python_2 = GhPythonScript(optitrack_robot_plane=pln, urdf_base_plane=xy, base_transformation_dist=number_slider_3)  # -> out, transform, inverse_transform, robot_base_frame; inputs optitrack_robot_plane: Plane, urdf_base_plane: Plane; disabled
# ---------- python_2: Python ----------
from compas.geometry import Transformation
from compas.geometry import Translation
from compas_rhino.conversions import plane_to_compas_frame, frame_to_rhino_plane

optitrack_robot_frame = plane_to_compas_frame(optitrack_robot_plane)
urdf_base_frame = plane_to_compas_frame(urdf_base_plane)

translation_vec = optitrack_robot_frame.xaxis + optitrack_robot_frame.yaxis
trans_vec_unitized = translation_vec.unitized()
translation_vector = trans_vec_unitized*base_transformation_dist

translation = Translation.from_vector(translation_vector)
robot_base_frame = optitrack_robot_frame.transformed(translation)

transform = Transformation.from_frame_to_frame(urdf_base_frame, robot_base_frame)
inverse_transform = transform.inverse()
# ---------- end python_2 ----------
draw = Draw(cg=python_2.robot_base_frame)  # -> rg; disabled
#   port cg: The COMPAS geometry or datastructure to be drawn.
# ---------- draw: Python ----------
from compas_rhino.conversions import frame_to_rhino_plane

rg = frame_to_rhino_plane(cg)
# ---------- end draw ----------

# ----
# 5) Solve IK for Planes
# 6) Plan trajectories
draw_2 = Draw(rg=merge)  # -> cgs; inputs rg: list
#   port rg: The COMPAS geometry or datastructure to be drawn.
# ---------- draw_2: Python ----------
from compas_rhino.conversions import plane_to_compas_frame

cgs = []

for plane in rg:
    cg = plane_to_compas_frame(plane)
    cgs.append(cg)
# ---------- end draw_2 ----------
robot_8 = Data(robot_4)
current_config = Data(zero_config)
approach_place_config = Data(current_config)
robot_9 = Data(robot_4)
motion_planes = Data(draw_2)
plan_place = GhPythonScript(robot=robot_9, current_config=current_config, requested_ik_frames=motion_planes, update=Button())  # -> motion_ik_solutions, free_motion_trajectories, free_motion_frames; inputs requested_ik_frames: list
# ---------- plan_place: Python ----------
"""
Calculate placement of a part.
"""
from ghpythonlib.componentbase import executingcomponent as component
from scriptcontext import sticky as st

#from compas.artists import Artist
from compas.scene import Scene
from compas.geometry import Frame
from compas.geometry import Transformation
from compas_rhino.conversions import plane_to_compas_frame
from compas_fab.ghpython.components import create_id
from compas_fab.robots import PlanningScene
from compas.geometry import scale_vector, add_vectors

class PlacePart(component):
    
    
    def RunScript(self, robot, group, current_config, requested_ik_frames, planner_id, collision_meshes, update):

        motion_ik_solutions = None
        free_motion_trajectories = None
        

        self.Message = ""
        if not current_config or not requested_ik_frames:
            print ('here')
            self.Message = "Missing current config or ik planes"
            return motion_ik_solutions, free_motion_trajectories

        if (update or not motion_ik_solutions or not motion_ik_solutions) and robot and robot.client and robot.client.is_connected:
            scene = PlanningScene(robot)

            frames_list = requested_ik_frames

            try:
                ik_solutions = []

                for i, frame in enumerate(frames_list):
                    if i== 0:
                        start_configuration = current_config
                    else:
                        start_configuration = ik_solutions[-1]
                    ik_solution = robot.inverse_kinematics(frame, start_configuration, group)
                    ik_solutions.append(ik_solution)

                motion_ik_solutions = ik_solutions

            except Exception as e:
                import traceback  # Import traceback for detailed error reporting
                print("Error occurred while solving IK:\n", traceback.format_exc())  # Print full traceback for debugging
                raise Exception("Could not solve IK solution. See error details above.")

        self.Message = "Found IK Solutions for Requested Planes"
        return motion_ik_solutions, free_motion_trajectories

    def _convert_planes_list_to_frames_list(self, planes_list):
        return [plane_to_compas_frame(plane) for plane in planes_list]

    def _generate_default_tolerances(self, joints):
        DEFAULT_TOLERANCE_METERS = .001
        DEFAULT_TOLERANCE_RADIANS = math.radians(1)

        return [
            DEFAULT_TOLERANCE_METERS if j.is_scalable()
            else DEFAULT_TOLERANCE_RADIANS
            for j in joints
        ]
# ---------- end plan_place ----------
place_config = Data(plan_place.motion_ik_solutions)
place_config_2 = Data(place_config)
plan_trajectories = GhPythonScript(robot=robot_8, current_config=approach_place_config, ik_solutions=place_config_2, compute=Toggle(True))  # -> motion_trajectories, motion_trajectory_frames; inputs ik_solutions: list, compute: Boolean
# ---------- plan_trajectories: Python ----------
"""
Calculate pickup trajectory of a part.
"""
import math
from ghpythonlib.componentbase import executingcomponent as component
from scriptcontext import sticky as st

#from compas.artists import Artist
from compas.scene import Scene
from compas.geometry import Frame
from compas.geometry import Transformation
from compas_rhino.conversions import plane_to_compas_frame, frame_to_rhino_plane
from compas_fab.ghpython.components import create_id
from compas_fab.robots import AttachedCollisionMesh
from compas_fab.robots import CollisionMesh
from compas_fab.robots import PlanningScene

#from helpers import get_assembly_sequence

class PlanPartPickupTrajectory(component):
    def RunScript(self, robot, group, current_config, ik_solutions, planner_id, compute):
        self.Message = ""

        motion_trajectories = []
        motion_frames = []

        # Clean scene
        if compute and robot and robot.client and robot.client.is_connected:
            scene = PlanningScene(robot)

        if not current_config or not ik_solutions:
            self.Message = "No current_config & ik_solutions defined"
            return motion_trajectories, motion_frames

        try:
            
            for i,ik_solution in enumerate(ik_solutions):
                # Compute MOVE trajectory

                if i == 0:
                    start_config = current_config
                else:
                    start_config = ik_solutions[(i-1)]
                goal_config = ik_solutions[i]
                if compute and robot and robot.client and robot.client.is_connected:
                    planner_id = planner_id or 'TRRT'
        
                    tolerance_above = self._generate_default_tolerances(robot.get_configurable_joints(group))
                    tolerance_below = self._generate_default_tolerances(robot.get_configurable_joints(group))
                    goal_constraints = robot.constraints_from_configuration(
                        configuration=goal_config,
                        tolerances_above=tolerance_above,
                        tolerances_below=tolerance_below,
                        group=group
                    )
        
                    trajectory = robot.plan_motion(goal_constraints,
                                                       start_configuration=start_config,
                                                       group=group,
                                                       options=dict(
                                                       planner_id=planner_id,
            #                                               attached_collision_meshes=attached_collision_meshes
                                                       ))
        
                    motion_trajectory = trajectory
                    motion_trajectories.append(motion_trajectory)

                    if motion_trajectory:
                        for c in motion_trajectory.points:
                            frame = robot.forward_kinematics(c, group, options=dict(solver='model'))
                            motion_frames.extend(frame_to_rhino_plane(frame))

            if len(motion_trajectories) > 0:
                self.Message = "Found Trajectories ({} individual trajectories)".format(len(motion_trajectories))

        except Exception as e:
            import traceback  # Import traceback for detailed error reporting
            print("Error occurred while solving IK:\n", traceback.format_exc())  # Print full traceback for debugging
            raise Exception("Could not solve IK solution. See error details above.")

        return motion_trajectories, motion_frames

    def _generate_default_tolerances(self, joints):
        DEFAULT_TOLERANCE_METERS = .001
        DEFAULT_TOLERANCE_RADIANS = math.radians(1)

        return [
            DEFAULT_TOLERANCE_METERS if j.is_scalable()
            else DEFAULT_TOLERANCE_RADIANS
            for j in joints
        ]
# ---------- end plan_trajectories ----------
approach_place_config_2 = Data(plan_place.free_motion_trajectories)
place_trajectory = Data(plan_trajectories.motion_trajectory_frames)
move_trajectory = Data(plan_trajectories.motion_trajectories)

ghpython_script_7 = GhPythonScript(trajectories=move_trajectory, dump=Button(), fp=panel_4)  # -> out, configs; inputs trajectories: list, dump: Boolean
# ---------- ghpython_script_7: Python ----------
from compas.data import json_dump
from compas_fab.robots import JointTrajectory

configs = []

for trajectory in trajectories:
    configs.extend(trajectory.points)

if dump:
    trajectory = JointTrajectory(configs)
    json_dump(trajectory, fp, pretty=True)
# ---------- end ghpython_script_7 ----------
stream_filter = StreamFilter(
    Gate=value_list,
    Stream0=zero_config_2,
    Stream1=custom_config_2,
    Stream2=ghpython_script_6.configs,
    Stream3=ghpython_script_7.configs)
list_item_2 = ListItem(List=stream_filter, Index=Slider(0, range=0..14), Wrap=True)

# ----
# 4. Robot Visualization
compas_fab_robot_visualize = COMPASFABRobotVisualize(robot=robot_7, configuration=list_item_2, show_base_frame=True)  # -> visual, collision, collision_meshes, attached_meshes, frames, base_frame, ee_frame; inputs show_visual: Boolean, show_collision: Boolean, show_frames: Boolean, show_base_frame: Boolean, show_end_effector_frame: Boolean, show_cm: Boolean, show_acm: Boolean
#   port group: The planning group used for end-effector and base visualization.
#   port configuration: The robot's full configuration.
#   port show_visual: Whether or not to show the robot's visual meshes.
#   port show_collision: Whether or not to show the robot's collision meshes.
#   port show_frames: Whether or not to show the robot's joint frames.
#   port show_base_frame: Whether or not to show the robot's base frame.
#   port show_end_effector_frame: Whether or not to show the robot's end-effector frame.
#   port show_cm: Whether or not to show the collision meshes (if any).
#   port show_acm: Whether or not to show the attached collision meshes (if any).
#   port visual: Rhino meshes of the robot's visual geometry (if any).
#   port collision: Rhino meshes of the robot's collision geometry (if any).
#   port collision_meshes: Rhino meshes of the scene's collision meshes (if any).
#   port attached_meshes: Rhino meshes of the scene's attached collision meshes (if any).
#   port frames: The robot's joint frames as Rhino planes (if any).
#   port base_frame: The robot's base frame as a Rhino plane (if any).
#   port ee_frame: The robot's end-effector frame as a Rhino plane (if any).
# ---------- compas_fab_robot_visualize: Python ----------
"""
Visualizes the robot.

COMPAS FAB v1.0.2
"""

import time

from compas.geometry import Frame
from compas.geometry import Transformation
from compas.scene import SceneObject
from compas_ghpython import create_id
from compas_rhino.conversions import frame_to_rhino_plane
from ghpythonlib.componentbase import executingcomponent as component
from scriptcontext import sticky as st

from compas_fab.backends import BackendFeatureNotSupportedError
from compas_fab.robots import PlanningScene


class RobotVisualize(component):
    def RunScript(
        self,
        robot,
        group,
        configuration,
        show_visual,
        show_collision,
        show_frames,
        show_base_frame,
        show_end_effector_frame,
        show_cm,
        show_acm,
    ):
        visual = None
        collision = None
        collision_meshes = None
        attached_meshes = None
        frames = None
        base_frame = None
        ee_frame = None

        if robot:
            show_visual = True if show_visual is None else show_visual
            show_cm = True if show_cm is None else show_cm
            show_acm = True if show_acm is None else show_acm
            configuration = configuration or robot.zero_configuration()

            robot.update(configuration, visual=show_visual, collision=show_collision)
            compas_frames = robot.transformed_frames(configuration, group)

            if show_visual:
                visual = robot.scene_object.draw_visual()

            if show_collision:
                collision = robot.scene_object.draw_collision()

            if show_base_frame:
                base_compas_frame = compas_frames[0]
                base_frame = frame_to_rhino_plane(base_compas_frame)

            if show_end_effector_frame:
                options = dict(solver="model")
                if robot.attached_tool:
                    options["link"] = robot.attached_tool.connected_to

                ee_compas_frame = robot.forward_kinematics(configuration, group, options=options)
                ee_frame = frame_to_rhino_plane(ee_compas_frame)

            if show_frames:
                frames = []
                for compas_frame in compas_frames[1:]:
                    frame = frame_to_rhino_plane(compas_frame)
                    frames.append(frame)

            cached_scene_key = create_id(self, "cached_scene")

            if show_cm or show_acm:
                cached_scene = st.get(cached_scene_key)
                if not cached_scene:
                    cached_scene = {"time": 0}

                # expire cache if the component has not been executed in the last 2 seconds
                # this allows to slide through a list of configurations
                # without triggering refreshes of the scene in the middle of it
                if time.time() - cached_scene["time"] > 2:
                    update_scene = True
                else:
                    update_scene = False

                if update_scene:
                    scene = PlanningScene(robot)
                    try:
                        scene = robot.client.get_planning_scene()
                    except BackendFeatureNotSupportedError:
                        print(
                            "The selected backend does not support collision meshes. If you need collision mesh support, use a different backend."
                        )
                        scene = None
                        show_cm = False
                        show_acm = False

                if update_scene and show_cm:
                    collision_meshes = []

                    for co in scene.world.collision_objects:
                        header = co.header
                        frame_id = header.frame_id
                        cms = co.to_collision_meshes()

                        for cm in cms:
                            if cm.frame != Frame.worldXY():
                                t = Transformation.from_frame(cm.frame)
                                mesh = cm.mesh.transformed(t)
                            else:
                                mesh = cm.mesh

                            collision_meshes.extend(SceneObject(mesh).draw())

                        cached_scene["cm"] = collision_meshes

                collision_meshes = cached_scene.get("cm", [])

                if update_scene and show_acm:
                    attached_meshes = []

                    for aco in scene.robot_state.attached_collision_objects:
                        for acm in aco.to_attached_collision_meshes():
                            frame_id = aco.object["header"]["frame_id"]
                            frame = robot.forward_kinematics(configuration, options=dict(link=frame_id))
                            t = Transformation.from_frame(frame)

                            # Local CM frame
                            if acm.collision_mesh.frame and acm.collision_mesh.frame != Frame.worldXY():
                                t = t * Transformation.from_frame(acm.collision_mesh.frame)

                            mesh = acm.collision_mesh.mesh.transformed(t)

                            attached_meshes.extend(SceneObject(mesh).draw())

                    cached_scene["acm"] = attached_meshes

                attached_meshes = cached_scene.get("acm", [])

                cached_scene["time"] = time.time()
                st[cached_scene_key] = cached_scene

        return (
            visual,
            collision,
            collision_meshes,
            attached_meshes,
            frames,
            base_frame,
            ee_frame,
        )
# ---------- end compas_fab_robot_visualize ----------
mesh = Mesh(compas_fab_robot_visualize.visual)

# ----
# Get Current Config
button_2 = Button()  # disabled
get_config = GhPythonScript(send=button_2)  # -> config, frame; disabled
# ---------- get_config: Python ----------
import os
from scriptcontext import sticky as st
#sticky is a persistent dictionary which can save values and also be acessed by other GH components
#we use it here with a custom key to store values we read from the robot
from compas.rpc import Proxy
from compas.geometry import Frame
package_path = ghdoc.Path

config_key = 'config_{}'.format(str(ghenv.Component.InstanceGuid))
new_key = 'new_key_{}'.format(str(ghenv.Component.InstanceGuid))
frame_key = 'frame_{}'.format(str(ghenv.Component.InstanceGuid))

if config_key not in st:
    st[config_key] = None

if frame_key not in st:
    st[frame_key] = None

if send:
    canvas = ghenv.Component.OnPingDocument()
    path = os.path.abspath(os.path.join(package_path,"../fabrication", "control"))
    print (path)
    rtde = Proxy('fabrication', path=path)
    st[config_key] = rtde.get_config(ip=ip)
    st[new_key] = rtde.get_config(ip=ip)
    st[frame_key] = robot.forward_kinematics(st[config_key], group, options=dict(solver='model'))
#    a = rtde.get_config(ip=ip)

config = st[config_key]
frame = st[frame_key]

#print "joint values: ", config.joint_values

#frame_WCF = frame_RCF.transformed(robot.transformation_BCF_WCF())
#print frame_RCF
# ---------- end get_config ----------
draw_3 = Draw(cg=get_config.frame)  # -> rg; disabled
#   port cg: The COMPAS geometry or datastructure to be drawn.
#   port rg: The Rhino geometry object.
# ---------- draw_3: Python ----------
"""
Draws COMPAS geometry in Grasshopper.
"""
from ghpythonlib.componentbase import executingcomponent as component

from compas_rhino.conversions import frame_to_rhino_plane


class CompasToRhinoGeometry(component):
    def RunScript(self, cg):
        if not cg:
            return None

        return frame_to_rhino_plane(cg)
# ---------- end draw_3 ----------

# ----
# Requested Robot Frames
frames = Data(python.frames)  # disabled
# FIXED
inversetx = Data(python_2.inverse_transform)  # disabled
requested_planes = GhPythonScript(frames=frames, inverse_transform=inversetx)  # -> out, frames_trans; inputs frames: list; disabled
# ---------- requested_planes: Python ----------
frames_trans = []

for frame in frames:
    transformed_frame = frame.transformed(inverse_transform)
    frames_trans.append(transformed_frame)
# ---------- end requested_planes ----------

# ----
# Config Storage
ghpython_script_8 = GhPythonScript(config=get_config.config)  # -> data; disabled
# ---------- ghpython_script_8: Python ----------
from compas.data import json_dumps

data_dict = {}
data_dict["config"] = config.__data__
print type(data_dict["config"])
a = [data_dict]
# ---------- end ghpython_script_8 ----------
data = Data("Grasshopper.Kernel.Types.GH_ObjectWrapper")  # disabled
ghpython_script_9 = GhPythonScript(data=data)  # -> config; disabled
# ---------- ghpython_script_9: Python ----------
from compas_robots import Configuration

a = Configuration.__from_data__(data["config"])
# ---------- end ghpython_script_9 ----------

# ----
# Trajectory Testing Components
compas_fab_zero_config_3 = COMPASFABZeroConfig(robot=robot_4)  # -> config; disabled; same code as compas_fab_zero_config

# ----
# 4. COMPAS FAB - Plan Trajectories
# 5) Solve IK for Planes
# 6) Plan trajectories
robot_10 = Data(robot_4)  # disabled
current_config_2 = Data(compas_fab_zero_config_3)  # disabled
approach_place_config_3 = Data(current_config_2)  # disabled
robot_11 = Data(robot_4)  # disabled
motion_planes_2 = Data(requested_planes.frames_trans)  # disabled
toggle = BooleanToggle(True)  # disabled
button_3 = Button()  # disabled
plan_place_2 = GhPythonScript(robot=robot_11, current_config=current_config_2, requested_ik_frames=motion_planes_2, update=button_3)  # -> motion_ik_solutions, free_motion_trajectories, free_motion_frames; inputs requested_ik_frames: list; disabled; same code as plan_place
place_config_3 = Data(plan_place_2.motion_ik_solutions)  # disabled
plan_trajectories_2 = GhPythonScript(robot=robot_10, current_config=approach_place_config_3, ik_solutions=place_config_3, compute=toggle)  # -> motion_trajectories, motion_trajectory_frames; inputs ik_solutions: list, compute: Boolean; disabled; same code as plan_trajectories
approach_place_config_4 = Data(plan_place_2.free_motion_trajectories)  # disabled
place_trajectory_2 = Data(plan_trajectories_2.motion_trajectory_frames)  # disabled
place_config_4 = Data(plan_place_2.motion_ik_solutions)  # disabled
move_trajectory_2 = Data(plan_trajectories_2.motion_trajectories)  # disabled

python_3 = GhPythonScript(x=move_trajectory_2)  # -> out, a; inputs x: list; disabled
# ---------- python_3: Python ----------
a = []

for item in x:
    a.extend(item.points)
# ---------- end python_3 ----------
number_slider_4 = Slider(0, range=0..10)  # disabled

# ----
# Selection
number_slider_5 = Slider(1, range=0..1)  # disabled
ghpython_script_10 = GhPythonScript(selected=python_3.a, i=number_slider_5)  # -> config; disabled
# ---------- ghpython_script_10: Python ----------
import ghpythonlib.components as ghcomp
import compas_fab
from compas_fab.robots.robot import Configuration

def remap(value, source_min, source_max, target_min, target_max):

    normalized_value = (value - source_min) / (source_max - source_min)
    remapped_value = target_min + normalized_value * (target_max - target_min)
    return remapped_value

def trajectory_points_to_configs(trajectory_points):
    configs = [] 
    for trajectory_point in trajectory_points:
        config = Configuration(trajectory_point.joint_values, trajectory_point.joint_types, trajectory_point.joint_names)
        configs.append(config)
    return configs

if isinstance(selected, compas_fab.robots.trajectory.JointTrajectory):
    selected = trajectory_points_to_configs (selected.points)
    index = int(remap(i, 0.001, 1.00, 0, len(selected) - 1))
    index = min(max(0, index), len(selected) - 1)
    result = selected[index]
elif isinstance(selected, Configuration):
    result = selected
else:
    result = None  

config = result
# ---------- end ghpython_script_10 ----------

item = ListItem(List=place_config_4, Index=number_slider_4, Wrap=True)  # disabled
number_slider_6 = Slider(83, range=0..100)  # disabled
item_2 = ListItem(List=python_3.a, Index=number_slider_6, Wrap=True)  # disabled
