# Grasshopper definition 00_end_effector_writer.ghx (Grasshopper 1.0.7)

point = Point(Point(-5.846568416e-07, 7.357176641e-07, 0.07257158337))
mesh = Mesh(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)
mesh_2 = Mesh(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)

robot = ValueList({"ur3": 0, "ur5": 1, "ur10e": 2, "ur20": 3}, selected="ur20")
mesh_3 = Mesh(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)
mesh_4 = Mesh(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)
point_2 = Point(Point(0, 0, 0.1098150101))

# ----
# End Effector .json Writer
panel = Panel("piab_gripper")
export = Button()
xy_plane = XYPlane(Origin=point_2)
ghpython_script = GhPythonScript(ee_name=panel, robot=robot, visual_mesh=mesh_4, tcf_plane=xy_plane, collision_mesh=mesh_3, export=export)  # inputs robot: Int32, visual_mesh: Mesh, tcf_plane: Plane, collision_mesh: Mesh
# ---------- ghpython_script: Python ----------
from compas.data import json_dump, json_dumps
from compas_rhino.conversions import plane_to_compas_frame, mesh_to_compas
import os
import sys

canvas = ghenv.Component.OnPingDocument()
path = canvas.FilePath
dir_path = os.path.dirname(path)
robots = ["ur3", "ur5", "ur10e", "ur20"]
robot = robots[robot]
ee_path = os.path.join(dir_path, robot, ee_name + ".json")


if not (tcf_plane and visual_mesh):
    ghenv.Component.Message = "Missing End Effector Information"
else:
    ee_frame = plane_to_compas_frame(tcf_plane)
    ee_visual_mesh = mesh_to_compas(visual_mesh)
    ghenv.Component.Message = None
    
    ee_dict = {}
    ee_dict["visual_mesh"] = ee_visual_mesh
    ee_dict["tcf"] = ee_frame
    
    if collision_mesh:
        ee_collision_mesh = mesh_to_compas(collision_mesh)
        ee_dict["collision_mesh"] = ee_collision_mesh
    
    if export:
        json_dump(ee_dict, ee_path, pretty=True)
        ghenv.Component.Message = "Exported: {}".format(ee_name)
# ---------- end ghpython_script ----------
