# Grasshopper definition 00_define_simple_goals.ghx (Grasshopper 1.0.7)

# ----
# Goal 00
box = Box([{Plane=PlaneXY(-0.15, -0.15, -0.15), X=Domain(0, 0.3), Y=Domain(0, 0.3), Z=Domain(0, 0.3)}, {Plane=Plane(origin=(-0.15, 0.5008, -0.1500000001), x=(1, 0, 0), y=(0, -1, 0)), X=Domain(0, 0.3), Y=Domain(0, 0.3), Z=Domain(-0.3, 0)}, {Plane=Plane(origin=(0.2008, 0.15, -0.15), x=(1, 0, 0), y=(0, -1, 0)), X=Domain(0, 0.3), Y=Domain(0, 0.3), Z=Domain(-0.3, 0)}, {Plane=PlaneXY(0.2008, 0.2008, -0.1500000001), X=Domain(0, 0.3), Y=Domain(0, 0.3), Z=Domain(0, 0.3)}, {Plane=PlaneXY(0.5516, -0.15, -0.15), X=Domain(0, 0.3), Y=Domain(0, 0.3), Z=Domain(0, 0.3)}, {Plane=PlaneXY(0.5516, 0.2008, -0.1500000001), X=Domain(0, 0.3), Y=Domain(0, 0.3), Z=Domain(0, 0.3)}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])
panel = Panel("Goal00")

# ----
# Goal 01
box_2 = Box([{Plane=PlaneXY(-0.15, -0.15, -0.15), X=Domain(0, 0.3), Y=Domain(0, 0.3), Z=Domain(0, 0.3)}, {Plane=Plane(origin=(0.2008, 0.15, -0.15), x=(1, 0, 0), y=(0, -1, 0)), X=Domain(0, 0.3), Y=Domain(0, 0.3), Z=Domain(-0.3, 0)}, {Plane=Plane(origin=(0.5516, 0.15, -0.15), x=(1, 0, 0), y=(0, -1, 0)), X=Domain(0, 0.3), Y=Domain(0, 0.3), Z=Domain(-0.3, 0)}, {Plane=PlaneXY(0.9024, -0.15, -0.1500000001), X=Domain(0, 0.3), Y=Domain(0, 0.3), Z=Domain(0, 0.3)}, {Plane=PlaneXY(1.2532, -0.15, -0.1500000001), X=Domain(0, 0.3), Y=Domain(0, 0.3), Z=Domain(0, 0.3)}, {Plane=Plane(origin=(1.604, 0.15, -0.1500000001), x=(1, 0, 0), y=(0, -1, 0)), X=Domain(0, 0.3), Y=Domain(0, 0.3), Z=Domain(-0.3, 0)}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])
panel_2 = Panel("Goal01")

# ----
# Goal 02
box_3 = Box([{Plane=PlaneXY(-0.15, -0.15, -0.15), X=Domain(0, 0.3), Y=Domain(0, 0.3), Z=Domain(0, 0.3)}, {Plane=Plane(origin=(0.2008, 0.15, -0.15), x=(1, 0, 0), y=(0, -1, 0)), X=Domain(0, 0.3), Y=Domain(0, 0.3), Z=Domain(-0.3, 0)}, {Plane=Plane(origin=(0.5516, 0.15, -0.15), x=(1, 0, 0), y=(0, -1, 0)), X=Domain(0, 0.3), Y=Domain(0, 0.3), Z=Domain(-0.3, 0)}, {Plane=PlaneXY(-0.15, 0.2008, -0.1500000001), X=Domain(0, 0.3), Y=Domain(0, 0.3), Z=Domain(0, 0.3)}, {Plane=PlaneXY(0.5516, 0.2008, -0.1500000001), X=Domain(0, 0.3), Y=Domain(0, 0.3), Z=Domain(0, 0.3)}, {Plane=PlaneXY(-0.15, 0.5516, -0.1500000003), X=Domain(0, 0.3), Y=Domain(0, 0.3), Z=Domain(0, 0.3)}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])
panel_3 = Panel("Goal02")

# ----
# Goal 09
box_4 = Box([{Plane=PlaneXY(-0.15, -0.15, -0.15), X=Domain(0, 0.3), Y=Domain(0, 0.3), Z=Domain(0, 0.3)}, {Plane=Plane(origin=(-0.15, 0.5008, -0.1500000003), x=(1, 0, 0), y=(0, -1, 0)), X=Domain(0, 0.3), Y=Domain(0, 0.3), Z=Domain(-0.3, 0)}, {Plane=Plane(origin=(0.2008, 0.15, -0.1499999999), x=(1, 0, 0), y=(0, -1, 0)), X=Domain(0, 0.3), Y=Domain(0, 0.3), Z=Domain(-0.3, 0)}, {Plane=PlaneXY(-0.15, 0.5516, -0.1500000011), X=Domain(0, 0.3), Y=Domain(0, 0.3), Z=Domain(0, 0.3)}, {Plane=PlaneXY(0.5516, -0.15, -0.1499999997), X=Domain(0, 0.3), Y=Domain(0, 0.3), Z=Domain(0, 0.3)}, {Plane=PlaneXY(0.9024, -0.15, -0.1499999996), X=Domain(0, 0.3), Y=Domain(0, 0.3), Z=Domain(0, 0.3)}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])

panel_4 = Panel("Goal05")
# Goal 05
box_5 = Box([{Plane=PlaneXY(-0.15, -0.15, -0.15), X=Domain(0, 0.3), Y=Domain(0, 0.3), Z=Domain(0, 0.3)}, {Plane=PlaneXY(0.2008, -0.15, -0.15), X=Domain(0, 0.3), Y=Domain(0, 0.3), Z=Domain(0, 0.3)}, {Plane=Plane(origin=(-0.15, 0.5008, -0.1500000001), x=(1, 0, 0), y=(0, -1, 0)), X=Domain(0, 0.3), Y=Domain(0, 0.3), Z=Domain(-0.3, 0)}, {Plane=Plane(origin=(0.5516, 0.15, -0.15), x=(1, 0, 0), y=(0, -1, 0)), X=Domain(0, 0.3), Y=Domain(0, 0.3), Z=Domain(-0.3, 0)}, {Plane=Plane(origin=(-0.15, 0.8516, -0.1500000003), x=(1, 0, 0), y=(0, -1, 0)), X=Domain(0, 0.3), Y=Domain(0, 0.3), Z=Domain(-0.3, 0)}, {Plane=PlaneXY(0.9024, -0.15, -0.1500000003), X=Domain(0, 0.3), Y=Domain(0, 0.3), Z=Domain(0, 0.3)}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])

panel_5 = Panel("Goal06")
# Goal 06
box_6 = Box([{Plane=Plane(origin=(-0.15, 0.15, -0.15), x=(1, 0, 0), y=(0, -1, 0)), X=Domain(0, 0.3), Y=Domain(0, 0.3), Z=Domain(-0.3, 0)}, {Plane=Plane(origin=(-0.15, 0.5008, -0.1500000001), x=(1, 0, 0), y=(0, -1, 0)), X=Domain(0, 0.3), Y=Domain(0, 0.3), Z=Domain(-0.3, 0)}, {Plane=PlaneXY(0.2008, -0.15, -0.15), X=Domain(0, 0.3), Y=Domain(0, 0.3), Z=Domain(0, 0.3)}, {Plane=Plane(origin=(0.2008, 0.5008, -0.1500000004), x=(1, 0, 0), y=(0, -1, 0)), X=Domain(0, 0.3), Y=Domain(0, 0.3), Z=Domain(-0.3, 0)}, {Plane=PlaneXY(0.5516, -0.15, -0.15), X=Domain(0, 0.3), Y=Domain(0, 0.3), Z=Domain(0, 0.3)}, {Plane=PlaneXY(0.5516, 0.2008, -0.15), X=Domain(0, 0.3), Y=Domain(0, 0.3), Z=Domain(0, 0.3)}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])

panel_6 = Panel("Goal07")
# Goal 07
box_7 = Box([{Plane=PlaneXY(-0.15, -0.15, -0.15), X=Domain(0, 0.3), Y=Domain(0, 0.3), Z=Domain(0, 0.3)}, {Plane=Plane(origin=(-0.15, 0.5008, -0.1500000001), x=(1, 0, 0), y=(0, -1, 0)), X=Domain(0, 0.3), Y=Domain(0, 0.3), Z=Domain(-0.3, 0)}, {Plane=Plane(origin=(0.2008, 0.15, -0.15), x=(1, 0, 0), y=(0, -1, 0)), X=Domain(0, 0.3), Y=Domain(0, 0.3), Z=Domain(-0.3, 0)}, {Plane=PlaneXY(0.2008, 0.2008, -0.1500000001), X=Domain(0, 0.3), Y=Domain(0, 0.3), Z=Domain(0, 0.3)}, {Plane=Plane(origin=(0.5516, 0.15, -0.15), x=(1, 0, 0), y=(0, -1, 0)), X=Domain(0, 0.3), Y=Domain(0, 0.3), Z=Domain(-0.3, 0)}, {Plane=Plane(origin=(0.9024, 0.15, -0.15), x=(1, 0, 0), y=(0, -1, 0)), X=Domain(0, 0.3), Y=Domain(0, 0.3), Z=Domain(-0.3, 0)}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])

panel_7 = Panel("Goal08")
# Goal 08
box_8 = Box([{Plane=PlaneXY(-0.15, -0.15, -0.15), X=Domain(0, 0.3), Y=Domain(0, 0.3), Z=Domain(0, 0.3)}, {Plane=PlaneXY(0.2008, -0.15, -0.1499999999), X=Domain(0, 0.3), Y=Domain(0, 0.3), Z=Domain(0, 0.3)}, {Plane=PlaneXY(0.5516, -0.15, -0.1499999997), X=Domain(0, 0.3), Y=Domain(0, 0.3), Z=Domain(0, 0.3)}, {Plane=Plane(origin=(0.2008, 0.5008, -0.15), x=(1, 0, 0), y=(0, -1, 0)), X=Domain(0, 0.3), Y=Domain(0, 0.3), Z=Domain(-0.3, 0)}, {Plane=PlaneXY(0.5516, 0.2008, -0.1499999999), X=Domain(0, 0.3), Y=Domain(0, 0.3), Z=Domain(0, 0.3)}, {Plane=PlaneXY(0.9024, 0.2008, -0.1499999997), X=Domain(0, 0.3), Y=Domain(0, 0.3), Z=Domain(0, 0.3)}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])

panel_8 = Panel("Goal04")
# Goal 04
box_9 = Box([{Plane=Plane(origin=(-0.15, 0.15, -0.15), x=(1, 0, 0), y=(0, -1, 0)), X=Domain(0, 0.3), Y=Domain(0, 0.3), Z=Domain(-0.3, 0)}, {Plane=PlaneXY(0.2008, -0.15, -0.1500000003), X=Domain(0, 0.3), Y=Domain(0, 0.3), Z=Domain(0, 0.3)}, {Plane=PlaneXY(0.5516, -0.15, -0.1500000003), X=Domain(0, 0.3), Y=Domain(0, 0.3), Z=Domain(0, 0.3)}, {Plane=Plane(origin=(0.9024, 0.15, -0.1500000003), x=(1, 0, 0), y=(0, -1, 0)), X=Domain(0, 0.3), Y=Domain(0, 0.3), Z=Domain(-0.3, 0)}, {Plane=Plane(origin=(0.9024, 0.5008, -0.1500000001), x=(1, 0, 0), y=(0, -1, 0)), X=Domain(0, 0.3), Y=Domain(0, 0.3), Z=Domain(-0.3, 0)}, {Plane=PlaneXY(0.9024, 0.5516, -0.15), X=Domain(0, 0.3), Y=Domain(0, 0.3), Z=Domain(0, 0.3)}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])

panel_9 = Panel("Goal03")
# Goal 03
box_10 = Box([{Plane=Plane(origin=(-0.15, 0.15, -0.15), x=(1, 0, 0), y=(0, -1, 0)), X=Domain(0, 0.3), Y=Domain(0, 0.3), Z=Domain(-0.3, 0)}, {Plane=PlaneXY(0.2008, -0.15, -0.15), X=Domain(0, 0.3), Y=Domain(0, 0.3), Z=Domain(0, 0.3)}, {Plane=PlaneXY(0.2008, 0.2008, -0.1500000001), X=Domain(0, 0.3), Y=Domain(0, 0.3), Z=Domain(0, 0.3)}, {Plane=PlaneXY(0.5516, -0.15, -0.15), X=Domain(0, 0.3), Y=Domain(0, 0.3), Z=Domain(0, 0.3)}, {Plane=Plane(origin=(0.5516, 0.5008, -0.1500000001), x=(1, 0, 0), y=(0, -1, 0)), X=Domain(0, 0.3), Y=Domain(0, 0.3), Z=Domain(-0.3, 0)}, {Plane=Plane(origin=(0.9024, 0.15, -0.15), x=(1, 0, 0), y=(0, -1, 0)), X=Domain(0, 0.3), Y=Domain(0, 0.3), Z=Domain(-0.3, 0)}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])

# ----
# QUICK FIX FOR TESTING
cluster = Cluster(geometry=box_5)

# ----
# QUICK FIX FOR TESTING
cluster_2 = Cluster(geometry=box_4)

# ----
# QUICK FIX FOR TESTING
cluster_3 = Cluster(geometry=box_6)

# ----
# QUICK FIX FOR TESTING
cluster_4 = Cluster(geometry=box_8)

# ----
# QUICK FIX FOR TESTING
cluster_5 = Cluster(geometry=box_10)

# ----
# QUICK FIX FOR TESTING
cluster_6 = Cluster(geometry=box_3)

# ----
# QUICK FIX FOR TESTING
cluster_7 = Cluster(geometry=box_9)

# ----
# QUICK FIX FOR TESTING
cluster_8 = Cluster(geometry=box)

# ----
# QUICK FIX FOR TESTING
cluster_9 = Cluster(geometry=box_7)

# ----
# QUICK FIX FOR TESTING
cluster_10 = Cluster(geometry=box_2)

panel_10 = Panel("C:\Users\jk6372\Desktop\00_princeton_projects\00_robotic_territories\00_git\compas_xr_robotic_territories\dev\performance_operations\inference\goals_2")
number_slider = Slider(0, range=0..10)
ghpython_script = GhPythonScript(folder_fp=panel_10, box_list=cluster_8, name="Goal09", frame_rot=Toggle(False), write=Button())  # -> out, box_frames; inputs box_list: list of Box, frame_rot: Boolean, write: Boolean
# ---------- ghpython_script: Python ----------
import os
from compas_rhino.conversions import box_to_compas, frame_to_rhino
from compas.data import json_dump
from compas.geometry import Rotation
import math


goal_data = {}
goal_data["name"] = name
goal_data["cube_locations"] = {}

goal_fp = os.path.join(folder_fp, str(name+".json"))

box_frames = []


for i,box in enumerate(box_list):
    compas_box = box_to_compas(box)
    if frame_rot:
        Rz90_local = Rotation.from_axis_and_angle(compas_box.frame.zaxis, math.radians(-90), point=compas_box.frame.point)
        rotated_frame = compas_box.frame.transformed(Rz90_local)
        compas_box.frame = rotated_frame
    key = "G"+str(i)
    goal_data["cube_locations"][key] = compas_box
    box_frames.append(frame_to_rhino(compas_box.frame))

if write:
    json_dump(data=goal_data, fp=goal_fp, pretty=True)
# ---------- end ghpython_script ----------
list_item = ListItem(List=cluster_8, Index=number_slider, Wrap=True)
list_item_2 = ListItem(List=ghpython_script.box_frames, Index=number_slider, Wrap=True)

# ----
# Goal 02
geometry = Geometry([<brep referenced from the Rhino model> x6])

# ----
# Goal 03
geometry_2 = Geometry([<brep referenced from the Rhino model> x6])

# ----
# Goal 01
box_11 = Box([{Plane=PlaneXY(-0.15, -0.15, -0.15), X=Domain(0, 0.3), Y=Domain(0, 0.3), Z=Domain(0, 0.3)}, {Plane=Plane(origin=(0.2008, 0.15, -0.15), x=(1, 0, 0), y=(0, -1, 0)), X=Domain(0, 0.3), Y=Domain(0, 0.3), Z=Domain(-0.3, 0)}, {Plane=Plane(origin=(0.5516, 0.15, -0.15), x=(1, 0, 0), y=(0, -1, 0)), X=Domain(0, 0.3), Y=Domain(0, 0.3), Z=Domain(-0.3, 0)}, {Plane=PlaneXY(0.9024, -0.15, -0.1500000001), X=Domain(0, 0.3), Y=Domain(0, 0.3), Z=Domain(0, 0.3)}, {Plane=PlaneXY(1.2532, -0.15, -0.1500000001), X=Domain(0, 0.3), Y=Domain(0, 0.3), Z=Domain(0, 0.3)}, {Plane=Plane(origin=(1.604, 0.15, -0.1500000001), x=(1, 0, 0), y=(0, -1, 0)), X=Domain(0, 0.3), Y=Domain(0, 0.3), Z=Domain(-0.3, 0)}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])  # disabled
panel_13 = Panel("Goal01")  # disabled

# ----
# Goal 02
box_12 = Box([{Plane=PlaneXY(-0.15, -0.15, -0.15), X=Domain(0, 0.3), Y=Domain(0, 0.3), Z=Domain(0, 0.3)}, {Plane=Plane(origin=(0.2008, 0.15, -0.15), x=(1, 0, 0), y=(0, -1, 0)), X=Domain(0, 0.3), Y=Domain(0, 0.3), Z=Domain(-0.3, 0)}, {Plane=Plane(origin=(0.5516, 0.15, -0.15), x=(1, 0, 0), y=(0, -1, 0)), X=Domain(0, 0.3), Y=Domain(0, 0.3), Z=Domain(-0.3, 0)}, {Plane=PlaneXY(-0.15, 0.2008, -0.1500000001), X=Domain(0, 0.3), Y=Domain(0, 0.3), Z=Domain(0, 0.3)}, {Plane=PlaneXY(0.5516, 0.2008, -0.1500000001), X=Domain(0, 0.3), Y=Domain(0, 0.3), Z=Domain(0, 0.3)}, {Plane=PlaneXY(-0.15, 0.5516, -0.1500000003), X=Domain(0, 0.3), Y=Domain(0, 0.3), Z=Domain(0, 0.3)}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])  # disabled
panel_14 = Panel("Goal02")  # disabled

# ----
# 6 part goals for Study
# Goal 00
geometry_3 = Geometry([<brep referenced from the Rhino model> x6])

# ----
# Goal 04
geometry_4 = Geometry([<brep referenced from the Rhino model> x6])

# ----
# Goal 01
geometry_5 = Geometry([<brep referenced from the Rhino model> x6])

# ----
# Goal 06
geometry_6 = Geometry([<brep referenced from the Rhino model> x6])

# ----
# Goal 05
geometry_7 = Geometry([<brep referenced from the Rhino model> x6])

# ----
# Goal 07
geometry_8 = Geometry([<brep referenced from the Rhino model> x6])

# ----
# Goal 08
geometry_9 = Geometry([<brep referenced from the Rhino model> x6])

panel_21 = Panel("Goal09")
# Goal 09
geometry_10 = Geometry([<brep referenced from the Rhino model> x6])

panel_22 = Panel("Goal09")  # disabled
# Goal 09
box_13 = Box([{Plane=PlaneXY(-0.15, -0.15, -0.15), X=Domain(0, 0.3), Y=Domain(0, 0.3), Z=Domain(0, 0.3)}, {Plane=Plane(origin=(-0.15, 0.5008, -0.1500000003), x=(1, 0, 0), y=(0, -1, 0)), X=Domain(0, 0.3), Y=Domain(0, 0.3), Z=Domain(-0.3, 0)}, {Plane=Plane(origin=(0.2008, 0.15, -0.1499999999), x=(1, 0, 0), y=(0, -1, 0)), X=Domain(0, 0.3), Y=Domain(0, 0.3), Z=Domain(-0.3, 0)}, {Plane=PlaneXY(-0.15, 0.5516, -0.1500000011), X=Domain(0, 0.3), Y=Domain(0, 0.3), Z=Domain(0, 0.3)}, {Plane=PlaneXY(0.5516, -0.15, -0.1499999997), X=Domain(0, 0.3), Y=Domain(0, 0.3), Z=Domain(0, 0.3)}, {Plane=PlaneXY(0.9024, -0.15, -0.1499999996), X=Domain(0, 0.3), Y=Domain(0, 0.3), Z=Domain(0, 0.3)}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])  # disabled

panel_23 = Panel("Goal05")  # disabled
# Goal 05
box_14 = Box([{Plane=PlaneXY(-0.15, -0.15, -0.15), X=Domain(0, 0.3), Y=Domain(0, 0.3), Z=Domain(0, 0.3)}, {Plane=PlaneXY(0.2008, -0.15, -0.15), X=Domain(0, 0.3), Y=Domain(0, 0.3), Z=Domain(0, 0.3)}, {Plane=Plane(origin=(-0.15, 0.5008, -0.1500000001), x=(1, 0, 0), y=(0, -1, 0)), X=Domain(0, 0.3), Y=Domain(0, 0.3), Z=Domain(-0.3, 0)}, {Plane=Plane(origin=(0.5516, 0.15, -0.15), x=(1, 0, 0), y=(0, -1, 0)), X=Domain(0, 0.3), Y=Domain(0, 0.3), Z=Domain(-0.3, 0)}, {Plane=Plane(origin=(-0.15, 0.8516, -0.1500000003), x=(1, 0, 0), y=(0, -1, 0)), X=Domain(0, 0.3), Y=Domain(0, 0.3), Z=Domain(-0.3, 0)}, {Plane=PlaneXY(0.9024, -0.15, -0.1500000003), X=Domain(0, 0.3), Y=Domain(0, 0.3), Z=Domain(0, 0.3)}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])  # disabled

panel_24 = Panel("Goal06")  # disabled
# Goal 06
box_15 = Box([{Plane=Plane(origin=(-0.15, 0.15, -0.15), x=(1, 0, 0), y=(0, -1, 0)), X=Domain(0, 0.3), Y=Domain(0, 0.3), Z=Domain(-0.3, 0)}, {Plane=Plane(origin=(-0.15, 0.5008, -0.1500000001), x=(1, 0, 0), y=(0, -1, 0)), X=Domain(0, 0.3), Y=Domain(0, 0.3), Z=Domain(-0.3, 0)}, {Plane=PlaneXY(0.2008, -0.15, -0.15), X=Domain(0, 0.3), Y=Domain(0, 0.3), Z=Domain(0, 0.3)}, {Plane=Plane(origin=(0.2008, 0.5008, -0.1500000004), x=(1, 0, 0), y=(0, -1, 0)), X=Domain(0, 0.3), Y=Domain(0, 0.3), Z=Domain(-0.3, 0)}, {Plane=PlaneXY(0.5516, -0.15, -0.15), X=Domain(0, 0.3), Y=Domain(0, 0.3), Z=Domain(0, 0.3)}, {Plane=PlaneXY(0.5516, 0.2008, -0.15), X=Domain(0, 0.3), Y=Domain(0, 0.3), Z=Domain(0, 0.3)}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])  # disabled

panel_25 = Panel("Goal07")  # disabled
# Goal 07
box_16 = Box([{Plane=PlaneXY(-0.15, -0.15, -0.15), X=Domain(0, 0.3), Y=Domain(0, 0.3), Z=Domain(0, 0.3)}, {Plane=Plane(origin=(-0.15, 0.5008, -0.1500000001), x=(1, 0, 0), y=(0, -1, 0)), X=Domain(0, 0.3), Y=Domain(0, 0.3), Z=Domain(-0.3, 0)}, {Plane=Plane(origin=(0.2008, 0.15, -0.15), x=(1, 0, 0), y=(0, -1, 0)), X=Domain(0, 0.3), Y=Domain(0, 0.3), Z=Domain(-0.3, 0)}, {Plane=PlaneXY(0.2008, 0.2008, -0.1500000001), X=Domain(0, 0.3), Y=Domain(0, 0.3), Z=Domain(0, 0.3)}, {Plane=Plane(origin=(0.5516, 0.15, -0.15), x=(1, 0, 0), y=(0, -1, 0)), X=Domain(0, 0.3), Y=Domain(0, 0.3), Z=Domain(-0.3, 0)}, {Plane=Plane(origin=(0.9024, 0.15, -0.15), x=(1, 0, 0), y=(0, -1, 0)), X=Domain(0, 0.3), Y=Domain(0, 0.3), Z=Domain(-0.3, 0)}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])  # disabled

panel_26 = Panel("Goal08")  # disabled
# Goal 08
box_17 = Box([{Plane=PlaneXY(-0.15, -0.15, -0.15), X=Domain(0, 0.3), Y=Domain(0, 0.3), Z=Domain(0, 0.3)}, {Plane=PlaneXY(0.2008, -0.15, -0.1499999999), X=Domain(0, 0.3), Y=Domain(0, 0.3), Z=Domain(0, 0.3)}, {Plane=PlaneXY(0.5516, -0.15, -0.1499999997), X=Domain(0, 0.3), Y=Domain(0, 0.3), Z=Domain(0, 0.3)}, {Plane=Plane(origin=(0.2008, 0.5008, -0.15), x=(1, 0, 0), y=(0, -1, 0)), X=Domain(0, 0.3), Y=Domain(0, 0.3), Z=Domain(-0.3, 0)}, {Plane=PlaneXY(0.5516, 0.2008, -0.1499999999), X=Domain(0, 0.3), Y=Domain(0, 0.3), Z=Domain(0, 0.3)}, {Plane=PlaneXY(0.9024, 0.2008, -0.1499999997), X=Domain(0, 0.3), Y=Domain(0, 0.3), Z=Domain(0, 0.3)}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])  # disabled

panel_27 = Panel("Goal04")  # disabled
# Goal 04
box_18 = Box([{Plane=Plane(origin=(-0.15, 0.15, -0.15), x=(1, 0, 0), y=(0, -1, 0)), X=Domain(0, 0.3), Y=Domain(0, 0.3), Z=Domain(-0.3, 0)}, {Plane=PlaneXY(0.2008, -0.15, -0.1500000003), X=Domain(0, 0.3), Y=Domain(0, 0.3), Z=Domain(0, 0.3)}, {Plane=PlaneXY(0.5516, -0.15, -0.1500000003), X=Domain(0, 0.3), Y=Domain(0, 0.3), Z=Domain(0, 0.3)}, {Plane=Plane(origin=(0.9024, 0.15, -0.1500000003), x=(1, 0, 0), y=(0, -1, 0)), X=Domain(0, 0.3), Y=Domain(0, 0.3), Z=Domain(-0.3, 0)}, {Plane=Plane(origin=(0.9024, 0.5008, -0.1500000001), x=(1, 0, 0), y=(0, -1, 0)), X=Domain(0, 0.3), Y=Domain(0, 0.3), Z=Domain(-0.3, 0)}, {Plane=PlaneXY(0.9024, 0.5516, -0.15), X=Domain(0, 0.3), Y=Domain(0, 0.3), Z=Domain(0, 0.3)}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])  # disabled

panel_28 = Panel("Goal03")  # disabled
# Goal 03
box_19 = Box([{Plane=Plane(origin=(-0.15, 0.15, -0.15), x=(1, 0, 0), y=(0, -1, 0)), X=Domain(0, 0.3), Y=Domain(0, 0.3), Z=Domain(-0.3, 0)}, {Plane=PlaneXY(0.2008, -0.15, -0.15), X=Domain(0, 0.3), Y=Domain(0, 0.3), Z=Domain(0, 0.3)}, {Plane=PlaneXY(0.2008, 0.2008, -0.1500000001), X=Domain(0, 0.3), Y=Domain(0, 0.3), Z=Domain(0, 0.3)}, {Plane=PlaneXY(0.5516, -0.15, -0.15), X=Domain(0, 0.3), Y=Domain(0, 0.3), Z=Domain(0, 0.3)}, {Plane=Plane(origin=(0.5516, 0.5008, -0.1500000001), x=(1, 0, 0), y=(0, -1, 0)), X=Domain(0, 0.3), Y=Domain(0, 0.3), Z=Domain(-0.3, 0)}, {Plane=Plane(origin=(0.9024, 0.15, -0.15), x=(1, 0, 0), y=(0, -1, 0)), X=Domain(0, 0.3), Y=Domain(0, 0.3), Z=Domain(-0.3, 0)}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])  # disabled

# ----
# Goal Reorient To OptiTrack Space
cluster_11 = Cluster_2(rhino_geometry=geometry_7)  # -> box, box_2
geometry_11 = Geometry(cluster_11.box_2)

# ----
# Goal Reorient To OptiTrack Space
cluster_12 = Cluster_2(rhino_geometry=geometry_2)  # -> box, box_2
geometry_12 = Geometry(cluster_12.box_2)

# ----
# Goal Reorient To OptiTrack Space
cluster_13 = Cluster_2(rhino_geometry=geometry)  # -> box, box_2
geometry_13 = Geometry(cluster_13.box_2)

# ----
# Goal Reorient To OptiTrack Space
cluster_14 = Cluster_2(rhino_geometry=geometry_4)  # -> box, box_2
geometry_14 = Geometry(cluster_14.box_2)

# ----
# Goal Reorient To OptiTrack Space
cluster_15 = Cluster_2(rhino_geometry=geometry_6)  # -> box, box_2
geometry_15 = Geometry(cluster_15.box_2)

# ----
# Goal Reorient To OptiTrack Space
cluster_16 = Cluster_2(rhino_geometry=geometry_8)  # -> box, box_2
geometry_16 = Geometry(cluster_16.box_2)

# ----
# Goal Reorient To OptiTrack Space
cluster_17 = Cluster_2(rhino_geometry=geometry_3)  # -> box, box_2
geometry_17 = Geometry(cluster_17.box_2)

# ----
# Goal Reorient To OptiTrack Space
cluster_18 = Cluster_2(rhino_geometry=geometry_5)  # -> box, box_2
geometry_18 = Geometry(cluster_18.box_2)

# ----
# Goal Reorient To OptiTrack Space
cluster_19 = Cluster_2(rhino_geometry=geometry_9)  # -> box, box_2
geometry_19 = Geometry(cluster_19.box_2)

# ----
# Goal Reorient To OptiTrack Space
cluster_20 = Cluster_2(rhino_geometry=geometry_10)  # -> box, box_2
geometry_20 = Geometry(cluster_20.box_2)

# ----
# QUICK FIX FOR TESTING
cluster_21 = Cluster(geometry=box_14)  # disabled

# ----
# QUICK FIX FOR TESTING
cluster_22 = Cluster(geometry=box_13)  # disabled

# ----
# QUICK FIX FOR TESTING
cluster_23 = Cluster(geometry=box_15)  # disabled

# ----
# QUICK FIX FOR TESTING
cluster_24 = Cluster(geometry=box_17)  # disabled

# ----
# QUICK FIX FOR TESTING
cluster_25 = Cluster(geometry=box_19)  # disabled

# ----
# QUICK FIX FOR TESTING
cluster_26 = Cluster(geometry=box_12)  # disabled

# ----
# QUICK FIX FOR TESTING
cluster_27 = Cluster(geometry=box_18)  # disabled

# ----
# QUICK FIX FOR TESTING
cluster_28 = Cluster(geometry=box_16)  # disabled

# ----
# QUICK FIX FOR TESTING
cluster_29 = Cluster(geometry=box_11)  # disabled

number_slider_2 = Slider(0, range=0..10)
panel_29 = Panel("C:\Users\jk6372\Desktop\00_princeton_projects\00_robotic_territories\00_git\compas_xr_robotic_territories\dev\performance_operations\inference\goals_for_userstudy")
ghpython_script_2 = GhPythonScript(folder_fp=panel_29, box_list=geometry_20, name="Goal05", frame_rot=Toggle(False), write=Button())  # -> out, box_frames; inputs box_list: list of Box, frame_rot: Boolean, write: Boolean; same code as ghpython_script
list_item_3 = ListItem(List=geometry_20, Index=number_slider_2, Wrap=True)
list_item_4 = ListItem(List=ghpython_script_2.box_frames, Index=number_slider_2, Wrap=True)

# ==== cluster Cluster
geometry = ClusterInput()
rotate = Rotate(Geometry=geometry, Angle=1.570796327, Plane=PlaneXY(0, 0, 0))  # -> Geometry, Transform
area = Area(Geometry=rotate.Geometry)  # -> Area, Centroid
xy_plane = XYPlane(Origin=area.Centroid)
center_box = CenterBox(Base=xy_plane, X="0.15", Y="0.15", Z="0.15")
box = ClusterOutput(center_box)

# ==== cluster Cluster_2
rhino_geometry = ClusterInput()
area = Area(Geometry=rhino_geometry)  # -> Area, Centroid
xy_plane = XYPlane(Origin=area.Centroid)
center_box = CenterBox(Base=xy_plane, X="0.15", Y="0.15", Z="0.15")
rotate = Rotate(Geometry=center_box, Angle=1.570796327, Plane=PlaneXY(0, 0, 0))  # -> Geometry, Transform
box = ClusterOutput(center_box)
area_2 = Area(Geometry=rotate.Geometry)  # -> Area, Centroid
xy_plane_2 = XYPlane(Origin=area_2.Centroid)
center_box_2 = CenterBox(Base=xy_plane_2, X="0.15", Y="0.15", Z="0.15")
box_2 = ClusterOutput(center_box_2)
