# Grasshopper definition 20250803_random_abb_pick_and_place_information.ghx (Grasshopper 1.0.7)

# ----
# Attach Collision Meshes
panel = Panel("""PickUpStation1
PickUpStation2""")  # disabled
pickupstation = Geometry([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])  # disabled
robot_base_pu = Geometry(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)  # disabled
# Copy for new entries
mesh = Mesh(pickupstation)  # disabled
attach_acm_to_baselink = GhPythonScript(meshes=mesh, names=panel)  # inputs meshes: list of Mesh, names: list; disabled
# ---------- attach_acm_to_baselink: Python ----------
from compas_fab.robots import PlanningScene
from compas_fab.robots import  CollisionMesh
from compas_rhino.conversions import mesh_to_compas


if robot:
    scene = PlanningScene(robot)
    
    i = 0
    for m in meshes:
        
        scene.remove_collision_mesh(names[i])
        
        mesh = mesh_to_compas(m)
        cm = CollisionMesh(mesh, names[i])
        scene.add_collision_mesh(cm)
        
        i+=1
# ---------- end attach_acm_to_baselink ----------

# ----
# Notes: b) Follow the pattern : Name/ Visual_Mesh/ Collision_mesh / tcf_plane for new entries
# c) Use unique names for each entry
# Copy for new entries
panel_2 = Panel("")
simplified_mtip = Mesh()
detailed_mtip = Mesh()
tcf_plane = Plane()

point = Point(Point(-2.401017388e-11, -1.002982373e-11, 0.09356287867))
# ---------------------- TOOL LIBRARY ----------------------
panel_3 = Panel("gripper")
xy_plane = XYPlane(Origin=point)
collision_mesh = Mesh(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)
visual_mesh = Mesh(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)

point_2 = Point(Point(-2.401017388e-11, -1.002982373e-11, 0.14923472))
xy_plane_2 = XYPlane(Origin=point_2)
collision_mesh_2 = Mesh(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)
visual_mesh_2 = Mesh(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)

set_toollibrary = Merge(
    Data1=panel_3,
    Data2=visual_mesh,
    Data3=collision_mesh,
    Data4=xy_plane,
    Data5="measuring_tool",
    Data6=visual_mesh_2,
    Data7=collision_mesh_2,
    Data8=xy_plane_2)
dict = Dict(list=set_toollibrary)

pick_planerr = Plane(Plane(origin=(3.180244633, 0.9116622254, 0.1174023263), x=(0, 1, 0), y=(1, 0, 0)))
deconstruct_plane = DeconstructPlane(Plane=pick_planerr)  # -> Origin, XAxis, YAxis, ZAxis
plane = Plane()

value_list = ValueList({"Expiriment 02": 0, "Expiriment 03": 1}, selected="Expiriment 02")
geo = BooleanToggle(True)

# ----
# 1. Load Design Information
panel_4 = Panel("C:\Users\jk6372\Desktop\00_ecl_github_repos\00_robotic_fabrication\abbs_irb4600s_fabrication_control\expiriment_workflow\userWorkflow\json_data")
rotate_3d = Rotate3D(Geometry=plane, Angle=degrees(Slider(180, range=0..1000)), Center=deconstruct_plane.Origin, Axis=deconstruct_plane.ZAxis)  # -> Geometry, Transform
ghpython_script = GhPythonScript(fp=panel_4, project=value_list, show_geo=geo)  # -> out, config_path, project_name, assembly, building_plan, geometry; inputs project: Int32
# ---------- ghpython_script: Python ----------
import os
from compas.data import json_load
from compas.datastructures import Assembly
from compas_timber.assembly import TimberAssembly
from compas_timber.planning import BuildingPlan
from compas_timber.consumers import BrepGeometryConsumer
from compas.scene import Scene


if project == 0:
    project_json_fp = os.path.join(fp, "expiriment_02_project_data.json")
else:
    project_json_fp = os.path.join(fp, "expiriment_03_project_data.json")

project_data = json_load(project_json_fp)
config_path = project_data["config_fp"]
project_name = project_data["project_name"]
assembly = TimberAssembly.__from_data__(project_data["assembly"])
building_plan = BuildingPlan.__from_data__(project_data["building_plan"])


if show_geo:
    geometry = []
    scene = Scene()
    consumer = BrepGeometryConsumer(assembly)
    for result in consumer.result:
        scene.add(result.geometry)
        if result.debug_info:
            debug_info.add_feature_error(result.debug_info)
    geometry = scene.draw()
# ---------- end ghpython_script ----------

# ----
# Timbers Geometry
brep = Brep(ghpython_script.geometry)

panel_5 = Panel("ROB LL")

panel_6 = Panel("ROB RR")
track = Slider(0.81, range=0..3.9)

dist = Slider(0.5, range=0..1)
panel_7 = Panel("Configuration((0.870, 0.378, -0.176, 0.633, -0.107, -1.188, -1.520, 2.194, 0.154, -0.495, 0.822, -0.432, 1.120, 1.857), (2, 0, 0, 0, 0, 0, 0, 2, 0, 0, 0, 0, 0, 0), ('robRR/track_carriage', 'robRR/joint_1', 'robRR/joint_2', 'robRR/joint_3', 'robRR/joint_4', 'robRR/joint_5', 'robRR/joint_6', 'robLL/track_carriage', 'robLL/joint_1', 'robLL/joint_2', 'robLL/joint_3', 'robLL/joint_4', 'robLL/joint_5', 'robLL/joint_6'))")
piece = Brep(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)
panel_8 = Panel("Useful Geometries")
track_corner = Point(Point(-0.6462184787, 0.3564999998, -0.07299999893))
qrcode_corner = Point(Point(-0.6242184787, 0.2314999998, -0.07299999893))
dist_2 = Slider(0.8, range=0..1)
panel_9 = Panel(qrcode_corner)

# ----
# 2. Visualization of Current Project State
assembly = Data(ghpython_script.assembly)
project_name = Data(ghpython_script.project_name)

# ----
# Dependencies
# compas 		2.1.0
# compas_rrc 	1.1.0
# compas-fab 	1.0.2
# compas-robots	0.4.0
info = Info()  # -> info
#   port info: Environment info.
# ---------- info: Python ----------
"""
Displays information about the active COMPAS environment.
"""

import compas_bootstrapper
from ghpythonlib.componentbase import executingcomponent as component

import compas


class CompasInfo(component):
    def RunScript(self):
        self.Message = "COMPAS v{}".format(compas.__version__)
        info = "COMPAS Version: {}\nEnvironment: {}"
        return info.format(compas.__version__, compas_bootstrapper.ENVIRONMENT_NAME)
# ---------- end info ----------
negative = Negative(Value=dist_2)
index = Slider(1, range=0..10)
panel_10 = Panel(info)
select_tool = GhPythonScript(toolLibrary=dict, index=index)  # -> name, visual_mesh, collision_mesh, tcf_plane; inputs index: Int32
# ---------- select_tool: Python ----------
name = toolLibrary[str(index)]["name"]
visual_mesh = toolLibrary[str(index)]["visual_mesh"]
collision_mesh = toolLibrary[str(index)]["collision_mesh"]
tcf_plane = toolLibrary[str(index)]["tcf_plane"]
# ---------- end select_tool ----------
selected_tool = Panel(select_tool.name)

number_slider = Slider(4.1, range=0..10)
point_3 = Point(Point(3.180244633, 0.5093555645, 0.06040232629))
# Place Frame Transformation
xy_plane_3 = XYPlane(Origin=point_3)
number_slider_2 = Slider(10, range=0..10)
panel_11 = Panel("""0
1
2
3""")
addition = Addition(A="-220.58", B=number_slider)
subtraction = Subtraction(A="-220.58", B=number_slider)
ghpython_script_2 = GhPythonScript(
    assembly=ghpython_script.assembly,
    horizontal_keys=panel_11,
    pick_plane_base=xy_plane_3,
    rotation="-130.58",
    out_number=Slider(2, range=0..100))  # -> out, a, b_out, d, e, place_frame, pick_frame; inputs horizontal_keys: list of Int32, pick_plane_base: Plane, out_number: Int32
# ---------- ghpython_script_2: Python ----------
from compas.geometry import Transformation, Translation, Frame, Rotation
from compas_rhino.conversions import plane_to_compas_frame, frame_to_rhino
from compas.geometry import scale_vector, Vector
from compas.data import json_dump
import math

a = []
b_out = []
c = []
d = []
e  = []

data_dict = {}

beams = assembly.beams

for b in beams:
    b_len = b.length
    b_frame = b.frame
    b_xaxis = b_frame.xaxis
    b_key = b.key
    d.append(b.key)
    tx = Translation.from_vector(b_xaxis.unitized() * (b_len/2))
    b_frame_txed = b_frame.transformed(tx)
    b_flipped_plane = Frame(b_frame_txed.point, -b_frame_txed.yaxis, -b_frame_txed.xaxis)

    if b_key in horizontal_keys:
        add_rot = Rotation.from_axis_and_angle(b_flipped_plane.yaxis, -math.radians(90), b_flipped_plane.point)
        b_flipped_plane = b_flipped_plane.transformed(add_rot)

    b_place_offset = Translation.from_vector(b_flipped_plane.zaxis.unitized() * 0.02)
    b_final_place = b_flipped_plane.transformed(b_place_offset)

    pick_tx = Translation.from_vector(Vector.Yaxis().unitized() * (b_len/2))
    pick_frame = plane_to_compas_frame(pick_plane_base)
    pick_transformed = pick_frame.transformed(pick_tx)

    data_dict[b_key] = {}
    data_dict[b_key]["place_frame"] = b_final_place
    data_dict[b_key]["pick_frame"] = pick_transformed

    e.append(frame_to_rhino(b_final_place))
    b_out.append(frame_to_rhino(b_frame_txed))
    a.append(frame_to_rhino(b_flipped_plane))

fp=r"C:\Users\jk6372\Desktop\00_ecl_github_repos\00_robotic_fabrication\abbs_irb4600s_fabrication_control\rhino\trajectory_info.json"
json_dump(data=data_dict, fp=fp, pretty=True)

place_frame = data_dict[out_number]["place_frame"]
pick_frame = data_dict[out_number]["pick_frame"]
# ---------- end ghpython_script_2 ----------
data = Data([0, 1, 2, 3, 4, 5, 6, 7, 8, 9, 10, 11, 12, 13, 14, 15, 16, 17, 18, 19])
plane_2 = Plane([Plane(origin=(1.770981284, 1.729199969, 0.05355), x=(0, 0.7594984241, 0.6505091419), y=(0, 0.6505091419, -0.7594984241)), Plane(origin=(1.597308043, 1.729199969, 0.5558664502), x=(0, 0.7594984241, 0.6505091419), y=(0, 0.6505091419, -0.7594984241)), Plane(origin=(1.423634803, 1.729199969, 1.0581829), x=(0, 0.7594984241, 0.6505091419), y=(0, 0.6505091419, -0.7594984241)), Plane(origin=(1.327463275, 1.729199969, 0.05355), x=(0, 0.7594984241, 0.6505091419), y=(0, 0.6505091419, -0.7594984241)), Plane(origin=(1.684144664, 1.290287969, 0.3047082251), x=(-0.6867569999, -0.2430359007, 0.6850535557), y=(0.3224175144, 0.7428153392, 0.5867472354)), Plane(origin=(1.684144664, 1.582895969, 0.3047082251), x=(-0.7100320524, -0.1923278976, 0.6773953531), y=(0.354951402, 0.7330698396, 0.5801879976))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])
text_tag_3d = TextTag3D(Location=plane_2, Text=data, Size=Slider(0.05, range=0..10), Justification=7)
plane_3 = Plane(ghpython_script_2.e)
plane_4 = Plane(ghpython_script_2.b_out)
plane_5 = Plane(ghpython_script_2.a)

plane_6 = Plane(select_tool.tcf_plane)

ghpython_script_3 = GhPythonScript(config_filepath=ghpython_script.config_path, assembly=assembly, project_name=project_name, visualize=Toggle(True))  # -> last_built_index, step_locations, built_human, unbuilt_human, built_robot, unbuilt_robot; inputs visualize: Boolean
# ---------- ghpython_script_3: Python ----------
import sys
import os

from compas_xr.project import ProjectManager
from compas_timber.planning.sequencer import BuildingPlan

last_built_index = None
step_locations = None
built_human = None
unbuilt_human = None
built_robot = None
unbuilt_robot = None

if "project_data" not in globals():
    project_data = {}

if not (config_filepath):
    ghenv.Component.Message = "Missing Config"

elif not (project_name):
    ghenv.Component.Message = "Missing Project Name"

elif not (assembly):
    ghenv.Component.Message = "Missing Assembly"

else:
    pm = ProjectManager(config_filepath)
    ghenv.Component.Message = None
    
    if visualize:
        last_built_index, step_locations, built_human, unbuilt_human, built_robot, unbuilt_robot = pm.visualize_project_state_timbers(assembly, project_name)
        project_data["last_built_index"] = last_built_index
        project_data["step_locations"] = step_locations
        project_data["built_human"] = built_human
        project_data["unbuilt_human"] = unbuilt_human
        project_data["built_robot"] = built_robot
        project_data["unbuilt_robot"] = unbuilt_robot

if project_data:
    last_built_index = project_data["last_built_index"]
    step_locations = project_data["step_locations"]
    built_human = project_data["built_human"]
    unbuilt_human = project_data["unbuilt_human"]
    built_robot = project_data["built_robot"]
    unbuilt_robot = project_data["unbuilt_robot"]
# ---------- end ghpython_script_3 ----------
draw = Draw(cg=ghpython_script_3.step_locations)  # -> rg
#   port cg: The COMPAS geometry or datastructure to be drawn.
# ---------- draw: Python ----------
from compas_rhino.conversions import frame_to_rhino_plane
if cg:
    rg = frame_to_rhino_plane(cg)
else:
    rg = None
# ---------- end draw ----------
draw_2 = Draw(cg=ghpython_script_3.built_human)  # -> rg
#   port cg: The COMPAS geometry or datastructure to be drawn.
#   port rg: The Rhino geometry object.
# ---------- draw_2: Python ----------
"""
Draws COMPAS geometry in Grasshopper.
"""

from ghpythonlib.componentbase import executingcomponent as component

from compas.scene import SceneObject


class CompasToRhinoGeometry(component):
    def RunScript(self, cg):
        if not cg:
            return None

        return SceneObject(cg).draw()
# ---------- end draw_2 ----------
draw_3 = Draw(cg=ghpython_script_3.unbuilt_human)  # -> rg; same code as draw_2
draw_4 = Draw(cg=ghpython_script_3.built_robot)  # -> rg; same code as draw_2
draw_5 = Draw(cg=ghpython_script_3.unbuilt_robot)  # -> rg; same code as draw_2

# ----
# Visualization Example: Current Project State Visualization
# Built Human
custom_preview = CustomPreview(Geometry=draw_2, Material=ColourSwatch(SwatchColor=RGB(255, 255, 0)))

# ----
# Unbuilt Human
custom_preview_2 = CustomPreview(Geometry=draw_3, Material=ColourSwatch(SwatchColor=RGBA(255, 255, 0, 75)))

mesh_2 = Mesh(select_tool.visual_mesh)
mesh_3 = Mesh(select_tool.collision_mesh)

# ----
# Built Robot
custom_preview_3 = CustomPreview(Geometry=draw_4, Material=ColourSwatch(SwatchColor=RGB(0, 255, 255)))

# ----
# !!!!! External_Axes Values are in mm !!!!!
panel_12 = Panel("ROB LL")

# ----
# Or Define a Plane in Rhino and a distance. The Z Axis of the Robot should point down.
number_slider_3 = Slider(0.25, range=0..1)
pick_planell = Plane(Plane(origin=(3.180244633, 2.344824311, 0.1174023263), x=(0, 1, 0), y=(1, 0, 0)))

# ---- group: Scroll to Select
item = Slider(0, range=0..1)

# ----
# Select a Tool from the Library
value_list_2 = ValueList({"ur3": 0, "ur5": 1, "ur10e": 2, "ur20": 3, "ABB_IRB4600": 4}, selected="ABB_IRB4600")
select_tool_2 = GhPythonScript(item=item, robot=value_list_2, load=Toggle(True))  # -> name, visual_mesh, collision_mesh, tcf_plane; inputs robot: Int32, load: Boolean
# ---------- select_tool_2: Python ----------
from compas_rhino.conversions import frame_to_rhino_plane, mesh_to_rhino
from compas.data import json_load
import os
import sys

canvas = ghenv.Component.OnPingDocument()
path = canvas.FilePath
dir_path = os.path.dirname(path)
robots = ["ur3", "ur5", "ur10e", "ur20", "ABB_IRB4600"]
robot = robots[robot]

endeffector_dir = os.path.join(dir_path, "fabrication", "setup", "endeffectors", robot)
file_names = [f for f in os.listdir(endeffector_dir) if os.path.isfile(os.path.join(endeffector_dir, f))]


index = int(item * (len(file_names) - 1))

ee_name = file_names[index]
ee_path = os.path.join(dir_path, "fabrication", "setup", "endeffectors", robot, ee_name)
name =""

if (ee_name, robot, load):
    name = ee_name.split('.')[0]
    ee_dict = json_load(ee_path)
    
    tcf_plane = frame_to_rhino_plane(ee_dict["tcf"])
    visual_mesh = mesh_to_rhino(ee_dict["visual_mesh"])
    
    if 'collision_mesh' in ee_dict:
        collision_mesh = mesh_to_rhino(ee_dict["collision_mesh"])
    else:
        collision_mesh = None

else:
    ghenv.Component.Message("Missing EE Info")
# ---------- end select_tool_2 ----------
selected_tool_2 = Panel(select_tool_2.name)
mesh_4 = Mesh(select_tool_2.visual_mesh)
plane_7 = Plane(select_tool_2.tcf_plane)

# ----
# Unbuilt Robot
custom_preview_4 = CustomPreview(Geometry=draw_5, Material=ColourSwatch(SwatchColor=RGBA(0, 255, 255, 75)))

# ----
# Or Define a Plane in Rhino and a distance. The Z Axis of the Robot should point down.
number_slider_4 = Slider(0.2, range=0..1)
plane_8 = Plane(Plane(origin=(2.15725743, 1.610324796, 1.322434998), x=(1, 1.913878627e-06, 4.376459195e-08), y=(6.207326209e-07, -0.3457886368, 0.9383124313)))

plane_9 = Plane(plane_8)
move = Move(plane=plane_9, amplitude=negative)
# 0. Define pick and Approach Pick Configuration
plane_10 = Plane(move)
pick_planerr_2 = Plane(Plane(origin=(3.180244633, 0.9116622254, 0.1174023263), x=(0, -1, 0), y=(-1, 0, 0)))
pick_planerr_3 = Plane(Plane(origin=(3.180244633, 0.9116622254, 0.06040232629), x=(0, -1, 0), y=(-1, 0, 0)))
number_slider_5 = Slider(90, range=0..100)
plane_11 = Plane(Plane(origin=(2.73338286, 2.453337818, 0.4771652393), x=(1, 7.017270178e-07, 1.781130516e-06), y=(6.207326209e-07, -0.9989836876, 0.04507318375)))
plane_12 = Plane(Plane(origin=(1.35725743, 1.610324796, 1.322434998), x=(1, 1.913878627e-06, 4.376459195e-08), y=(6.207326209e-07, -0.3457886368, 0.9383124313)))
plane_13 = Plane(Plane(origin=(1.390887228, 1.561826229, 1.251467203), x=(6.207326209e-07, -0.3457886368, 0.9383124313), y=(1, 1.913878627e-06, 4.376459195e-08)))
flip_plane = FlipPlane(Plane=plane_13, ReverseX=False, ReverseY=False, SwapAxes=True)
data_2 = Data(ghpython_script_2.place_frame)
data_3 = Data(ghpython_script_2.pick_frame)
rotate_220 = RotatePlane(Plane=pick_planerr_3, Angle=degrees("270"))
rotate_220_2 = RotatePlane(Plane=plane_11, Angle=degrees(-220.58))
mesh_5 = Mesh(select_tool_2.collision_mesh)
robot = ValueList({"RobRR": "robRR_track", "RobLL": "robLL_track", "bothRRLL", "bothLLRR"}, selected="RobRR")
planerr = Plane(Plane(origin=(1.65725743, 1.610323839, 1.322434977), x=(1, 1.913878627e-06, 4.376459195e-08), y=(-6.207326209e-07, 0.3457886368, -0.9383124313)))
rotate_220_3 = RotatePlane(Plane=flip_plane, Angle=degrees(-200.58))
draw_6 = Draw(cg=data_2)  # -> rg; same code as draw_2
draw_7 = Draw(cg=data_3)  # -> rg
#   port cg: The COMPAS geometry or datastructure to be drawn.
# ---------- draw_7: Python ----------
from compas_rhino.conversions import frame_to_rhino_plane

rg = frame_to_rhino_plane(cg)
# ---------- end draw_7 ----------
flip_plane_2 = FlipPlane(Plane=draw_7, ReverseX=False, ReverseY=False, SwapAxes=True)

planell = Plane(Plane(origin=(1.65725743, 1.610323839, 1.322434977), x=(1, 1.913878627e-06, 4.376459195e-08), y=(6.207326209e-07, -0.3457886368, 0.9383124313)))
# 1b. Plan Place Configuration
planerr_2 = Plane(Plane(origin=(1.391234543, 1.148527852, 0.6506411444), x=(1, 0, 0), y=(0, -0.8594884458, -0.5111551736)))

plane_14 = Plane(planell)
rotaroundz = Move(plane=plane_14, amplitude=dist)
# The following section runs only if we are planning for both robots
plane_15 = Plane(rotaroundz)

update = GhPythonScript(Manual=Button())  # -> bang; unedited script template

rotate_220_4 = RotatePlane(Plane=flip_plane_2, Angle=degrees("90"))
pick_planes = GhPythonScript(pick_planeLL=pick_planell, pick_planeRR=rotate_220_4)  # -> pick_planes; inputs pick_planeLL: Plane, pick_planeRR: Plane
# ---------- pick_planes: Python ----------
pick_planes = {"robLL_track": pick_planeLL, "robRR_track": pick_planeRR}

pick_planes=[pick_planes]
# ---------- end pick_planes ----------

# ----
# 1b. Plan Place Configuration
place_plane = Plane(rotate_220_2)

update_2 = GhPythonScript(Manual=Button())  # -> bang; unedited script template

plane_16 = Plane(Plane(origin=(1.391983254, 1.553575881, 1.324981662), x=(-0.7669050275, -0.2219733987, 0.6021498892), y=(-0.6417606086, 0.2652530882, -0.7195721787)))

# ---- group: Scroll to Select
item_2 = Slider(0.5, range=0..1)

# ----
# Select a Tool from the Library
value_list_3 = ValueList({"ur3": 0, "ur5": 1, "ur10e": 2, "ur20": 3, "ABB_IRB4600": 4}, selected="ABB_IRB4600")
select_tool_3 = GhPythonScript(item=item_2, robot=value_list_3, load=Toggle(True))  # -> name, visual_mesh, collision_mesh, tcf_plane; inputs robot: Int32, load: Boolean; same code as select_tool_2
selected_tool_3 = Panel(select_tool_3.name)
plane_17 = Plane(select_tool_3.tcf_plane)
mesh_6 = Mesh(select_tool_3.visual_mesh)

panel_15 = Panel(robot)
panel_16 = Panel(robot)
ghpython_script_4 = GhPythonScript(plane=place_plane)  # -> frame; inputs plane: Plane
# ---------- ghpython_script_4: Python ----------
from compas.geometry import Frame

frame = Frame(plane.Origin, plane.XAxis, plane.YAxis)
# ---------- end ghpython_script_4 ----------
panel_17 = Panel(robot)
panel_18 = Panel(robot)
mesh_7 = Mesh(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)
mesh_8 = Mesh(select_tool_3.collision_mesh)
mesh_9 = Mesh([<mesh referenced from the Rhino model> x2])
subscribe = Button()
unsubscribe = Button()
number_slider_6 = Slider(2.19, range=0..10)
ghpython_script_5 = GhPythonScript(x=mesh_9)  # -> out, a; inputs x: list of Mesh
# ---------- ghpython_script_5: Python ----------
from compas.data import json_dump
from compas_rhino.conversions import mesh_to_compas

mesh_list = []
for m in x:
    compas_mesh = mesh_to_compas(m)
    mesh_list.append(compas_mesh)

fp = r"C:\Users\jk6372\Desktop\00_princeton_projects\00_robotic_territories\00_git\compas_xr_robotic_territories\dev\performance_operations\robots\setup_objects\abb_collisions\abb_static_collision_meshes.json"

json_dump(fp=fp, data=mesh_list, pretty=True)
# ---------- end ghpython_script_5 ----------
ghpython_script_6 = GhPythonScript()  # -> out, a
# ---------- ghpython_script_6: Python ----------
from compas_rhino.conversions import plane_to_compas_frame
from compas.geometry import Transformation
from compas.geometry import Frame
from compas.data import json_dump

xyFrame = Frame.worldXY()

tx = Transformation.from_frame_to_frame(xyFrame, xyFrame)
inv_tx = tx.inverse()

print tx.__data__
print inv_tx.__data__

data={}
data["observed"] = {}
data["static"]={}
data["observed"]["inverse_transform_to_observed"] = tx
data["observed"]["transformation_to_urdf"] = inv_tx
data["observed"]["urdf_base_frame"] = xyFrame.transformed(tx)
data["static"]["urdf_base_frame"] = xyFrame

fp = r"C:\Users\jk6372\Desktop\00_princeton_projects\00_robotic_territories\00_git\compas_xr_robotic_territories\dev\performance_operations\testing\workcell_transformations.json"
#json_dump(fp=fp, data=data, pretty=True)
# ---------- end ghpython_script_6 ----------
plane_18 = Plane(Plane(origin=(-1.18446672, 0.5701081437, 0.05349999914), x=(0, -1, 0), y=(1, 0, 0)))

# ----
# mimic Human
# Visualization Example: Current Project State Visualization
box = Box({Plane=PlaneXY(-0.1475749538, -2.84789562, -0.3657519164), X=Domain(0, 3.392213091), Y=Domain(0, 1.809642666), Z=Domain(0, 1.8)})

# ----
# LLZonesDefinition
# Boundary
box_2 = Box({Plane=PlaneXY(-1.311218429, -2.89789562, -0.3657519164), X=Domain(0, 5.719500041), Y=Domain(0, 6.856783089), Z=Domain(0, 3.432110602)})

# ----
# mimic Robot
box_3 = Box({Plane=PlaneXY(-1.261218429, 0.9110548562, 0.03449999914), X=Domain(0, 5.619500041), Y=Domain(0, 2.997832613), Z=Domain(0, 2.981858687)})

negative_2 = Negative(Value=number_slider_6)
ghpython_script_7 = GhPythonScript(x=plane_18)  # -> out, a; inputs x: Plane
# ---------- ghpython_script_7: Python ----------
from compas_rhino.conversions import plane_to_compas_frame
from compas.data import json_dump

frame = plane_to_compas_frame(x)
fp = r"C:\Users\jk6372\Desktop\00_princeton_projects\00_robotic_territories\00_git\compas_xr_robotic_territories\dev\performance_operations\testing\optitrack_origin_abb_workcell.json"
json_dump(fp=fp, data=frame, pretty=True)
# ---------- end ghpython_script_7 ----------
list_item = ListItem(List=plane_3, Index=Slider(2, range=0..20), Wrap=True)
to = GhPythonScript(plane=list_item)  # -> frame; inputs plane: Plane; same code as ghpython_script_4

# ----
# Unbuilt Human
preview = CustomPreview(Geometry=box, Material=ColourSwatch(SwatchColor=RGBA(255, 255, 0, 75)))

rotate_220_5 = RotatePlane(Plane=list_item, Angle=degrees(number_slider_6))

# ----
# 4. Set QRFrame Positions
# Marker 00
plane_19 = Plane(PlaneXY(-0.07257495375, -2.77289562, -0.3657519164))

# ----
# Marker 02
plane_20 = Plane(PlaneXY(1.548531592, -1.113252954, -0.3657519164))

# ----
# Marker 01
plane_21 = Plane(PlaneXY(-0.07257495375, -1.113252954, -0.3657519164))

# ----
# Marker 03
plane_22 = Plane(PlaneXY(3.169638138, -1.113252954, -0.3657519164))

# ----
# Marker 04
plane_23 = Plane(PlaneXY(3.169638138, -2.77289562, -0.3657519164))

# ----
# Marker 05
plane_24 = Plane(PlaneXY(1.548531592, -2.77289562, -0.3657519164))

# ----
# Inf Pick
box_4 = Box({Plane=Plane(origin=(-1.088541357, 2.54999999, 0.03449999914), x=(1, 0, 0), y=(0, -1, 0)), X=Domain(0, 1.146543426), Y=Domain(0, 1.64159997), Z=Domain(-1.252957571, 0)})

preview_2 = CustomPreview(Geometry=box_4, Material=ColourSwatch(SwatchColor=RGBA(47, 0, 255, 75)))

# ----
# Inf Collaboration
box_5 = Box({Plane=PlaneXY(0.1543290324, 0.9084000206, 0.03449999914), X=Domain(0, 2.788405119), Y=Domain(0, 2.04), Z=Domain(0, 2.504975764)})

# ----
# Built Human
# Built Human
swatch = ColourSwatch(SwatchColor=RGBA(255, 0, 0, 75))
preview_3 = CustomPreview(Geometry=box_5, Material=swatch)

list_item_2 = ListItem(List=ghpython_script.geometry, Index=0, Wrap=True)  # -> Item, Item1

# ----
# Built Human
swatch_2 = ColourSwatch(SwatchColor=RGBA(255, 255, 255, 75))
preview_4 = CustomPreview(Geometry=box_2, Material=swatch_2)

merge = Merge(Data1=plane_19, Data2=plane_21, Data3=plane_20, Data4=plane_22, Data5=plane_23, Data6=plane_24)

# ----
# QRFrame Locations Visualization
geometry = Geometry(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)
orient = Orient(Geometry=geometry, Source=PlaneXY(0, 0, 0), Target=merge)  # -> Geometry, Transform
custom_preview_5 = CustomPreview(Geometry=orient.Geometry, Material=ColourSwatch(SwatchColor=RGB(110, 202, 255)))
point_list = PointList(Points=merge, Size="0.1")

ghpython_script_8 = GhPythonScript(x=box, rot=Toggle(True))  # -> out, a; inputs x: Box, rot: Boolean
# ---------- ghpython_script_8: Python ----------
from compas_rhino.conversions import box_to_compas, frame_to_rhino_plane
from compas.geometry import Rotation, Box
import math

box = box_to_compas(x)
if rot:
    box_frame = box.frame
    tx = Rotation.from_axis_and_angle(box_frame.zaxis, math.radians(90), box_frame.point)
    new_box_frame = box_frame.transformed(tx)
    new_box = Box(box.ysize, box.xsize, new_box_frame)
print box.__data__
a = frame_to_rhino_plane(box.frame)
# ---------- end ghpython_script_8 ----------

ghpython_script_9 = GhPythonScript(x=box_3)  # -> out, a; inputs x: Box
# ---------- ghpython_script_9: Python ----------
from compas_rhino.conversions import box_to_compas, frame_to_rhino_plane

box = box_to_compas(x)
print box.__data__
a = frame_to_rhino_plane(box.frame)
# ---------- end ghpython_script_9 ----------

# ----
# Unbuilt Robot
preview_5 = CustomPreview(Geometry=box_3, Material=ColourSwatch(SwatchColor=RGBA(0, 255, 255, 75)))

plane_25 = Plane(ghpython_script_8.a)

# ---- group: I think May need to Rotate 90... Will check and see.
plane_26 = Plane(ghpython_script_9.a)

# ----
# Plane to Compas Frame
ghpython_script_10 = GhPythonScript(planes=merge)  # -> frames; inputs planes: list
# ---------- ghpython_script_10: Python ----------
from compas_rhino.conversions import plane_to_compas_frame

frames = [plane_to_compas_frame(plane) for plane in planes]
# ---------- end ghpython_script_10 ----------

ghpython_script_11 = GhPythonScript(frames=ghpython_script_10)  # -> out, qr_assembly; inputs frames: list
# ---------- ghpython_script_11: Python ----------
from compas_xr.project import AssemblyExtensions
from compas.data import json_dump

ae = AssemblyExtensions()
qr_assembly = ae.create_qr_assembly(frames)
fp = r"C:\Users\jk6372\Desktop\00_princeton_projects\00_robotic_territories\00_git\compas_xr_robotic_territories\dev\performance_operations\testing\fire_base_geo_upload_and_tracking_testing\workcell_qr_frames.json"
json_dump(fp=fp, data=qr_assembly.__data__, pretty=True)
# ---------- end ghpython_script_11 ----------
ghpython_script_12 = GhPythonScript()  # -> config
# ---------- ghpython_script_12: Python ----------
from compas_fab.robots.robot import Configuration
import math


config = Configuration((0.870, 0.378, -0.176, 0.633, -0.107, -1.188, -1.520, 
                        2.194, 0.154, -0.495, 0.822, -0.432, 1.120, 1.857), 
                         (2, 0, 0, 0, 0, 0, 0, 2, 0, 0, 0, 0, 0, 0), 
                         ('robRR/track_carriage', 'robRR/joint_1', 'robRR/joint_2', 'robRR/joint_3', 
                         'robRR/joint_4', 'robRR/joint_5', 'robRR/joint_6', 'robLL/track_carriage', 
                         'robLL/joint_1', 'robLL/joint_2', 'robLL/joint_3', 'robLL/joint_4', 
                         'robLL/joint_5', 'robLL/joint_6'))
# ---------- end ghpython_script_12 ----------
panel_19 = Panel(robot)
go = Button()
go_2 = Button()
panel_20 = Panel(robot)

# ----
# INVERSE KINEMATICS
robot_2 = ValueList({"RobRR": "robRR_track", "RobLL": "robLL_track"}, selected="RobLL")
plane_27 = Plane(plane_12)

# ----
# FORWARD KINEMATICS
button = Button()

# ----
# 1) Load robot from ROS ----------------
# Notes: Change IP : when running ROS in an another machine (eg. Linux)
# Default   : when running a docker file
boolean_toggle = BooleanToggle(True)
ros = COMPASFABROSConnect(connect=boolean_toggle)  # -> ros_client, is_connected; inputs port: Int32, connect: Boolean
#   port ip: The ip address ROS. Defaults to 127.0.0.1.
#   port port: The port of ROS. Defaults to 9090.
#   port connect: If True, connects to ROS. If False, disconnects from ROS. Defaults to False.
#   port ros_client: The ROS client.
#   port is_connected: True if connection established.
# ---------- ros: Python ----------
"""
Connect or disconnect to ROS.

COMPAS FAB v1.0.2
"""

from ghpythonlib.componentbase import executingcomponent as component
from scriptcontext import sticky as st

from compas_fab.backends import RosClient
from compas_fab.ghpython.components import create_id


class ROSConnect(component):
    def RunScript(self, ip, port, connect):
        ros_client = None

        ip = ip or "127.0.0.1"
        port = port or 9090

        key = create_id(self, "ros_client")
        ros_client = st.get(key, None)

        if ros_client:
            st[key].close()
        if connect:
            st[key] = RosClient(ip, port)
            st[key].run(5)

        ros_client = st.get(key, None)
        is_connected = ros_client.is_connected if ros_client else False
        return (ros_client, is_connected)
# ---------- end ros ----------

# ---- group: Define Attributes
robot_3 = COMPASFABROSRobot(ros_client=ros.ros_client, load=Toggle(True))  # -> robot; inputs load: Boolean
#   port ros_client: The ROS client.
#   port load: If True, loads the robot from ROS. Defaults to False.
# ---------- robot_3: Python ----------
"""
Load robot directly from ROS.

COMPAS FAB v1.0.2
"""

from compas.scene import SceneObject
from ghpythonlib.componentbase import executingcomponent as component
from scriptcontext import sticky as st

from compas_fab.ghpython.components import create_id


class ROSRobot(component):
    def RunScript(self, ros_client, load):
        key = create_id(self, "robot")

        if ros_client and ros_client.is_connected and load:
            # Load URDF from ROS
            st[key] = ros_client.load_robot(load_geometry=True, precision=12)
            st[key].scene_object = SceneObject(st[key].model)

        robot = st.get(key, None)
        if robot:  # client sometimes need to be restarted, without needing to reload geometry
            robot.client = ros_client
            robot.attributes["robRR_track"] = {"last_config": None, "changed":True, "io_AIR" : "RR_AIR_ON", "io_GRIPPER" : "RR_GRIPPER" }
            robot.attributes["robLL_track"] = {"last_config": None, "changed":True, "io_AIR" : "LL_AIR_ON", "io_GRIPPER" : "LL_GRIPPER"}
        return robot
# ---------- end robot_3 ----------

# ----
# Define Robot to plan for >>>>>
robot_4 = ValueList({"RobRR": "robRR_track", "RobLL": "robLL_track"}, selected="RobLL")
tool = COMPASFABAttachedTool(robot=robot_3, visual_mesh=mesh_4, collision_mesh=mesh_5, tcf_plane=plane_7, group=robot_4)  # -> robot; inputs visual_mesh: Mesh, collision_mesh: Mesh
#   port visual_mesh: A visual mesh for the tool.
#   port collision_mesh: A collision mesh for the tool.
#   port tcf_plane: The frame of the tool in tool0 frame.
#   port group: The planning group to which the tool should be attached.
#   port connected_to: The link to which the tool should be connected to.
# ---------- tool: Python ----------
"""
Attach a tool to the robot.

COMPAS FAB v1.0.2
"""

from compas.geometry import Frame
from compas_rhino.conversions import mesh_to_compas
from compas_rhino.conversions import plane_to_compas_frame
from ghpythonlib.componentbase import executingcomponent as component

from compas_fab.robots import Tool


class AttachToolComponent(component):
    def RunScript(self, robot, visual_mesh, collision_mesh, tcf_plane, group, connected_to):
        if robot and robot.client and robot.client.is_connected and visual_mesh:
            if not collision_mesh:
                collision_mesh = visual_mesh

            c_visual_mesh = mesh_to_compas(visual_mesh)
            c_collision_mesh = mesh_to_compas(collision_mesh)

            if not tcf_plane:
                frame = Frame.worldXY()
            else:
                frame = plane_to_compas_frame(tcf_plane)
            tool = Tool(c_visual_mesh, frame, c_collision_mesh)

            robot.attach_tool(tool, group)

        return robot
# ---------- end tool ----------

robot_5 = ValueList({"RobRR": "robRR_track", "RobLL": "robLL_track"}, selected="RobRR")
tool_2 = COMPASFABAttachedTool(robot=tool, visual_mesh=mesh_6, collision_mesh=mesh_8, tcf_plane=plane_17, group=robot_5)  # -> robot; inputs visual_mesh: Mesh, collision_mesh: Mesh; same code as tool

ghpython_script_13 = GhPythonScript(x=tool_2)  # -> out, a
# ---------- ghpython_script_13: Python ----------
print x.get_end_effector_link_name()
# ---------- end ghpython_script_13 ----------

# ----
# 2) Attach tools and Collision Meshes
robot_6 = Data(tool_2)

forward_kinematics = PythonScript(
    robot=robot_6,
    set_joint_positions=button,
    trackLL=Slider(1.01, range=0..3.9),
    robLL_1=Slider(-134, range=-360..360),
    robLL_2=Slider(-20, range=-360..360),
    robLL_3=Slider(16, range=-360..360),
    robLL_4=Slider(23, range=-360..360),
    robLL_5=Slider(90, range=-360..360),
    robLL_6=Slider(0, range=-360..360),
    trackRR=track,
    robRR_1=Slider(-34, range=-360..360),
    robRR_2=Slider(16, range=-360..360),
    robRR_3=Slider(24, range=-360..360),
    robRR_4=Slider(-61, range=-360..360),
    robRR_5=Slider(-54, range=-360..360),
    robRR_6=Slider(3, range=-360..360))  # -> full_configuration
# ---------- forward_kinematics: Python ----------
import math
import Grasshopper
from compas_fab.robots.robot import Joint
from compas_fab.robots.robot import Configuration

if set_joint_positions:
    j = 0
    for i in range(ghenv.Component.Params.Input.Count):
        nslider = ghenv.Component.Params.Input[i].Sources[0]
        if nslider.GetType() == Grasshopper.Kernel.Special.GH_NumberSlider:
            nslider.TrySetSliderValue(math.degrees(joint_positions[j]))
            j += 1

if robot:
    joints = robot.get_configurable_joints()
    joint_types = [joint.type for joint in joints]
    joint_names = [joint.name for joint in joints]
    
    joint_positions = [trackRR, 
                        math.radians(robRR_1), math.radians(robRR_2), 
                        math.radians(robRR_3), math.radians(robRR_4), 
                        math.radians(robRR_5), math.radians(robRR_6),
                        trackLL, 
                        math.radians(robLL_1), math.radians(robLL_2), 
                        math.radians(robLL_3), math.radians(robLL_4), 
                        math.radians(robLL_5), math.radians(robLL_6)]
    
    full_configuration = Configuration(joint_positions, joint_types, joint_names)
    
print(full_configuration)
# ---------- end forward_kinematics ----------

compas_fab_inverse_kinematics = COMPASFABInverseKinematics(robot=robot_6, plane=plane_27, group=robot_2)  # -> configuration
#   port plane: The plane or frame to calculate the inverse kinematic for.
#   port start_configuration: If passed, calculates the inverse such that the joint positions differ the least from the start_configuration. Defaults to the zero configuration.
#   port group: The planning group used for calculation. Defaults to the robot's main planning group.
#   port configuration: The planning group's configuration.
# ---------- compas_fab_inverse_kinematics: Python ----------
"""
Calculate the robot's inverse kinematic for a given plane.

COMPAS FAB v1.0.2
"""

from compas_rhino.conversions import plane_to_compas_frame
from ghpythonlib.componentbase import executingcomponent as component



class InverseKinematics(component):
    def RunScript(self, robot, plane, start_configuration, group):
    
        configuration = None
        if robot and robot.client and robot.client.is_connected and plane:
            frame = plane_to_compas_frame(plane)
            configuration = robot.inverse_kinematics(frame, start_configuration, group)
        return configuration
# ---------- end compas_fab_inverse_kinematics ----------

# ----
# 0. Define pick and Approach Pick Configuration
set_config = GhPythonScript(robot=robot_6)  # -> pick_config, port, approach_pick_config
# ---------- set_config: Python ----------
from compas_fab.robots.robot import Configuration
import math


def normalize_joint_values_to_pi(config):
    for i,v in enumerate(config.joint_values):
        if v>math.pi:
            v-=2*math.pi
        if v<-math.pi:
            v+=2*math.pi
        config.joint_values[i]=v
    return config


config = robot.zero_configuration()
approach_pick_config_LL = Configuration((0.000, 3.042, 0.073, -0.093, -0.000, 1.591, 3.042), 
                        (2, 0, 0, 0, 0, 0, 0), ('robLL/track_carriage', 'robLL/joint_1', 'robLL/joint_2', 
                        'robLL/joint_3', 'robLL/joint_4', 'robLL/joint_5', 'robLL/joint_6'))

approach_pick_config_RR = Configuration((1.596, -0.665, -0.437, 0.898, -0.000, 1.109, 0.905), 
                        (2, 0, 0, 0, 0, 0, 0), ('robRR/track_carriage', 'robRR/joint_1', 'robRR/joint_2', 
                        'robRR/joint_3', 'robRR/joint_4', 'robRR/joint_5', 'robRR/joint_6'))

config.joint_values[:7] = approach_pick_config_RR.joint_values
config.joint_values[7:] = approach_pick_config_LL.joint_values
approach_pick_config = config
approach_pick_config = normalize_joint_values_to_pi(approach_pick_config)

p_config = robot.zero_configuration()
pick_config_LL = Configuration((0.000, 3.042, 0.116, 0.334, 3.142, -1.121, -6.383), 
                            (2, 0, 0, 0, 0, 0, 0), ('robLL/track_carriage', 'robLL/joint_1', 'robLL/joint_2', 
                            'robLL/joint_3', 'robLL/joint_4', 'robLL/joint_5', 'robLL/joint_6'))
                            
pick_config_RR = Configuration((1.475, -0.760, -0.016, 1.001, -0.000, 0.586, 0.811), 
                        (2, 0, 0, 0, 0, 0, 0), ('robRR/track_carriage', 'robRR/joint_1', 'robRR/joint_2', 
                        'robRR/joint_3', 'robRR/joint_4', 'robRR/joint_5', 'robRR/joint_6'))

p_config.joint_values[:7] = pick_config_RR.joint_values
p_config.joint_values[7:] = pick_config_LL.joint_values

pick_config = p_config
pick_config = normalize_joint_values_to_pi(pick_config)
# ---------- end set_config ----------

compas_fab_zero_config = COMPASFABZeroConfig(robot=robot_6)  # -> config
#   port group: If assigned, it will return the zero configuration for the given group, otherwise a full zero configuration.
#   port config: The zero configuration.
# ---------- compas_fab_zero_config: Python ----------
"""
Get a zero configuration for a robot.

COMPAS FAB v1.0.2
"""

from ghpythonlib.componentbase import executingcomponent as component


class ConfigZero(component):
    def RunScript(self, robot, group):
        if robot:
            return robot.zero_configuration(group)

        return None
# ---------- end compas_fab_zero_config ----------

# ----
# Use this for testing >>>>>
ghpython_script_14 = GhPythonScript(robot=robot_6, test=Button())  # -> config
# ---------- ghpython_script_14: Python ----------
from compas_fab.robots.robot import Configuration
import math


def normalize_joint_values_to_pi(config):
    for i,v in enumerate(config.joint_values):
        if v>math.pi:
            v-=2*math.pi
        if v<-math.pi:
            v+=2*math.pi
        config.joint_values[i]=v
    return config

def remove_other_robot (config, group):
    z_config = robot.zero_configuration(group)
    if group == "robRR_track":
        z_config.joint_values = config.joint_values [:7]
    elif group == "robLL_track":
        z_config.joint_values = config.joint_values [7:]
    return z_config

config = Configuration((0.810, -0.593, 0.279, 0.419, -1.065, -0.942, 0.052,
                         -0.000, -1.443, 0.182, 0.399, -0.081, -1.978, -0.227), 
                         (2, 0, 0, 0, 0, 0, 0, 2, 0, 0, 0, 0, 0, 0), 
                         ('robRR/track_carriage', 'robRR/joint_1', 'robRR/joint_2', 'robRR/joint_3', 
                         'robRR/joint_4', 'robRR/joint_5', 'robRR/joint_6', 'robLL/track_carriage', 
                         'robLL/joint_1', 'robLL/joint_2', 'robLL/joint_3', 'robLL/joint_4', 
                         'robLL/joint_5', 'robLL/joint_6'))

config = normalize_joint_values_to_pi(config)

if test:
    robot.attributes["robLL_track"]["last_config"] = remove_other_robot (config, "robLL_track")
    robot.attributes["robRR_track"]["last_config"] = remove_other_robot (config, "robRR_track")
# ---------- end ghpython_script_14 ----------

plan_pickup = GhPythonScript(
    robot=robot_6,
    group=panel_15,
    pick_planes=pick_planes,
    approach_distance=number_slider_3,
    flip_offset_plane=Toggle(True),
    update=Button())  # -> pick_plane, pick_config, approach_pick_plane, approach_pick_config, pick_trajectory; inputs flip_offset_plane: Boolean
# ---------- plan_pickup: Python ----------
"""
Calculate pickup of a part.
"""
from ghpythonlib.componentbase import executingcomponent as component
from scriptcontext import sticky as st

from compas.geometry import Frame
from compas.geometry import Transformation
from compas_rhino.conversions import plane_to_compas_frame, frame_to_rhino_plane
from compas_fab.ghpython.components import create_id
from compas_fab.robots import PlanningScene
from compas.geometry import scale_vector, add_vectors
from compas_fab.robots.robot import Configuration
import math

def normalize_joint_values_to_pi(config):
    for i,v in enumerate(config.joint_values):
        if v>math.pi:
            v-=2*math.pi
        if v<-math.pi:
            v+=2*math.pi
        config.joint_values[i]=v
    return config


class PickPart(component):
    def RunScript(self, robot, group, pick_config, pick_planes, approach_pick_config, approach_distance, flip_offset_plane, update):
        self.Message = ""
        
        def add_other_robot (config):
            z_config = robot.zero_configuration()
            if group == "robRR_track":
                print config
                z_config.joint_values[:7] = config.joint_values[:7]
                z_config.joint_values[7:] = robot.attributes["robLL_track"]["last_config"].joint_values
            elif group == "robLL_track":
                z_config.joint_values[:7] = robot.attributes["robRR_track"]["last_config"].joint_values
                z_config.joint_values[7:] = config.joint_values [7:]
            return z_config
        
        def remove_other_robot (config):
            z_config = robot.zero_configuration(group)
            if group == "robRR_track":
                z_config.joint_values = config.joint_values [:7]
            elif group == "robLL_track":
                z_config.joint_values = config.joint_values [7:]
            return z_config
            
        #pick_config = None
        #approach_pick_config = None
        pick_trajectory = None
        pick_frame = None
        pick_plane = None
        approach_pick_plane= None
        
        if group == "bothRRLL":
            group = "robRR_track"
        elif group == "bothLLRR":
            group = "robLL_track"
        
        if pick_planes and pick_config == None :
            pick_plane = pick_planes[group]
            pick_frame = plane_to_compas_frame(pick_planes[group])

        if approach_distance > 0 and not approach_pick_config :
            flip = 1
            if flip_offset_plane:
                flip =-1
            approach_pick_frame = pick_frame.translated(pick_frame.zaxis*approach_distance* flip)
            approach_pick_plane = frame_to_rhino_plane(approach_pick_frame)
            
        scene = PlanningScene(robot)
        scene.remove_attached_collision_mesh("attached")
        scene.remove_collision_mesh("attached") 
            
        if (update or pick_config==None or approach_pick_config==None) and robot and robot.client and robot.client.is_connected:
            try:
                pick_config = robot.inverse_kinematics(pick_frame, robot.zero_configuration(), group)
            except:
                raise Exception("Could not solve IK solution for pick config")
            try:
                approach_pick_config = robot.inverse_kinematics(approach_pick_frame, add_other_robot(pick_config), group)
            except:
                raise Exception("Could not solve IK solution for approach pick config")

        
        # Compute PICK trajectory
        if approach_pick_config and pick_config:
            
            #Remove Attached_collision mesh from the end effector 
            scene = PlanningScene(robot)
            scene.remove_attached_collision_mesh("attached")
            scene.remove_collision_mesh("attached")
            
#            pick_config = normalize_joint_values_to_pi(pick_config) # THE EXTERNAL AXIS VALUES CHANGES
#            approach_pick_config = normalize_joint_values_to_pi(approach_pick_config)  # THE EXTERNAL AXIS VALUES CHANGES
            
            max_step = 0.05
            frames = [
                       robot.forward_kinematics(c, group, options=dict(solver='model'))
                       for c in (approach_pick_config, pick_config)
                     ]
            trajectory = robot.plan_cartesian_motion(frames,
                                                     start_configuration=add_other_robot(approach_pick_config),
                                                     group=group,
                                                     options=dict(
                                                         max_step=max_step,
                                                     ))

            if trajectory.fraction < 0.11:
                raise Exception("Incomplete cartesian trajectory found. Only {:.1f}% of the trajectory could be planned".format(trajectory.fraction * 100))

            # Only assign if fraction is full
            pick_trajectory = trajectory

        self.Message = "Found pick up configurations\nusing {:.2f}m approach distance".format(approach_distance)
        
        return pick_plane, pick_config, approach_pick_plane, approach_pick_config, pick_trajectory
    
    def _offset_approach_frame(self, frame, approach_distance, flip_offset_plane):
        
        frame = frame.copy()
        offset_frame = frame.copy()
            
        if approach_distance > 0:
            frame_normal = offset_frame.normal
            frame_normal_scaled = scale_vector(-frame_normal, approach_distance)
            if(flip_offset_plane):
                frame_normal_scaled = scale_vector(-frame_normal, approach_distance)
            new_frame_origin = add_vectors(offset_frame.point, frame_normal_scaled)
            offset_frame = Frame(new_frame_origin, offset_frame.xaxis, offset_frame.yaxis)
        
        return offset_frame
# ---------- end plan_pickup ----------

info_2 = PythonScript(robot=robot_6)  # -> out, main_group_name
# ---------- info_2: Python ----------
if robot:
    robot.info()
    main_group_name = robot.main_group_name
# ---------- end info_2 ----------
panel_22 = Panel(info_2.out)

# ----
# Attach Collision Meshes
panel_23 = Panel("""assemblyPlatform
robotABB7600""")  # disabled
geos = Geometry([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])
mesh_10 = Mesh(geos)  # disabled
attach_cm = GhPythonScript(robot=robot_6, meshes=mesh_10, names=panel_23)  # inputs meshes: list of Mesh, names: list; disabled; same code as attach_acm_to_baselink

# ----
# 1) Connect with Real Robots ----------------
speed = Slider(125, range=50..1000)
abb = GhPythonScript(ros_client=ros.ros_client)  # -> abbs
# ---------- abb: Python ----------
import compas_rrc as rrc

abbs ={}
if ros_client and ros_client.is_connected:
    abbs ["robLL_track"] = rrc.AbbClient(ros_client, '/robLL_track')
    abbs ["robRR_track"] = rrc.AbbClient(ros_client, '/robRR_track')
    
abbs=[abbs]
# ---------- end abb ----------

# ----
# 1a. Get Start Configuration (Current)
button_2 = Button()
current = GhPythonScript(robot=robot_6, abbs=abb, go=button_2)  # -> config, frameLL, planeLL, frameRR, planeRR
# ---------- current: Python ----------
import Grasshopper
import System
import Rhino
import scriptcontext as sc

from ghpythonlib.componentbase import executingcomponent as component
from compas_rhino.conversions import frame_to_rhino_plane

from compas_fab.robots import to_radians
from compas_fab.ghpython.components import create_id

import compas_rrc as rrc

MM_to_M = 0.001

class MyComponent(component):
    
    def RunScript(self, robot, abbs, go):
        key = create_id(self, 'last_config')
        
        frameRR = None
        planeRR = None
        
        frameLL = None
        planeLL = None
        
        
        abbRR = abbs["robRR_track"]
        abbLL = abbs["robLL_track"]
        
        
        if robot and abbs and abbRR.ros.is_connected and abbLL.ros.is_connected and go:
            jointsRR, external_axes_RR = abbRR.send_and_wait(rrc.GetJoints(), timeout=5)
            jointsLL, external_axes_LL = abbLL.send_and_wait(rrc.GetJoints(), timeout=5)
            config = robot.zero_configuration()
            configLL = robot.zero_configuration("robLL_track")
            configRR = robot.zero_configuration("robRR_track")
            
            configRR.joint_values[0]  = external_axes_RR[0] * MM_to_M
            configRR.joint_values[1:7]  = to_radians(jointsRR)
            
#            if all(round(a, 3) == round(b, 3) for a, b in zip(robot.attributes["robRR_track"]["last_config"].joint_values, configRR.joint_values)):
#                robot.attributes["robRR_track"]["changed"] = False
#            else:
#                robot.attributes["robRR_track"]["last_trajectory"]= {}
#                robot.attributes["robRR_track"]["changed"] = True
            
            robot.attributes["robRR_track"]["last_config"] = configRR
            
            configLL.joint_values[0]  = external_axes_LL[0] * MM_to_M
            configLL.joint_values[1:7]  = to_radians(jointsLL)
            
#            if all(round(a, 3) == round(b, 3) for a, b in zip(robot.attributes["robLL_track"]["last_config"].joint_values, configLL.joint_values)):
#                robot.attributes["robLL_track"]["changed"] = False
#            else:
#                robot.attributes["robLL_track"]["last_trajectory"]= {}
#                robot.attributes["robLL_track"]["changed"] = True
                
            robot.attributes["robLL_track"]["last_config"] = configLL
             
            config.joint_values[:7] = configRR.joint_values[:7]
            config.joint_values[7:] = configLL.joint_values[:7]
            
            sc.sticky[key] = config
            
            
        config = sc.sticky.get(key)
        

        if robot and config:
            frameRR = robot.forward_kinematics(config, group = "robRR_track", options=dict(solver='model'))
            frameLL = robot.forward_kinematics(config, group = "robLL_track", options=dict(solver='model'))
            #print frameLL == robot.attributes["robLL_track"]["last_placed_frame"]
            planeRR = frame_to_rhino_plane(frameRR) 
            planeLL = frame_to_rhino_plane(frameLL)

        return (config, frameLL, planeLL, frameRR, planeRR)
# ---------- end current ----------

approach_pick_config = Data(plan_pickup.approach_pick_config)
pick_trajectory = Data(plan_pickup.pick_trajectory)
pick_config = Data(plan_pickup.pick_config)
plane_28 = Plane(plan_pickup.approach_pick_plane)
plane_29 = Plane(plan_pickup.pick_plane)

plan_place = GhPythonScript(
    robot=robot_6,
    group=panel_16,
    approach_pick_config=approach_pick_config,
    place_frame=data_2,
    approach_distance=Slider(0.1, range=0..1),
    flip_offset_plane=Toggle(False),
    update=update)  # -> place_config, approach_place_config; inputs mesh: Mesh, flip_offset_plane: Boolean
# ---------- plan_place: Python ----------
"""
Calculate placement of a part.
"""
from ghpythonlib.componentbase import executingcomponent as component
#from scriptcontext import sticky as st

from compas.geometry import Frame
from compas.geometry import Transformation, Rotation, Translation, Vector
from compas_rhino.conversions import plane_to_compas_frame, frame_to_rhino_plane, mesh_to_compas
from compas_fab.ghpython.components import create_id
from compas_fab.robots import PlanningScene, CollisionMesh
from compas.geometry import scale_vector, add_vectors
from compas_fab.robots.robot import Configuration
import math

def normalize_joint_values_to_pi(config):
    for i,v in enumerate(config.joint_values):
        if v>math.pi:
            v-=2*math.pi
        if v<-math.pi:
            v+=2*math.pi
        config.joint_values[i]=v
    return config

class PlacePart(component):
    def RunScript(self, robot, group, approach_pick_config, place_frame, mesh, approach_distance, flip_offset_plane, update):
        self.Message = ""
        
        def add_other_robot (config):
            z_config = robot.zero_configuration()
            if group == "robRR_track":
                z_config.joint_values[:7] = config.joint_values [:7]
                z_config.joint_values[7:] = robot.attributes["robLL_track"]["last_config"].joint_values
            elif group == "robLL_track":
                z_config.joint_values[:7] = robot.attributes["robRR_track"]["last_config"].joint_values
                z_config.joint_values[7:] = config.joint_values [7:]
            return z_config
            
        def remove_other_robot (config):
            z_config = robot.zero_configuration(group)
            if group == "robRR_track":
                z_config.joint_values = config.joint_values [:7]
            elif group == "robLL_track":
                z_config.joint_values = config.joint_values [7:]
            return z_config
            
        if group == "bothRRLL":
            group = "robRR_track"
        elif group == "bothLLRR":
            group = "robLL_track"
            
        if not place_frame:
            raise Exception("No place plane defined")

        place_config = None
        approach_place_config = None
        
        if (update or not place_config or not approach_place_config) and robot and robot.client and robot.client.is_connected:
            
            #Remove Attached_collision mesh from the end effector 
            scene = PlanningScene(robot)
            scene.remove_attached_collision_mesh("attached")
            scene.remove_collision_mesh("attached")
                
            if flip_offset_plane:
                R = Rotation.from_axis_and_angle(place_frame.zaxis, math.radians(180), place_frame.point)
            else:
                R = Rotation.from_axis_and_angle(place_frame.zaxis, math.radians(0), place_frame.point)
            
            place_frame.transform(R)
            place_plane = frame_to_rhino_plane(place_frame)
            
            approach_place_frame = place_frame.translated(place_frame.zaxis*-approach_distance)
            approach_place_plane = frame_to_rhino_plane(approach_place_frame)
            
            try:
                place_config = robot.inverse_kinematics(place_frame, add_other_robot(approach_pick_config), group)
            except:
                raise Exception("Could solve IK solution for place config")
            try:
                approach_place_config = robot.inverse_kinematics(approach_place_frame, add_other_robot(approach_pick_config), group)
            except:
                raise Exception("Could not solve IK solution for approach place config")

        self.Message = "Found place configurations\nusing {:.2f}m approach distance".format(approach_distance)
        
        place_config = normalize_joint_values_to_pi(place_config)
        
        approach_place_config = normalize_joint_values_to_pi(approach_place_config)
        
        return place_config, approach_place_config
# ---------- end plan_place ----------

approach_place_config = Data(plan_place.approach_place_config)
place_config = Data(plan_place.place_config)

# ----
# 2. Plan Trajectories
panel_24 = Panel(robot)
plan_free_motion = GhPythonScript(
    robot=robot_6,
    group=panel_24,
    current_config=current.config,
    approach_pick_config=approach_pick_config,
    approach_place_config=approach_place_config,
    place_config=place_config,
    exit_distance=Slider(0.25, range=0..0.5),
    compute=Toggle(True),
    update=Button())  # -> exit_safe_config, exit_trajectory, move_to_pick_trajectory, move_trajectory, place_trajectory, place_config; inputs compute: Boolean
# ---------- plan_free_motion: Python ----------
"""
Calculate pickup trajectory of a part.
"""
import math
from ghpythonlib.componentbase import executingcomponent as component
from scriptcontext import sticky as st

from compas.geometry import Frame, Vector
from compas.geometry import Transformation, Translation, Rotation
from compas_rhino.conversions import plane_to_compas_frame, frame_to_rhino_plane
from compas_fab.ghpython.components import create_id
from compas_fab.robots import AttachedCollisionMesh
from compas_fab.robots import CollisionMesh
from compas_fab.robots import PlanningScene
from compas_fab.robots.robot import Configuration



class PlanPartPickupTrajectory(component):
    
    def RunScript(self, robot, group, current_config, approach_pick_config, approach_place_config, place_config, exit_distance, mesh, planner_id, compute, bang):
        self.Message = ""
        
        def add_other_robot (config):
            z_config = robot.zero_configuration()
            if group == "robRR_track":
                z_config.joint_values[:7] = config.joint_values [:7]
                z_config.joint_values[7:] = robot.attributes["robLL_track"]["last_config"].joint_values
            elif group == "robLL_track":
                z_config.joint_values[:7] = robot.attributes["robRR_track"]["last_config"].joint_values
                z_config.joint_values[7:] = config.joint_values [7:]
            return z_config
        
        def remove_other_robot (config):
            z_config = robot.zero_configuration(group)
            if group == "robRR_track":
                z_config.joint_values = config.joint_values [:7]
            elif group == "robLL_track":
                z_config.joint_values = config.joint_values [7:]
            return z_config
        
        exit_trajectory = None
        move_to_pick_trajectory = None
        place_trajectory = None
        move_trajectory = None
        
        
        exit_safe_config = None
        
        if group == "bothRRLL":
            group = "robRR_track"
        elif group == "bothLLRR":
            group = "robLL_track"
        
        if not approach_pick_config or not place_config or not approach_place_config:
            self.Message = "No approach or place or current config defined"
            return exit_safe_config, exit_trajectory, move_to_pick_trajectory, move_trajectory, place_trajectory
        
        try:

            if compute and robot and robot.client and robot.client.is_connected:
                #Remove Attached_collision mesh from the end effector 
                scene = PlanningScene(robot)
                scene.remove_attached_collision_mesh("attached")
                scene.remove_collision_mesh("attached")
                
                ####################### Current config ########################################
                
                
                ####################### Compute Exit Safe config ########################################
                current_robot_frame = robot.forward_kinematics(current_config, group, options=dict(solver='model'))
                exit_safe_frame = current_robot_frame.translated(current_robot_frame.zaxis*-exit_distance)
                exit_safe_config = robot.inverse_kinematics(exit_safe_frame, current_config, group)
                exit_safe_config = normalize_joint_values_to_pi(exit_safe_config)
                
                
                max_step = 0.05
                frames = [
                           robot.forward_kinematics(c, group, options=dict(solver='model'))
                           for c in (current_config, exit_safe_config)
                         ]
                
                #--------------------- Compute Exit Trajectory -----------------------------------------#
                trajectory = robot.plan_cartesian_motion(frames,
                                                         start_configuration=add_other_robot(current_config),
                                                         group=group,
                                                         options=dict(
                                                             max_step=max_step
                                                             ))
                
                if trajectory.fraction < 1:
                    raise Exception("Incomplete cartesian trajectory found for exit trajectory. Only {:.1f}% of the trajectory could be planned".format(trajectory.fraction * 100))
    
                # Only assign if fraction is full
                exit_trajectory = trajectory
            
            #--------------------- Compute Move to Pick Trajectory -----------------------------------------#
            if compute and robot and robot.client and robot.client.is_connected:
                planner_id = planner_id or 'TRRT'
                
                tolerance_above = self._generate_default_tolerances(robot.get_configurable_joints(group))
                tolerance_below = self._generate_default_tolerances(robot.get_configurable_joints(group))
                goal_constraints = robot.constraints_from_configuration(
                    configuration=remove_other_robot(approach_pick_config),
                    tolerances_above=tolerance_above,
                    tolerances_below=tolerance_below,
                    group=group
                )
                move_to_pick_trajectory = robot.plan_motion(goal_constraints,
                                                                       start_configuration=add_other_robot(exit_safe_config),
                                                                       group=group,
                                                                       options=dict(
                                                                           planner_id=planner_id
                                                                           ))
                
                move_to_pick_trajectory = move_to_pick_trajectory
            
            
            #--------------------- Compute Place Trajectory -----------------------------------------#
            if compute and robot and robot.client and robot.client.is_connected:
                
                max_step = 0.02
                frames = [
                           robot.forward_kinematics(c, group, options=dict(solver='model'))
                            for c in (approach_place_config, place_config)
                         ]
                trajectory = robot.plan_cartesian_motion(frames,
                                                         start_configuration=add_other_robot(approach_place_config),
                                                         group=group,
                                                         options=dict(
                                                             max_step=max_step
                                                         ))
                
                if trajectory.fraction < 0.01:
                    raise Exception("Incomplete cartesian trajectory found. Only {:.1f}% of the trajectory could be planned".format(trajectory.fraction * 100))
    
                # Only assign if fraction is full
                place_trajectory = trajectory
    
                    
                    
            #--------------------- Compute Move Trajectory -----------------------------------------#
            if compute and robot and robot.client and robot.client.is_connected:
                planner_id = planner_id or 'TRRT'
                
                scene = PlanningScene(robot)
                if mesh:
                    transformed_mesh = mesh.transformed(Translation.from_vector(Vector.Zaxis()*0.10)*Rotation.from_axis_and_angle(Vector.Zaxis(), math.radians(90)))
                    cm = CollisionMesh(transformed_mesh, "attached")
                    scene.attach_collision_mesh_to_robot_end_effector(cm, group=group)
                
                
                tolerance_above = self._generate_default_tolerances(robot.get_configurable_joints(group))
                tolerance_below = self._generate_default_tolerances(robot.get_configurable_joints(group))
                goal_constraints = robot.constraints_from_configuration(
                                    configuration=approach_place_config,
                                    tolerances_above=tolerance_above,
                                    tolerances_below=tolerance_below,
                                    group=group
                                    )
                trajectory = robot.plan_motion(goal_constraints,
                                                   start_configuration=add_other_robot(approach_pick_config),
                                                   group=group,
                                                   options=dict(
                                                   planner_id=planner_id,
                                                   ))
                move_trajectory = trajectory
                
            if place_trajectory and move_trajectory and move_to_pick_trajectory and exit_trajectory :
                self.Message = "Found move and place trajectories ({} points)".format(len(exit_trajectory.points) +len(move_to_pick_trajectory.points) +len(move_trajectory.points) + len(place_trajectory.points))
                
                return exit_safe_config, exit_trajectory, move_to_pick_trajectory, move_trajectory, place_trajectory, place_config
                
        except Exception as e:
            print e
            self.Message = "Failed"
            return exit_safe_config, exit_trajectory, move_to_pick_trajectory, move_trajectory, place_trajectory
        
    def _generate_default_tolerances(self, joints):
        DEFAULT_TOLERANCE_METERS = .001
        DEFAULT_TOLERANCE_RADIANS = math.radians(1)

        return [
            DEFAULT_TOLERANCE_METERS if j.is_scalable()
            else DEFAULT_TOLERANCE_RADIANS
            for j in joints
        ]
    
def normalize_joint_values_to_pi(config):
    for i,v in enumerate(config.joint_values):
        if v>math.pi:
            v-=2*math.pi
        if v<-math.pi:
            v+=2*math.pi
        config.joint_values[i]=v
    return config
# ---------- end plan_free_motion ----------

plan_pickup_2 = GhPythonScript(
    robot=robot_6,
    group=panel_17,
    other_placed_config=plan_free_motion.place_config,
    pick_plane=plane_16,
    approach_distance=number_slider_4,
    flip_offset_plane=Toggle(True),
    update=Button())  # -> pick_config, approach_pick_config, pick_trajectory; inputs flip_offset_plane: Boolean
# ---------- plan_pickup_2: Python ----------
"""
Calculate pickup of a part.
"""
from ghpythonlib.componentbase import executingcomponent as component
from scriptcontext import sticky as st

from compas.geometry import Frame
from compas.geometry import Transformation
from compas_rhino.conversions import plane_to_compas_frame, frame_to_rhino_plane
from compas_fab.ghpython.components import create_id
from compas_fab.robots import PlanningScene
from compas.geometry import scale_vector, add_vectors
from compas_fab.robots.robot import Configuration
import math

def normalize_joint_values_to_pi(config):
    for i,v in enumerate(config.joint_values):
        if v>math.pi:
            v-=2*math.pi
        if v<-math.pi:
            v+=2*math.pi
        config.joint_values[i]=v
    return config
    

class PickPart(component):
    def RunScript(self, robot, group, other_placed_config, pick_config, pick_plane, approach_pick_config, approach_distance, flip_offset_plane, update):
        self.Message = ""
        
        def add_other_robot (config):
            z_config = robot.zero_configuration()
            if group == "robRR_track":
                z_config.joint_values[:7] = config.joint_values
                z_config.joint_values[7:] = other_placed_config.joint_values
            elif group == "robLL_track":
                z_config.joint_values[:7] = other_placed_config.joint_values
                z_config.joint_values[7:] = config.joint_values
            return z_config
        
        def remove_other_robot (config):
            z_config = robot.zero_configuration(group)
            if group == "robRR_track":
                z_config.joint_values = config.joint_values [:7]
            elif group == "robLL_track":
                z_config.joint_values = config.joint_values [7:]
            return z_config
            
        #pick_config = None
        #approach_pick_config = None
        pick_trajectory = None
        pick_frame = None
        
        if group == "bothRRLL":
            group = "robLL_track"
        elif group == "bothLLRR":
            group = "robRR_track"
        else:
            return pick_config, approach_pick_config, pick_trajectory
            
        if pick_plane and pick_config == None :
            pick_frame = plane_to_compas_frame(pick_plane)

        if approach_distance > 0 and not approach_pick_config :
            flip = 1
            if flip_offset_plane:
                flip =-1
            approach_pick_frame = pick_frame.translated(pick_frame.zaxis*approach_distance* flip)
            
        scene = PlanningScene(robot)
        scene.remove_attached_collision_mesh("attached")
        scene.remove_collision_mesh("attached") 
            
        if (update or pick_config==None or approach_pick_config==None) and robot and robot.client and robot.client.is_connected:
            try:
                pick_config = robot.inverse_kinematics(pick_frame, robot.zero_configuration(), group)
            except:
                raise Exception("Could not solve IK solution for pick config")
            try:
                approach_pick_config = robot.inverse_kinematics(approach_pick_frame, add_other_robot(pick_config), group)
            except:
                raise Exception("Could not solve IK solution for approach pick config")

        
        # Compute PICK trajectory
        if approach_pick_config and pick_config:
            
            #Remove Attached_collision mesh from the end effector 
            scene = PlanningScene(robot)
            scene.remove_attached_collision_mesh("attached")
            scene.remove_collision_mesh("attached")
            
            pick_config = normalize_joint_values_to_pi(pick_config)
            approach_pick_config = normalize_joint_values_to_pi(approach_pick_config)
            
            max_step = 0.05
            frames = [
                       robot.forward_kinematics(c, group, options=dict(solver='model'))
                       for c in (approach_pick_config, pick_config)
                     ]
            trajectory = robot.plan_cartesian_motion(frames,
                                                     start_configuration=add_other_robot(approach_pick_config),
                                                     group=group,
                                                     options=dict(
                                                         max_step=max_step,
                                                     ))
            if trajectory.fraction < 0.11:
                raise Exception("Incomplete cartesian trajectory found. Only {:.1f}% of the trajectory could be planned".format(trajectory.fraction * 100))

            # Only assign if fraction is full
            pick_trajectory = trajectory

        self.Message = "Found pick up configurations\nusing {:.2f}m approach distance".format(approach_distance)
        
        return pick_config, approach_pick_config, pick_trajectory
    
    def _offset_approach_frame(self, frame, approach_distance, flip_offset_plane):
        
        frame = frame.copy()
        offset_frame = frame.copy()
            
        if approach_distance > 0:
            frame_normal = offset_frame.normal
            frame_normal_scaled = scale_vector(-frame_normal, approach_distance)
            if(flip_offset_plane):
                frame_normal_scaled = scale_vector(-frame_normal, approach_distance)
            new_frame_origin = add_vectors(offset_frame.point, frame_normal_scaled)
            offset_frame = Frame(new_frame_origin, offset_frame.xaxis, offset_frame.yaxis)
        
        return offset_frame
# ---------- end plan_pickup_2 ----------
move_to_pick_trajectory = Data(plan_free_motion.move_to_pick_trajectory)
move_trajectory = Data(plan_free_motion.move_trajectory)
place_trajectory = Data(plan_free_motion.place_trajectory)
exit_trajectory = Data(plan_free_motion.exit_trajectory)

approach_pick_config_2 = Data(plan_pickup_2.approach_pick_config)
pick_trajectory_2 = Data(plan_pickup_2.pick_trajectory)
pick_config_2 = Data(plan_pickup_2.pick_config)

plan_place_2 = GhPythonScript(
    robot=robot_6,
    group=panel_18,
    other_placed_config=plan_free_motion.place_config,
    approach_pick_config=approach_pick_config_2,
    place_frame=ghpython_script_4,
    approach_distance=Slider(0.1, range=0..1),
    flip_offset_plane=Toggle(False),
    update=update_2)  # -> place_config, approach_place_config; inputs mesh: Mesh, flip_offset_plane: Boolean
# ---------- plan_place_2: Python ----------
"""
Calculate placement of a part.
"""
from ghpythonlib.componentbase import executingcomponent as component
#from scriptcontext import sticky as st

from compas.geometry import Frame
from compas.geometry import Transformation, Rotation, Translation, Vector
from compas_rhino.conversions import plane_to_compas_frame, frame_to_rhino_plane, mesh_to_compas
from compas_fab.ghpython.components import create_id
from compas_fab.robots import PlanningScene, CollisionMesh
from compas.geometry import scale_vector, add_vectors
from compas_fab.robots.robot import Configuration
import math

def normalize_joint_values_to_pi(config):
    for i,v in enumerate(config.joint_values):
        if v>math.pi:
            v-=2*math.pi
        if v<-math.pi:
            v+=2*math.pi
        config.joint_values[i]=v
    return config

class PlacePart(component):
    def RunScript(self, robot, group, other_placed_config, approach_pick_config, place_frame, mesh, approach_distance, flip_offset_plane, update):
        self.Message = ""
        
        def add_other_robot (config):
            z_config = robot.zero_configuration()
            if group == "robRR_track":
                z_config.joint_values[:7] = config.joint_values
                z_config.joint_values[7:] = other_placed_config.joint_values
            elif group == "robLL_track":
                z_config.joint_values[:7] = other_placed_config.joint_values
                z_config.joint_values[7:] = config.joint_values
            return z_config
            
        def remove_other_robot (config):
            z_config = robot.zero_configuration(group)
            if group == "robRR_track":
                z_config.joint_values = config.joint_values [:7]
            elif group == "robLL_track":
                z_config.joint_values = config.joint_values [7:]
            return z_config
        
        place_config = None
        approach_place_config = None
        
        if group == "bothRRLL":
            group = "robLL_track"
        elif group == "bothLLRR":
            group = "robRR_track"
        else:
            return place_config, approach_place_config
            
        if not place_frame:
            raise Exception("No place plane defined")
        
        if (update or not place_config or not approach_place_config) and robot and robot.client and robot.client.is_connected:
            
            #Remove Attached_collision mesh from the end effector 
            scene = PlanningScene(robot)
            scene.remove_attached_collision_mesh("attached")
            scene.remove_collision_mesh("attached")
                
            if flip_offset_plane:
                R = Rotation.from_axis_and_angle(place_frame.zaxis, math.radians(180), place_frame.point)
            else:
                R = Rotation.from_axis_and_angle(place_frame.zaxis, math.radians(0), place_frame.point)
            
            place_frame.transform(R)
            place_plane = frame_to_rhino_plane(place_frame)
            
            approach_place_frame = place_frame.translated(place_frame.zaxis*-approach_distance)
            approach_place_plane = frame_to_rhino_plane(approach_place_frame)
            
            try:
                place_config = robot.inverse_kinematics(place_frame, add_other_robot(approach_pick_config), group)
            except:
                raise Exception("Could solve IK solution for place config")
            try:
                approach_place_config = robot.inverse_kinematics(approach_place_frame, add_other_robot(approach_pick_config), group)
            except:
                raise Exception("Could not solve IK solution for approach place config")

        self.Message = "Found place configurations\nusing {:.2f}m approach distance".format(approach_distance)
        
        place_config = normalize_joint_values_to_pi(place_config)
        
        approach_place_config = normalize_joint_values_to_pi(approach_place_config)
        
        return place_config, approach_place_config
# ---------- end plan_place_2 ----------

approach_place_config_2 = Data(plan_place_2.approach_place_config)
place_config_2 = Data(plan_place_2.place_config)

panel_25 = Panel(robot)
plan_free_motion_2 = GhPythonScript(
    robot=robot_6,
    group=panel_25,
    other_placed_config=plan_free_motion.place_config,
    current_config=current.config,
    approach_pick_config=approach_pick_config_2,
    approach_place_config=approach_place_config_2,
    place_config=place_config_2,
    exit_distance=Slider(0.15, range=0..0.5),
    compute=Toggle(True),
    update=Button())  # -> exit_safe_config, exit_trajectory, move_to_pick_trajectory, move_trajectory, place_trajectory; inputs compute: Boolean
# ---------- plan_free_motion_2: Python ----------
"""
Calculate pickup trajectory of a part.
"""
import math
from ghpythonlib.componentbase import executingcomponent as component
from scriptcontext import sticky as st

from compas.geometry import Frame, Vector
from compas.geometry import Transformation, Translation, Rotation
from compas_rhino.conversions import plane_to_compas_frame, frame_to_rhino_plane
from compas_fab.ghpython.components import create_id
from compas_fab.robots import AttachedCollisionMesh
from compas_fab.robots import CollisionMesh
from compas_fab.robots import PlanningScene
from compas_fab.robots.robot import Configuration



class PlanPartPickupTrajectory(component):
    
    def RunScript(self, robot, group, other_placed_config, current_config, approach_pick_config, approach_place_config, place_config, exit_distance, mesh, planner_id, compute, bang):
        self.Message = ""
        
        def add_other_robot (config):
            z_config = robot.zero_configuration()
            if group == "robRR_track":
                z_config.joint_values[:7] = config.joint_values
                z_config.joint_values[7:] = other_placed_config.joint_values
            elif group == "robLL_track":
                z_config.joint_values[:7] = other_placed_config.joint_values
                z_config.joint_values[7:] = config.joint_values
            return z_config
        
        def remove_other_robot (config):
            z_config = robot.zero_configuration(group)
            if group == "robRR_track":
                z_config.joint_values = config.joint_values [:7]
            elif group == "robLL_track":
                z_config.joint_values = config.joint_values [7:]
            return z_config
        
        exit_trajectory = None
        move_to_pick_trajectory = None
        place_trajectory = None
        move_trajectory = None
        
        
        exit_safe_config = None
        
        if group == "bothRRLL":
            group = "robLL_track"
        elif group == "bothLLRR":
            group = "robRR_track"
        else:
            return exit_safe_config, exit_trajectory, move_to_pick_trajectory, move_trajectory, place_trajectory
        
        if not approach_pick_config or not place_config or not approach_place_config:
            self.Message = "No approach or place or current config defined"
            return exit_safe_config, exit_trajectory, move_to_pick_trajectory, move_trajectory, place_trajectory
        
        try:

            if compute and robot and robot.client and robot.client.is_connected:
                #Remove Attached_collision mesh from the end effector 
                scene = PlanningScene(robot)
                scene.remove_attached_collision_mesh("attached")
                scene.remove_collision_mesh("attached")
                
                ####################### Current config ########################################
                
                
                ####################### Compute Exit Safe config ########################################
                current_robot_frame = robot.forward_kinematics(current_config, group, options=dict(solver='model'))
                exit_safe_frame = current_robot_frame.translated(current_robot_frame.zaxis*-exit_distance)
                exit_safe_config = robot.inverse_kinematics(exit_safe_frame, current_config, group)
                exit_safe_config = normalize_joint_values_to_pi(exit_safe_config)
                
                
                max_step = 0.05
                frames = [
                           robot.forward_kinematics(c, group, options=dict(solver='model'))
                           for c in (current_config, exit_safe_config)
                         ]
                
                #--------------------- Compute Exit Trajectory -----------------------------------------#
                trajectory = robot.plan_cartesian_motion(frames,
                                                         start_configuration=current_config,
                                                         group=group,
                                                         options=dict(
                                                             max_step=max_step
                                                             ))
                
                if trajectory.fraction < 1:
                    raise Exception("Incomplete cartesian trajectory found for exit trajectory. Only {:.1f}% of the trajectory could be planned".format(trajectory.fraction * 100))
    
                # Only assign if fraction is full
                exit_trajectory = trajectory
            
           
            #--------------------- Compute Move to Pick Trajectory -----------------------------------------#
            if compute and robot and robot.client and robot.client.is_connected:
                planner_id = planner_id or 'TRRT'
                
                tolerance_above = self._generate_default_tolerances(robot.get_configurable_joints(group))
                tolerance_below = self._generate_default_tolerances(robot.get_configurable_joints(group))
                goal_constraints = robot.constraints_from_configuration(
                    configuration=approach_pick_config,
                    tolerances_above=tolerance_above,
                    tolerances_below=tolerance_below,
                    group=group
                )
                
                move_to_pick_trajectory = robot.plan_motion(goal_constraints,
                                                                       start_configuration=add_other_robot(exit_safe_config),
                                                                       group=group,
                                                                       options=dict(
                                                                           planner_id=planner_id
                                                                           ))
                
                move_to_pick_trajectory = move_to_pick_trajectory
            
            
            #--------------------- Compute Place Trajectory -----------------------------------------#
            if compute and robot and robot.client and robot.client.is_connected:
                
                max_step = 0.02
                frames = [
                           robot.forward_kinematics(c, group, options=dict(solver='model'))
                            for c in (approach_place_config, place_config)
                         ]
                trajectory = robot.plan_cartesian_motion(frames,
                                                         start_configuration=add_other_robot(approach_place_config),
                                                         group=group,
                                                         options=dict(
                                                             max_step=max_step
                                                         ))
                
                if trajectory.fraction < 0.01:
                    raise Exception("Incomplete cartesian trajectory found. Only {:.1f}% of the trajectory could be planned".format(trajectory.fraction * 100))
    
                # Only assign if fraction is full
                place_trajectory = trajectory
    
                    
                    
            #--------------------- Compute Move Trajectory -----------------------------------------#
            if compute and robot and robot.client and robot.client.is_connected:
                planner_id = planner_id or 'TRRT'
                
                scene = PlanningScene(robot)
                if mesh:
                    transformed_mesh = mesh.transformed(Translation.from_vector(Vector.Zaxis()*0.10)*Rotation.from_axis_and_angle(Vector.Zaxis(), math.radians(90)))
                    cm = CollisionMesh(transformed_mesh, "attached")
                    scene.attach_collision_mesh_to_robot_end_effector(cm, group=group)
                
                
                tolerance_above = self._generate_default_tolerances(robot.get_configurable_joints(group))
                tolerance_below = self._generate_default_tolerances(robot.get_configurable_joints(group))
                goal_constraints = robot.constraints_from_configuration(
                                    configuration=approach_place_config,
                                    tolerances_above=tolerance_above,
                                    tolerances_below=tolerance_below,
                                    group=group
                                    )
                trajectory = robot.plan_motion(goal_constraints,
                                                   start_configuration=add_other_robot(approach_pick_config),
                                                   group=group,
                                                   options=dict(
                                                   planner_id=planner_id,
                                                   ))
                move_trajectory = trajectory
                
            if place_trajectory and move_trajectory and move_to_pick_trajectory and exit_trajectory :
                self.Message = "Found move and place trajectories ({} points)".format(len(exit_trajectory.points) +len(move_to_pick_trajectory.points) +len(move_trajectory.points) + len(place_trajectory.points))
                
                return exit_safe_config, exit_trajectory, move_to_pick_trajectory, move_trajectory, place_trajectory
                
        except Exception as e:
            print e
            self.Message = "Failed"
            return exit_safe_config, exit_trajectory, move_to_pick_trajectory, move_trajectory, place_trajectory
        
    def _generate_default_tolerances(self, joints):
        DEFAULT_TOLERANCE_METERS = .001
        DEFAULT_TOLERANCE_RADIANS = math.radians(1)

        return [
            DEFAULT_TOLERANCE_METERS if j.is_scalable()
            else DEFAULT_TOLERANCE_RADIANS
            for j in joints
        ]
    
def normalize_joint_values_to_pi(config):
    for i,v in enumerate(config.joint_values):
        if v>math.pi:
            v-=2*math.pi
        if v<-math.pi:
            v+=2*math.pi
        config.joint_values[i]=v
    return config
# ---------- end plan_free_motion_2 ----------

# ----
# 2. Plan Trajectories
move_to_pick_trajectory_2 = Data(plan_free_motion_2.move_to_pick_trajectory)
place_trajectory_2 = Data(plan_free_motion_2.place_trajectory)
move_trajectory_2 = Data(plan_free_motion_2.move_trajectory)
exit_trajectory_2 = Data(plan_free_motion_2.exit_trajectory)

mesh_11 = Mesh(geos)
mesh_edges = MeshEdges(Mesh=mesh_11)  # -> NakedEdges, InteriorEdges, NonManifoldEdges
joint_states = GhPythonScript(robot=robot_6, subscribe=subscribe, unsubscribe=unsubscribe)
# ---------- joint_states: Python ----------
def _receive_joint_states(message):
    for key, joint_name in enumerate(message.get('name')):
        print ( message.get('position')[key])
        robot.mobile_client.current_joint_values[joint_name] = message.get('position')[key]


if subscribe:
    robot.mobile_client.topic_subscribe('/joint_states', 'sensor_msgs/JointState', _receive_joint_states)

if unsubscribe:
    robot.mobile_client.topic_unsubscribe('/joint_states')
# ---------- end joint_states ----------

go_3 = Button()
panel_26 = Panel(robot)
# import compas_rrc as rrc
# 
# if __name__ == "__main__":
#     # Create Ros Client
#     ros = rrc.RosClient()
#     ros.run()
# 
#     # Create ABB Client
#     abb = rrc.AbbClient(ros, "/rob1")
#     print("Connected.")
# 
#     # Set start values
#     robot_joints, external_axes = [0, 0, 0, 0, 0, 0], []
# 
#     # Move robot to start position
#     done = abb.send_and_wait(rrc.MoveToJoints(robot_joints, external_axes, 1000, rrc.Zone.FINE))
# 
#     # Print feedback
#     print("Feedback = ", done)
# 
#     # End of Code
#     print("Finished")
# 
#     # Close client
#     ros.close()
# Send Pick and Place
send_pick_n_place = GhPythonScript(
    robot=robot_6,
    abbs=abb,
    group=panel_26,
    speed=speed,
    place_config=place_config,
    exit_trajectory=exit_trajectory,
    move_to_pick_trajectory=move_to_pick_trajectory,
    pick_trajectory=pick_trajectory,
    move_trajectory=move_trajectory,
    place_trajectory=place_trajectory,
    place_config_2=place_config_2,
    exit_trajectory_2=exit_trajectory_2,
    move_to_pick_trajectory_2=move_to_pick_trajectory_2,
    pick_trajectory_2=pick_trajectory_2,
    move_trajectory_2=move_trajectory_2,
    place_trajectory_2=place_trajectory_2,
    go=go_3)
# ---------- send_pick_n_place: Python ----------
import compas_rrc as rrc
from compas_fab.robots import to_degrees

M_to_MM = 1000
both = False
def send_trajectory(abb, speed, points, last_point_fine=True):
    for i in range(len(points)):
        c = points[i]
        joints = to_degrees(c.joint_values[1:])
        ext_axes=[c.joint_values[0]* M_to_MM] 
        if i < len(points) - 1:
            zone = rrc.Zone.Z10
        else:
            zone = rrc.Zone.FINE if last_point_fine else rrc.Zone.Z10

        abb.send(rrc.MoveToJoints(joints, ext_axes, speed=speed, zone=zone))

if group == "bothRRLL":
    group = "robRR_track"
    groupB = "robLL_track"
    both= True
elif group == "bothLLRR":
    group = "robLL_track"
    groupB = "robRR_track"
    both= True

abbA = abbs[group]
print (group)
io_signal_air_A = robot.attributes[group]["io_AIR"]
io_signal_gripper_A = robot.attributes[group]["io_GRIPPER"]
print (io_signal_gripper_A)
print (io_signal_air_A)
if robot and abbA and abbA.ros.is_connected and go:
    total_points = len(exit_trajectory.points)+ len(move_to_pick_trajectory.points)+  len(pick_trajectory.points) * 2 + len(move_trajectory.points) + len(place_trajectory.points)
    
    abbA.send(rrc.PrintText("Sending {} PnP points for {}. Press play to move".format(total_points, group)))
    abbA.send(rrc.Stop())

    speed = speed or 500
    abbA.send(rrc.SetDigital(io_signal_air_A, 1))
    abbA.send(rrc.SetDigital(io_signal_gripper_A, 0))
    abbA.send(rrc.WaitTime(1))
    
    
    send_trajectory(abbA, speed, exit_trajectory.points, last_point_fine=False)
    send_trajectory(abbA, speed, move_to_pick_trajectory.points, last_point_fine=False)
    abbA.send(rrc.WaitTime(1))
    send_trajectory(abbA, speed/2, pick_trajectory.points)
    abbA.send(rrc.WaitTime(2))
    abbA.send(rrc.SetDigital(io_signal_gripper_A, 1))
    abbA.send(rrc.WaitTime(1))
    send_trajectory(abbA, speed, list(reversed(pick_trajectory.points)), last_point_fine=False)
    abbA.send(rrc.WaitTime(1))
    send_trajectory(abbA, speed, move_trajectory.points, last_point_fine=False)
    send_trajectory(abbA, speed, place_trajectory.points)

    future = abbA.send(rrc.PrintText("Trajectory for {} is done".format(group),feedback_level=rrc.FeedbackLevel.DONE))
    
    robot.attributes[group]["last_placed_frame"] = robot.forward_kinematics(place_config, group = group, options=dict(solver='model'))
    robot.attributes[group]["last_trajectory"] = {"exit_trajectory":exit_trajectory, 
                                                    "move_to_pick_trajectory":move_to_pick_trajectory, "pick_trajectory":pick_trajectory,
                                                    "move_trajectory":move_trajectory, "place_trajectory":place_trajectory }
    done = future.result(timeout=850.0)
    
    if both:
        abbB = abbs[groupB]
        io_signal_air_B = robot.attributes[groupB]["io_AIR"]
        io_signal_gripper_B = robot.attributes[groupB]["io_GRIPPER"]
        
        if abbB and abbB.ros.is_connected:
            
            total_points = len(exit_trajectory_2.points)+ len(move_to_pick_trajectory_2.points)+  len(pick_trajectory_2.points) * 2 + len(move_trajectory_2.points) + len(place_trajectory_2.points)
            
            abbB.send(rrc.PrintText("Sending {} PnP points for {}. Press play to move".format(total_points, groupB)))
            abbB.send(rrc.Stop())
            abbB.send(rrc.SetDigital(io_signal_air_B, 1))
            abbB.send(rrc.SetDigital(io_signal_gripper_B, 0))
            abbB.send(rrc.WaitTime(1))
            
            
            send_trajectory(abbB, speed, exit_trajectory_2.points, last_point_fine=False)
            abbB.send(rrc.WaitTime(1))
            send_trajectory(abbB, speed/2, move_to_pick_trajectory_2.points, last_point_fine=False)
            abbB.send(rrc.WaitTime(1))
            send_trajectory(abbB, speed, pick_trajectory_2.points)
            abbB.send(rrc.SetDigital(io_signal_gripper_B, 1))
            
            # Ensure abbB completes pick action before abbA releases its grip
            abbB.send_and_wait(rrc.WaitTime(1))  # Ensure time delay before the pick
            abbB.send_and_wait(rrc.SetDigital(io_signal_gripper_B, 1))  # Pick action completed
            
            # Now abbA releases the gripper only after abbB has picked the object
            abbA.send_and_wait(rrc.SetDigital(io_signal_gripper_A, 0))  # Release grip only after abbB picked up
            
            # Wait to ensure abbA's release is processed before continuing
            abbB.send_and_wait(rrc.WaitTime(2))
            
            send_trajectory(abbB, speed, list(reversed(pick_trajectory_2.points)), last_point_fine=False)
            send_trajectory(abbB, speed, move_trajectory_2.points, last_point_fine=False)
            send_trajectory(abbB, speed, place_trajectory_2.points)
        
            abbB.send(rrc.PrintText("Trajectory for {} is done".format(groupB)))
            robot.attributes[groupB]["last_placed_frame"] = robot.forward_kinematics(place_config_2, group = groupB, options=dict(solver='model'))
            robot.attributes[groupB]["last_trajectory"] = {"exit_trajectory":exit_trajectory_2, 
                                                            "move_to_pick_trajectory":move_to_pick_trajectory_2, "pick_trajectory":pick_trajectory_2,
                                                            "move_trajectory":move_trajectory_2, "place_trajectory":place_trajectory_2 }
# ---------- end send_pick_n_place ----------

ghpython_script_15 = GhPythonScript(x=robot_6)  # -> out, a
# ---------- ghpython_script_15: Python ----------
a = x.zero_configuration()
print a
# ---------- end ghpython_script_15 ----------
movetoconfig = GhPythonScript(robot=robot_6, abbs=abb, group=panel_20, speed=speed, config=ghpython_script_12, go=go)
# ---------- movetoconfig: Python ----------
import compas_rrc as rrc
from compas_fab.robots import to_degrees

M_to_MM = 1000


if group == "bothRRLL":
    group = "robRR_track"
    groupB = "robLL_track"
    both= True
elif group == "bothLLRR":
    group = "robLL_track"
    groupB = "robRR_track"
    both= True

abbA = abbs[groupB]
io_signal_air_A = robot.attributes[groupB]["io_AIR"]
io_signal_gripper_A = robot.attributes[groupB]["io_GRIPPER"]

if robot and abbA and abbA.ros.is_connected and go:
#    total_points = len(exit_trajectory.points)+ len(move_to_pick_trajectory.points)+  len(pick_trajectory.points) * 2 + len(move_trajectory.points) + len(place_trajectory.points)
    
#    abbA.send(rrc.PrintText("Sending {} PnP points for {}. Press play to move".format(total_points, group)))
    abbA.send(rrc.Stop())

    speed = speed or 500
#    abbA.send(rrc.SetDigital(io_signal_air_A, 1))
#    abbA.send(rrc.SetDigital(io_signal_gripper_A, 1))
#    abbA.send(rrc.WaitTime(1))
    print config.joint_values
    joints = to_degrees(config.joint_values[8:])
    ext_axes=[config.joint_values[7]* M_to_MM] 

    abbA.send(rrc.MoveToJoints(joints, ext_axes, speed=speed, zone=rrc.Zone.FINE))
    
#    abbA.send(rrc.SetDigital(io_signal_gripper_A, 0))
#    abbA.send(rrc.WaitTime(1))

    future = abbA.send(rrc.PrintText("Trajectory for {} is done".format(groupB),feedback_level=rrc.FeedbackLevel.DONE))
    
    
    done = future.result(timeout=250.0)
# ---------- end movetoconfig ----------
movetoconfig_2 = GhPythonScript(robot=robot_6, abbs=abb, group=panel_19, speed=speed, config=ghpython_script_15.a, go=go_2)
# ---------- movetoconfig_2: Python ----------
import compas_rrc as rrc
from compas_fab.robots import to_degrees

M_to_MM = 1000


if group == "bothRRLL":
    group = "robRR_track"
    groupB = "robLL_track"
    both= True
elif group == "bothLLRR":
    group = "robLL_track"
    groupB = "robRR_track"
    both= True

abbA = abbs[group]
io_signal_air_A = robot.attributes[group]["io_AIR"]
io_signal_gripper_A = robot.attributes[group]["io_GRIPPER"]

if robot and abbA and abbA.ros.is_connected and go:
#    total_points = len(exit_trajectory.points)+ len(move_to_pick_trajectory.points)+  len(pick_trajectory.points) * 2 + len(move_trajectory.points) + len(place_trajectory.points)
    
#    abbA.send(rrc.PrintText("Sending {} PnP points for {}. Press play to move".format(total_points, group)))
    abbA.send(rrc.Stop())

    speed = speed or 500
#    abbA.send(rrc.SetDigital(io_signal_air_A, 1))
#    abbA.send(rrc.SetDigital(io_signal_gripper_A, 1))
#    abbA.send(rrc.WaitTime(1))
    print config.joint_values
    joints = to_degrees(config.joint_values[1:7])
    ext_axes=[config.joint_values[0]* M_to_MM] 

    abbA.send(rrc.MoveToJoints(joints, ext_axes, speed=speed, zone=rrc.Zone.FINE))
    
#    abbA.send(rrc.SetDigital(io_signal_gripper_A, 0))
#    abbA.send(rrc.WaitTime(1))

    future = abbA.send(rrc.PrintText("Trajectory for {} is done".format(group),feedback_level=rrc.FeedbackLevel.DONE))
    
    
    done = future.result(timeout=250.0)
# ---------- end movetoconfig_2 ----------
send_pick_n_place_2 = GhPythonScript(
    robot=robot_6,
    abbs=abb,
    group=panel_26,
    speed=speed,
    place_config=place_config,
    exit_trajectory=exit_trajectory,
    move_to_pick_trajectory=move_to_pick_trajectory,
    pick_trajectory=pick_trajectory,
    move_trajectory=move_trajectory,
    place_trajectory=place_trajectory,
    place_config_2=place_config_2,
    exit_trajectory_2=exit_trajectory_2,
    move_to_pick_trajectory_2=move_to_pick_trajectory_2,
    pick_trajectory_2=pick_trajectory_2,
    move_trajectory_2=move_trajectory_2,
    place_trajectory_2=place_trajectory_2,
    go=go_3)  # disabled
# ---------- send_pick_n_place_2: Python ----------
import compas_rrc as rrc
from compas_fab.robots import to_degrees

M_to_MM = 1000
both = False
def send_trajectory(abb, speed, points, last_point_fine=True):
    for i in range(len(points)):
        c = points[i]
        joints = to_degrees(c.joint_values[1:])
        ext_axes=[c.joint_values[0]* M_to_MM] 
        if i < len(points) - 1:
            zone = rrc.Zone.Z10
        else:
            zone = rrc.Zone.FINE if last_point_fine else rrc.Zone.Z10

        abb.send(rrc.MoveToJoints(joints, ext_axes, speed=speed, zone=zone))

if group == "bothRRLL":
    group = "robRR_track"
    groupB = "robLL_track"
    both= True
elif group == "bothLLRR":
    group = "robLL_track"
    groupB = "robRR_track"
    both= True

abbA = abbs[group]
io_signal_air_A = robot.attributes[group]["io_AIR"]
io_signal_gripper_A = robot.attributes[group]["io_GRIPPER"]

if robot and abbA and abbA.ros.is_connected and go:
    total_points = len(exit_trajectory.points)+ len(move_to_pick_trajectory.points)+  len(pick_trajectory.points) * 2 + len(move_trajectory.points) + len(place_trajectory.points)
    
    abbA.send(rrc.PrintText("Sending {} PnP points for {}. Press play to move".format(total_points, group)))
    abbA.send(rrc.Stop())

    speed = speed or 500
    abbA.send(rrc.SetDigital(io_signal_air_A, 1))
    abbA.send(rrc.SetDigital(io_signal_gripper_A, 0))
    abbA.send(rrc.WaitTime(1))
    
    
    send_trajectory(abbA, speed, exit_trajectory.points, last_point_fine=False)
    send_trajectory(abbA, speed, move_to_pick_trajectory.points, last_point_fine=False)
    abbA.send(rrc.WaitTime(1))
    send_trajectory(abbA, speed, pick_trajectory.points)
    abbA.send(rrc.WaitTime(1))
    abbA.send(rrc.SetDigital(io_signal_gripper_A, 1))
    abbA.send(rrc.WaitTime(1))
    send_trajectory(abbA, speed, list(reversed(pick_trajectory.points)), last_point_fine=False)
    abbA.send(rrc.WaitTime(1))
    send_trajectory(abbA, speed, move_trajectory.points, last_point_fine=False)
    send_trajectory(abbA, speed, place_trajectory.points)

    future = abbA.send(rrc.PrintText("Trajectory for {} is done".format(group),feedback_level=rrc.FeedbackLevel.DONE))
    
    robot.attributes[group]["last_placed_frame"] = robot.forward_kinematics(place_config, group = group, options=dict(solver='model'))
    robot.attributes[group]["last_trajectory"] = {"exit_trajectory":exit_trajectory, 
                                                    "move_to_pick_trajectory":move_to_pick_trajectory, "pick_trajectory":pick_trajectory,
                                                    "move_trajectory":move_trajectory, "place_trajectory":place_trajectory }
    done = future.result(timeout=850.0)
    
    if both:
        abbB = abbs[groupB]
        io_signal_air_B = robot.attributes[groupB]["io_AIR"]
        io_signal_gripper_B = robot.attributes[groupB]["io_GRIPPER"]
        
        if abbB and abbB.ros.is_connected:
            
            total_points = len(exit_trajectory_2.points)+ len(move_to_pick_trajectory_2.points)+  len(pick_trajectory_2.points) * 2 + len(move_trajectory_2.points) + len(place_trajectory_2.points)
            
            abbB.send(rrc.PrintText("Sending {} PnP points for {}. Press play to move".format(total_points, groupB)))
            abbB.send(rrc.Stop())
            abbB.send(rrc.SetDigital(io_signal_air_B, 1))
            abbB.send(rrc.SetDigital(io_signal_gripper_B, 0))
            abbB.send(rrc.WaitTime(1))
            
            
            send_trajectory(abbB, speed, exit_trajectory_2.points, last_point_fine=False)
            send_trajectory(abbB, speed, move_to_pick_trajectory_2.points, last_point_fine=False)
            abbB.send(rrc.WaitTime(1))
            send_trajectory(abbB, speed, pick_trajectory_2.points)
            abbB.send(rrc.SetDigital(io_signal_gripper_B, 1))
            abbA.send(rrc.WaitTime(1))
            abbA.send(rrc.SetDigital(io_signal_gripper_A, 0))
            abbB.send(rrc.WaitTime(1))
            send_trajectory(abbB, speed, list(reversed(pick_trajectory_2.points)), last_point_fine=False)
            send_trajectory(abbB, speed, move_trajectory_2.points, last_point_fine=False)
            send_trajectory(abbB, speed, place_trajectory_2.points)
        
            abbB.send(rrc.PrintText("Trajectory for {} is done".format(groupB)))
            robot.attributes[groupB]["last_placed_frame"] = robot.forward_kinematics(place_config_2, group = groupB, options=dict(solver='model'))
            robot.attributes[groupB]["last_trajectory"] = {"exit_trajectory":exit_trajectory_2, 
                                                            "move_to_pick_trajectory":move_to_pick_trajectory_2, "pick_trajectory":pick_trajectory_2,
                                                            "move_trajectory":move_trajectory_2, "place_trajectory":place_trajectory_2 }
# ---------- end send_pick_n_place_2 ----------

value_list_4 = ValueList({"0. current config": 0, "1. Inverse Kinematic config": 1, "2. exit Safe config": 2, "3. Approach pickup config": 3, "4. Pickup config": 4, "5. Approach place config": 5, "6. Place config": 6, "7. Trajectory": 7, "8. Exit Trajectory": 8, "9. Move to Pick Trajectory": 9, "10. Pick Trajectory": 10, "11. Move Trajectory": 11, "12. PlaceTrajectory": 12, "13. Spare": 13}, selected="7. Trajectory")

value_list_5 = ValueList({"0. current config": 0, "1. Inverse Kinematic config": 1, "2. exit Safe confing": 2, "3. Approach pickup config": 3, "4. Pickup config": 4, "5. Approach place config": 5, "6. Place config": 6, "7. Trajectory": 7, "8. Exit Trajectory": 8, "9. Move to Pick Trajectory": 9, "10. Pick Trajectory": 10, "11. Move Trajectory": 11, "12. PlaceTrajectory": 12, "13. Spare": 13}, selected="7. Trajectory")

boolean_toggle_2 = BooleanToggle(True)
panel_27 = Panel(robot)

full_trajectory = GhPythonScript(
    robot=robot_6,
    group=panel_27,
    pick_trajectory=pick_trajectory,
    exit_trajectory=exit_trajectory,
    move_to_pick_trajectory=move_to_pick_trajectory,
    move_trajectory=move_trajectory,
    place_trajectory=place_trajectory)  # -> full_trajectory, port, exit_planes, pick_planes, move_to_pick_planes, move_planes, place_planes
# ---------- full_trajectory: Python ----------
from compas_fab.robots.robot import Configuration
from compas_rhino.conversions import plane_to_compas_frame, frame_to_rhino_plane
from compas_fab.robots import JointTrajectory
import math

pick_planes=[]
exit_planes=[]
move_to_pick_planes=[]
move_planes=[]
place_planes=[]

if group == "bothRRLL":
    group = "robRR_track"
elif group == "bothLLRR":
    group = "robLL_track"

if pick_trajectory:
                for c in pick_trajectory.points:
                    frame = robot.forward_kinematics(c, group, options=dict(solver='model'))
                    pick_planes.append(frame_to_rhino_plane(frame))

if exit_trajectory:
                for c in exit_trajectory.points:
                    frame = robot.forward_kinematics(c, group, options=dict(solver='model'))
                    exit_planes.append(frame_to_rhino_plane(frame))

if move_to_pick_trajectory:
                for c in move_to_pick_trajectory.points:
                    frame = robot.forward_kinematics(c, group, options=dict(solver='model'))
                    move_to_pick_planes.append(frame_to_rhino_plane(frame))

if move_trajectory:
                for c in move_trajectory.points:
                    frame = robot.forward_kinematics(c, group, options=dict(solver='model'))
                    move_planes.append(frame_to_rhino_plane(frame))

if place_trajectory:
                for c in place_trajectory.points:
                    frame = robot.forward_kinematics(c, group, options=dict(solver='model'))
                    place_planes.append(frame_to_rhino_plane(frame))

if pick_trajectory and exit_trajectory and move_to_pick_trajectory and move_trajectory and place_trajectory:
    full_trajectory_points = exit_trajectory.points + move_to_pick_trajectory.points + \
                 pick_trajectory.points + \
                 list(reversed(pick_trajectory.points)) + \
                 move_trajectory.points + \
                 place_trajectory.points
    
    full_trajectory = JointTrajectory (full_trajectory_points, exit_trajectory.joint_names  )
# ---------- end full_trajectory ----------
move_to_pick_planes = Data(full_trajectory.move_to_pick_planes)
move_planes = Data(full_trajectory.move_planes)
place_planes = Data(full_trajectory.place_planes)
pick_planes_2 = Data(full_trajectory.pick_planes)
exit_planes = Data(full_trajectory.exit_planes)

stream_filter = StreamFilter(
    Gate=value_list_4,
    Stream0=current.config,
    Stream1=compas_fab_inverse_kinematics,
    Stream2=plan_free_motion.exit_safe_config,
    Stream3=approach_pick_config,
    Stream4=pick_config,
    Stream5=approach_place_config,
    Stream6=place_config,
    Stream7=full_trajectory.full_trajectory,
    Stream8=exit_trajectory,
    Stream9=move_to_pick_trajectory,
    Stream10=pick_trajectory,
    Stream11=move_trajectory,
    Stream12=place_trajectory,
    Stream13=set_config.pick_config)

ghpython_script_16 = GhPythonScript(robot=robot_6, group=panel_27, selected=stream_filter, i=Slider(0.64, range=0..1))  # -> config
# ---------- ghpython_script_16: Python ----------
import ghpythonlib.components as ghcomp
import compas_fab
from compas_fab.robots.robot import Configuration

def remap(value, source_min, source_max, target_min, target_max):

    normalized_value = (value - source_min) / (source_max - source_min)
    
    remapped_value = target_min + normalized_value * (target_max - target_min)
    
    return remapped_value

def trajectory_points_to_configs(trajectory_points):
    configs = [] 
    for trajectory_point in trajectory_points:
        joint_values = list(trajectory_point.values())
        config = Configuration(joint_values, [2,0,0,0,0,0,0])
        configs.append(config)
    return configs

def add_other_robot (config):
    z_config = robot.zero_configuration()
    if group == "robRR_track":
        z_config.joint_values[:7] = config.joint_values
        z_config.joint_values[7:] = robot.attributes["robLL_track"]["last_config"].joint_values
    elif group == "robLL_track":
        z_config.joint_values[:7] = robot.attributes["robRR_track"]["last_config"].joint_values
        z_config.joint_values[7:] = config.joint_values
    return z_config

def remove_other_robot (config):
    z_config = robot.zero_configuration(group)
    if group == "robRR_track":
        z_config.joint_values = config.joint_values [:7]
    elif group == "robLL_track":
        z_config.joint_values = config.joint_values [7:]
    return z_config

if group == "bothRRLL":
    group = "robRR_track"
elif group == "bothLLRR":
    group = "robLL_track"

if isinstance(selected, compas_fab.robots.trajectory.JointTrajectory):
    selected = trajectory_points_to_configs (selected.points)
    index = int(remap(i, 0.001, 1.00, 0, len(selected) - 1))
    index = min(max(0, index), len(selected) - 1)
    result = selected[index]
elif isinstance(selected, Configuration):
    result = selected
else:
    result = None  



if len(result) ==14:
    result= remove_other_robot(result)
    result= add_other_robot(result)
else:
    result= add_other_robot(result)

print len(result)
config = result
print config
# ---------- end ghpython_script_16 ----------
# Visualization
compas_fab_robot_visualize = COMPASFABRobotVisualize(
    robot=robot_3,
    group=panel_27,
    configuration=ghpython_script_16,
    show_visual=Toggle(True),
    show_collision=Toggle(False),
    show_base_frame=boolean_toggle_2,
    show_cm=boolean_toggle_2,
    show_acm=Toggle(True))  # -> visual, collision, collision_meshes, attached_meshes, frames, base_frame, ee_frame; inputs show_visual: Boolean, show_collision: Boolean, show_frames: Boolean, show_base_frame: Boolean, show_end_effector_frame: Boolean, show_cm: Boolean, show_acm: Boolean
#   port group: The planning group used for end-effector and base visualization.
#   port configuration: The robot's full configuration.
#   port show_visual: Whether or not to show the robot's visual meshes.
#   port show_collision: Whether or not to show the robot's collision meshes.
#   port show_frames: Whether or not to show the robot's joint frames.
#   port show_base_frame: Whether or not to show the robot's base frame.
#   port show_end_effector_frame: Whether or not to show the robot's end-effector frame.
#   port show_cm: Whether or not to show the collision meshes (if any).
#   port show_acm: Whether or not to show the attached collision meshes (if any).
#   port visual: Rhino meshes of the robot's visual geometry (if any).
#   port collision: Rhino meshes of the robot's collision geometry (if any).
#   port collision_meshes: Rhino meshes of the scene's collision meshes (if any).
#   port attached_meshes: Rhino meshes of the scene's attached collision meshes (if any).
#   port frames: The robot's joint frames as Rhino planes (if any).
#   port base_frame: The robot's base frame as a Rhino plane (if any).
#   port ee_frame: The robot's end-effector frame as a Rhino plane (if any).
# ---------- compas_fab_robot_visualize: Python ----------
"""
Visualizes the robot.

COMPAS FAB v1.0.2
"""

import time

from compas.geometry import Frame
from compas.geometry import Transformation
from compas.scene import SceneObject
from compas_ghpython import create_id
from compas_rhino.conversions import frame_to_rhino_plane
from ghpythonlib.componentbase import executingcomponent as component
from scriptcontext import sticky as st

from compas_fab.backends import BackendFeatureNotSupportedError
from compas_fab.robots import PlanningScene


class RobotVisualize(component):
    def RunScript(
        self,
        robot,
        group,
        configuration,
        show_visual,
        show_collision,
        show_frames,
        show_base_frame,
        show_end_effector_frame,
        show_cm,
        show_acm,
    ):
        visual = None
        collision = None
        collision_meshes = None
        attached_meshes = None
        frames = None
        base_frame = None
        ee_frame = None
        
        if group == "bothRRLL":
            group = "robRR_track"
        elif group == "bothLLRR":
            group = "robLL_track"
            
        if robot:
            show_visual = True if show_visual is None else show_visual
            show_cm = True if show_cm is None else show_cm
            show_acm = True if show_acm is None else show_acm
            configuration = configuration or robot.zero_configuration()

            robot.update(configuration, visual=show_visual, collision=show_collision)
            compas_frames = robot.transformed_frames(configuration, group)

            if show_visual:
                visual = robot.scene_object.draw_visual()

            if show_collision:
                collision = robot.scene_object.draw_collision()

            if show_base_frame:
                base_compas_frame = compas_frames[0]
                base_frame = frame_to_rhino_plane(base_compas_frame)

            if show_end_effector_frame:
                options = dict(solver="model")
                if robot.attached_tool:
                    options["link"] = robot.attached_tool.connected_to

                ee_compas_frame = robot.forward_kinematics(configuration, group, options=options)
                ee_frame = frame_to_rhino_plane(ee_compas_frame)

            if show_frames:
                frames = []
                for compas_frame in compas_frames[1:]:
                    frame = frame_to_rhino_plane(compas_frame)
                    frames.append(frame)

            cached_scene_key = create_id(self, "cached_scene")

            if show_cm or show_acm:
                cached_scene = st.get(cached_scene_key)
                if not cached_scene:
                    cached_scene = {"time": 0}

                # expire cache if the component has not been executed in the last 2 seconds
                # this allows to slide through a list of configurations
                # without triggering refreshes of the scene in the middle of it
                if time.time() - cached_scene["time"] > 2:
                    update_scene = True
                else:
                    update_scene = False

                if update_scene:
                    scene = PlanningScene(robot)
                    try:
                        scene = robot.client.get_planning_scene()
                    except BackendFeatureNotSupportedError:
                        print(
                            "The selected backend does not support collision meshes. If you need collision mesh support, use a different backend."
                        )
                        scene = None
                        show_cm = False
                        show_acm = False

                if update_scene and show_cm:
                    collision_meshes = []

                    for co in scene.world.collision_objects:
                        header = co.header
                        frame_id = header.frame_id
                        cms = co.to_collision_meshes()

                        for cm in cms:
                            if cm.frame != Frame.worldXY():
                                t = Transformation.from_frame(cm.frame)
                                mesh = cm.mesh.transformed(t)
                            else:
                                mesh = cm.mesh

                            collision_meshes.extend(SceneObject(mesh).draw())

                        cached_scene["cm"] = collision_meshes

                collision_meshes = cached_scene.get("cm", [])

                if update_scene and show_acm:
                    attached_meshes = []

                    for aco in scene.robot_state.attached_collision_objects:
                        for acm in aco.to_attached_collision_meshes():
                            frame_id = aco.object["header"]["frame_id"]
                            frame = robot.forward_kinematics(configuration, options=dict(link=frame_id))
                            t = Transformation.from_frame(frame)

                            # Local CM frame
                            if acm.collision_mesh.frame and acm.collision_mesh.frame != Frame.worldXY():
                                t = t * Transformation.from_frame(acm.collision_mesh.frame)

                            mesh = acm.collision_mesh.mesh.transformed(t)

                            attached_meshes.extend(SceneObject(mesh).draw())

                    cached_scene["acm"] = attached_meshes

                attached_meshes = cached_scene.get("acm", [])

                cached_scene["time"] = time.time()
                st[cached_scene_key] = cached_scene

        return (
            visual,
            collision,
            collision_meshes,
            attached_meshes,
            frames,
            base_frame,
            ee_frame,
        )
# ---------- end compas_fab_robot_visualize ----------

orient_2 = Orient(Geometry=list_item_2.Item1, Source=list_item, Target=move_planes)  # -> Geometry, Transform
plane_30 = Plane(compas_fab_robot_visualize.base_frame)
plane_31 = Plane(compas_fab_robot_visualize.base_frame)
plane_32 = Plane(compas_fab_robot_visualize.base_frame)

boolean_toggle_3 = BooleanToggle(True)
panel_28 = Panel(robot)

full_trajectory_2 = GhPythonScript(
    robot=robot_6,
    group=panel_28,
    pick_trajectory=pick_trajectory_2,
    exit_trajectory=exit_trajectory_2,
    move_to_pick_trajectory=move_to_pick_trajectory_2,
    move_trajectory=move_trajectory_2,
    place_trajectory=place_trajectory_2)  # -> full_trajectory, port, exit_planes, pick_planes, move_to_pick_planes, move_planes, place_planes
# ---------- full_trajectory_2: Python ----------
from compas_fab.robots.robot import Configuration
from compas_rhino.conversions import plane_to_compas_frame, frame_to_rhino_plane
from compas_fab.robots import JointTrajectory
import math

pick_planes=[]
exit_planes=[]
move_to_pick_planes=[]
move_planes=[]
place_planes=[]

if group == "bothRRLL":
    group = "robLL_track"
elif group == "bothLLRR":
    group = "robRR_track"

if pick_trajectory:
                for c in pick_trajectory.points:
                    frame = robot.forward_kinematics(c, group, options=dict(solver='model'))
                    pick_planes.append(frame_to_rhino_plane(frame))

if exit_trajectory:
                for c in exit_trajectory.points:
                    frame = robot.forward_kinematics(c, group, options=dict(solver='model'))
                    exit_planes.append(frame_to_rhino_plane(frame))

if move_to_pick_trajectory:
                for c in move_to_pick_trajectory.points:
                    frame = robot.forward_kinematics(c, group, options=dict(solver='model'))
                    move_to_pick_planes.append(frame_to_rhino_plane(frame))

if move_trajectory:
                for c in move_trajectory.points:
                    frame = robot.forward_kinematics(c, group, options=dict(solver='model'))
                    move_planes.append(frame_to_rhino_plane(frame))

if place_trajectory:
                for c in place_trajectory.points:
                    frame = robot.forward_kinematics(c, group, options=dict(solver='model'))
                    place_planes.append(frame_to_rhino_plane(frame))

if pick_trajectory and exit_trajectory and move_to_pick_trajectory and move_trajectory and place_trajectory:
    full_trajectory_points = exit_trajectory.points + move_to_pick_trajectory.points + \
                 pick_trajectory.points + \
                 list(reversed(pick_trajectory.points)) + \
                 move_trajectory.points + \
                 place_trajectory.points
    
    full_trajectory = JointTrajectory (full_trajectory_points, exit_trajectory.joint_names  )
# ---------- end full_trajectory_2 ----------
move_to_pick_planes_2 = Data(full_trajectory_2.move_to_pick_planes)
move_planes_2 = Data(full_trajectory_2.move_planes)
place_planes_2 = Data(full_trajectory_2.place_planes)
pick_planes_3 = Data(full_trajectory_2.pick_planes)
exit_planes_2 = Data(full_trajectory_2.exit_planes)

stream_filter_2 = StreamFilter(
    Gate=value_list_5,
    Stream0=compas_fab_inverse_kinematics,
    Stream1=compas_fab_inverse_kinematics,
    Stream2=plan_free_motion.exit_safe_config,
    Stream3=approach_pick_config_2,
    Stream4=pick_config_2,
    Stream5=approach_place_config_2,
    Stream6=place_config,
    Stream7=full_trajectory_2.full_trajectory,
    Stream8=exit_trajectory_2,
    Stream9=move_to_pick_trajectory,
    Stream10=pick_trajectory_2,
    Stream11=move_trajectory,
    Stream12=place_trajectory,
    Stream13=approach_pick_config_2)

ghpython_script_17 = GhPythonScript(
    robot=robot_6,
    group=panel_28,
    other_placed_config=plan_free_motion.place_config,
    selected=stream_filter_2,
    i=Slider(0, range=0..1))  # -> config
# ---------- ghpython_script_17: Python ----------
import ghpythonlib.components as ghcomp
import compas_fab
from compas_fab.robots.robot import Configuration

def remap(value, source_min, source_max, target_min, target_max):

    normalized_value = (value - source_min) / (source_max - source_min)
    
    remapped_value = target_min + normalized_value * (target_max - target_min)
    
    return remapped_value

def trajectory_points_to_configs(trajectory_points):
    configs = [] 
    for trajectory_point in trajectory_points:
        joint_values = list(trajectory_point.values())
        config = Configuration(joint_values, [2,0,0,0,0,0,0])
        configs.append(config)
    return configs

def add_other_robot (config):
    z_config = robot.zero_configuration()
    if group == "robRR_track":
        z_config.joint_values[:7] = config.joint_values
        z_config.joint_values[7:] = other_placed_config.joint_values
    elif group == "robLL_track":
        z_config.joint_values[:7] = other_placed_config.joint_values
        z_config.joint_values[7:] = config.joint_values
    return z_config

def remove_other_robot (config):
    z_config = robot.zero_configuration(group)
    if group == "robRR_track":
        z_config.joint_values = config.joint_values [:7]
    elif group == "robLL_track":
        z_config.joint_values = config.joint_values [7:]
    return z_config

if group == "bothRRLL":
    group = "robLL_track"
elif group == "bothLLRR":
    group = "robRR_track"

if isinstance(selected, compas_fab.robots.trajectory.JointTrajectory):
    selected = trajectory_points_to_configs (selected.points)
    index = int(remap(i, 0.001, 1.00, 0, len(selected) - 1))
    index = min(max(0, index), len(selected) - 1)
    result = selected[index]
elif isinstance(selected, Configuration):
    result = selected
else:
    result = None  



if len(result) ==14:
    result= remove_other_robot(result)
    result= add_other_robot(result)
else:
    result= add_other_robot(result)

print len(result)
config = result
print config
# ---------- end ghpython_script_17 ----------
# Visualization
compas_fab_robot_visualize_2 = COMPASFABRobotVisualize(
    robot=robot_6,
    group=panel_28,
    configuration=ghpython_script_17,
    show_frames=boolean_toggle_3,
    show_end_effector_frame=boolean_toggle_3,
    show_cm=Toggle(True),
    show_acm=boolean_toggle_3)  # -> visual, collision, collision_meshes, attached_meshes, frames, base_frame, ee_frame; inputs show_visual: Boolean, show_collision: Boolean, show_frames: Boolean, show_base_frame: Boolean, show_end_effector_frame: Boolean, show_cm: Boolean, show_acm: Boolean
#   port group: The planning group used for end-effector and base visualization.
#   port configuration: The robot's full configuration.
#   port show_visual: Whether or not to show the robot's visual meshes.
#   port show_collision: Whether or not to show the robot's collision meshes.
#   port show_frames: Whether or not to show the robot's joint frames.
#   port show_base_frame: Whether or not to show the robot's base frame.
#   port show_end_effector_frame: Whether or not to show the robot's end-effector frame.
#   port show_cm: Whether or not to show the collision meshes (if any).
#   port show_acm: Whether or not to show the attached collision meshes (if any).
#   port visual: Rhino meshes of the robot's visual geometry (if any).
#   port collision: Rhino meshes of the robot's collision geometry (if any).
#   port collision_meshes: Rhino meshes of the scene's collision meshes (if any).
#   port attached_meshes: Rhino meshes of the scene's attached collision meshes (if any).
#   port frames: The robot's joint frames as Rhino planes (if any).
#   port base_frame: The robot's base frame as a Rhino plane (if any).
#   port ee_frame: The robot's end-effector frame as a Rhino plane (if any).
# ---------- compas_fab_robot_visualize_2: Python ----------
"""
Visualizes the robot.

COMPAS FAB v1.0.2
"""

import time

from compas.geometry import Frame
from compas.geometry import Transformation
from compas.scene import SceneObject
from compas_ghpython import create_id
from compas_rhino.conversions import frame_to_rhino_plane
from ghpythonlib.componentbase import executingcomponent as component
from scriptcontext import sticky as st

from compas_fab.backends import BackendFeatureNotSupportedError
from compas_fab.robots import PlanningScene


class RobotVisualize(component):
    def RunScript(
        self,
        robot,
        group,
        configuration,
        show_visual,
        show_collision,
        show_frames,
        show_base_frame,
        show_end_effector_frame,
        show_cm,
        show_acm,
    ):
        visual = None
        collision = None
        collision_meshes = None
        attached_meshes = None
        frames = None
        base_frame = None
        ee_frame = None
        
        if group == "bothRRLL":
            group = "robLL_track"
        elif group == "bothLLRR":
            print "hey"
            print configuration
            group = "robRR_track"
            
        if robot:
            show_visual = True if show_visual is None else show_visual
            show_cm = True if show_cm is None else show_cm
            show_acm = True if show_acm is None else show_acm
            configuration = configuration or robot.zero_configuration()

            robot.update(configuration, visual=show_visual, collision=show_collision)
            compas_frames = robot.transformed_frames(configuration, group)

            if show_visual:
                visual = robot.scene_object.draw_visual()

            if show_collision:
                collision = robot.scene_object.draw_collision()

            if show_base_frame:
                base_compas_frame = compas_frames[0]
                base_frame = frame_to_rhino_plane(base_compas_frame)

            if show_end_effector_frame:
                options = dict(solver="model")
                if robot.attached_tool:
                    options["link"] = robot.attached_tool.connected_to

                ee_compas_frame = robot.forward_kinematics(configuration, group, options=options)
                ee_frame = frame_to_rhino_plane(ee_compas_frame)

            if show_frames:
                frames = []
                for compas_frame in compas_frames[1:]:
                    frame = frame_to_rhino_plane(compas_frame)
                    frames.append(frame)

            cached_scene_key = create_id(self, "cached_scene")

            if show_cm or show_acm:
                cached_scene = st.get(cached_scene_key)
                if not cached_scene:
                    cached_scene = {"time": 0}

                # expire cache if the component has not been executed in the last 2 seconds
                # this allows to slide through a list of configurations
                # without triggering refreshes of the scene in the middle of it
                if time.time() - cached_scene["time"] > 2:
                    update_scene = True
                else:
                    update_scene = False

                if update_scene:
                    scene = PlanningScene(robot)
                    try:
                        scene = robot.client.get_planning_scene()
                    except BackendFeatureNotSupportedError:
                        print(
                            "The selected backend does not support collision meshes. If you need collision mesh support, use a different backend."
                        )
                        scene = None
                        show_cm = False
                        show_acm = False

                if update_scene and show_cm:
                    collision_meshes = []

                    for co in scene.world.collision_objects:
                        header = co.header
                        frame_id = header.frame_id
                        cms = co.to_collision_meshes()

                        for cm in cms:
                            if cm.frame != Frame.worldXY():
                                t = Transformation.from_frame(cm.frame)
                                mesh = cm.mesh.transformed(t)
                            else:
                                mesh = cm.mesh

                            collision_meshes.extend(SceneObject(mesh).draw())

                        cached_scene["cm"] = collision_meshes

                collision_meshes = cached_scene.get("cm", [])

                if update_scene and show_acm:
                    attached_meshes = []

                    for aco in scene.robot_state.attached_collision_objects:
                        for acm in aco.to_attached_collision_meshes():
                            frame_id = aco.object["header"]["frame_id"]
                            frame = robot.forward_kinematics(configuration, options=dict(link=frame_id))
                            t = Transformation.from_frame(frame)

                            # Local CM frame
                            if acm.collision_mesh.frame and acm.collision_mesh.frame != Frame.worldXY():
                                t = t * Transformation.from_frame(acm.collision_mesh.frame)

                            mesh = acm.collision_mesh.mesh.transformed(t)

                            attached_meshes.extend(SceneObject(mesh).draw())

                    cached_scene["acm"] = attached_meshes

                attached_meshes = cached_scene.get("acm", [])

                cached_scene["time"] = time.time()
                st[cached_scene_key] = cached_scene

        return (
            visual,
            collision,
            collision_meshes,
            attached_meshes,
            frames,
            base_frame,
            ee_frame,
        )
# ---------- end compas_fab_robot_visualize_2 ----------

plane_33 = Plane(compas_fab_robot_visualize_2.ee_frame)
plane_34 = Plane(compas_fab_robot_visualize_2.frames)
list_item_3 = ListItem(List=plane_34, Index=0, Wrap=True)  # -> Item1, Item, Item1_2, Item2, Item3, Item4, Item5, Item6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
plane_35 = Plane(list_item_3.Item11)

# ==== cluster Dict
list = ClusterInput()
sif_pattern = Panel("""0
1
2
3""")
sift_pattern = SiftPattern(List=list, SiftPattern=sif_pattern)  # -> Output0, Output1, Output2, Output3
create_dict = GhPythonScript(
    names=sift_pattern.Output0,
    visual_meshes=sift_pattern.Output1,
    collision_meshes=sift_pattern.Output2,
    tcf_planes=sift_pattern.Output3)  # -> toolLibrary; inputs names: list, visual_meshes: list of Mesh, collision_meshes: list of Mesh, tcf_planes: list of Plane
# ---------- create_dict: Python ----------
import Rhino.Geometry as rg

nms=[]
for nm in names:
    if nm !=None:
        nms.append(nm)
names = nms

v_meshes=[]
for vm in visual_meshes:
    if vm !=None:
        v_meshes.append(vm)
visual_meshes = v_meshes

c_meshes=[]
for cm in collision_meshes:
    if cm !=None:
        c_meshes.append(cm)
collision_meshes = c_meshes

planes=[]
for tcf in tcf_planes:
    if tcf !=None:
        planes.append(tcf)
tcf_planes = planes

toolLibrary ={}

for i, name in enumerate (names):
    key = str(i)
    toolLibrary[key] = {}
    toolLibrary[key]["name"] = names[i]
    toolLibrary[key]["visual_mesh"] = visual_meshes[i]
    toolLibrary[key]["collision_mesh"] = collision_meshes[i]
    toolLibrary[key]["tcf_plane"] = tcf_planes[i]

toolLibrary =[toolLibrary]
# ---------- end create_dict ----------
toollibrary = ClusterOutput(create_dict)

# ==== cluster Move
plane = ClusterInput()
plane_2 = Plane(plane)
deconstruct_plane = DeconstructPlane(Plane=plane_2)  # -> Origin, XAxis, YAxis, ZAxis
amplitude = ClusterInput()
amplitude_2 = Amplitude(Vector=deconstruct_plane.ZAxis, Amplitude=amplitude)
move = Move(Geometry=plane_2, Motion=amplitude_2)  # -> Geometry, Transform
flip_plane = FlipPlane(Plane=move.Geometry, ReverseX=False, ReverseY=False, SwapAxes=True)
plane_3 = ClusterOutput(flip_plane)
