# Grasshopper definition 00_ros_load_of_pybullet_configs.ghx (Grasshopper 1.0.7)

# ----
# 1. Load Robot From ROS
ros_connect = BooleanToggle(True)
robot_load = BooleanToggle(True)
compas_fab_ros_connect = COMPASFABROSConnect(connect=ros_connect)  # -> ros_client, is_connected; inputs port: Int32, connect: Boolean
#   port ip: The ip address ROS. Defaults to 127.0.0.1.
#   port port: The port of ROS. Defaults to 9090.
#   port connect: If True, connects to ROS. If False, disconnects from ROS. Defaults to False.
#   port ros_client: The ROS client.
#   port is_connected: True if connection established.
# ---------- compas_fab_ros_connect: Python ----------
"""
Connect or disconnect to ROS.

COMPAS FAB v1.0.2
"""

from ghpythonlib.componentbase import executingcomponent as component
from scriptcontext import sticky as st

from compas_fab.backends import RosClient
from compas_fab.ghpython.components import create_id


class ROSConnect(component):
    def RunScript(self, ip, port, connect):
        ros_client = None

        ip = ip or "127.0.0.1"
        port = port or 9090

        key = create_id(self, "ros_client")
        ros_client = st.get(key, None)

        if ros_client:
            st[key].close()
        if connect:
            st[key] = RosClient(ip, port)
            st[key].run(5)

        ros_client = st.get(key, None)
        is_connected = ros_client.is_connected if ros_client else False
        return (ros_client, is_connected)
# ---------- end compas_fab_ros_connect ----------
compas_fab_ros_robot = COMPASFABROSRobot(ros_client=compas_fab_ros_connect.ros_client, load=robot_load)  # -> robot; inputs load: Boolean
#   port ros_client: The ROS client.
#   port load: If True, loads the robot from ROS. Defaults to False.
# ---------- compas_fab_ros_robot: Python ----------
"""
Load robot directly from ROS.

COMPAS FAB v1.0.2
"""

from compas.scene import SceneObject
from ghpythonlib.componentbase import executingcomponent as component
from scriptcontext import sticky as st

from compas_fab.ghpython.components import create_id


class ROSRobot(component):
    def RunScript(self, ros_client, load):
        key = create_id(self, "robot")

        if ros_client and ros_client.is_connected and load:
            # Load URDF from ROS
            st[key] = ros_client.load_robot(load_geometry=True, precision=12)
            st[key].scene_object = SceneObject(st[key].model)

        robot = st.get(key, None)
        if robot:  # client sometimes need to be restarted, without needing to reload geometry
            robot.client = ros_client
        return robot
# ---------- end compas_fab_ros_robot ----------
robot = Data(compas_fab_ros_robot)

# ----
# 2. Get Robot Zero Configuration
robot_2 = Data(compas_fab_ros_robot)
compas_fab_zero_config = COMPASFABZeroConfig(robot=robot_2)  # -> config
#   port group: If assigned, it will return the zero configuration for the given group, otherwise a full zero configuration.
#   port config: The zero configuration.
# ---------- compas_fab_zero_config: Python ----------
"""
Get a zero configuration for a robot.

COMPAS FAB v1.0.2
"""

from ghpythonlib.componentbase import executingcomponent as component


class ConfigZero(component):
    def RunScript(self, robot, group):
        if robot:
            return robot.zero_configuration(group)

        return None
# ---------- end compas_fab_zero_config ----------
zero_config = Data(compas_fab_zero_config)

base = Slider(216, range=-360..360)
shoulder = Slider(302, range=-360..360)
elbow = Slider(-81, range=-180..180)
wrist1 = Slider(319, range=-360..360)
wrist2 = Slider(75, range=-360..360)
# Input Frame
wrist3 = Slider(-305, range=-360..360)
# 3. Define Custom Configuration
robot_3 = Data(compas_fab_ros_robot)
ghpython_script = GhPythonScript(robot=robot_3, base=base, shoulder=shoulder, elbow=elbow, wrist_1=wrist1, wrist_2=wrist2, wrist_3=wrist3)  # -> out, config; inputs base: Int32, shoulder: Int32, elbow: Int32, wrist_1: Int32, wrist_2: Int32, wrist_3: Int32
# ---------- ghpython_script: Python ----------
from compas_robots import Configuration
import math

base_rad = math.radians(base)
shoulder_rad = math.radians(shoulder)
elbow_rad = math.radians(elbow)
wrist_1_rad = math.radians(wrist_1)
wrist_2_rad = math.radians(wrist_2)
wrist_3_rad = math.radians(wrist_3)

joint_values = [base_rad, shoulder_rad, elbow_rad, wrist_1_rad, wrist_2_rad, wrist_3_rad]
joint_names = ['shoulder_pan_joint', 'shoulder_lift_joint', 'elbow_joint', 'wrist_1_joint', 'wrist_2_joint', 'wrist_3_joint']
joint_types = [0, 0, 0, 0, 0, 0]

config = Configuration(joint_values, joint_types, joint_names)
# ---------- end ghpython_script ----------
custom_config = Data(ghpython_script.config)

plane = Plane(Plane(origin=(1.256289165, 0.1494696637, 0), x=(0, -1, 0), y=(1, 0, 0)))
deconstruct_plane = DeconstructPlane(Plane=plane)  # -> Origin, XAxis, YAxis, ZAxis
negative = Negative(Value=Slider(0.33, range=0..1))
amplitude = Amplitude(Vector=deconstruct_plane.YAxis, Amplitude=negative)
move = Move(Geometry=plane, Motion=amplitude)  # -> Geometry, Transform
ghpython_script_2 = GhPythonScript(x=move.Geometry)  # -> out, a; inputs x: Plane
# ---------- ghpython_script_2: Python ----------
from compas_rhino.conversions import plane_to_compas_frame
from compas.geometry import Quaternion

frame = plane_to_compas_frame(x)
print frame.__data__

quaternion = Quaternion.from_frame(frame)
print(quaternion.__data__)
# ---------- end ghpython_script_2 ----------

# ----
# Input Frames List
ghpython_script_3 = GhPythonScript()  # -> out, frames
# ---------- ghpython_script_3: Python ----------
from compas.data import json_load

fp = r"C:\Users\jk6372\Desktop\00_princeton_projects\00_robotic_territories\00_git\compas_xr_robotic_territories\dev\python\frames_same.json"
frames = json_load(fp)
# ---------- end ghpython_script_3 ----------
draw = Draw(cg=ghpython_script_3.frames)  # -> rg
#   port cg: The COMPAS geometry or datastructure to be drawn.
# ---------- draw: Python ----------
from compas_rhino.conversions import frame_to_rhino_plane

rg = frame_to_rhino_plane(cg)
# ---------- end draw ----------
list_item = ListItem(List=draw, Index=0, Wrap=True)

# ----
# Output Forward Kinematics
ghpython_script_4 = GhPythonScript()  # -> out, frames
# ---------- ghpython_script_4: Python ----------
from compas.data import json_load

#fp = r"C:\Users\jk6372\Desktop\00_princeton_projects\00_robotic_territories\00_git\compas_xr_robotic_territories\dev\python\random_config_frames.json"
fp = r"C:\Users\jk6372\Desktop\00_princeton_projects\00_robotic_territories\00_git\compas_xr_robotic_territories\dev\python\frames.json"

frames = json_load(fp)
# ---------- end ghpython_script_4 ----------
draw_2 = Draw(cg=ghpython_script_4.frames)  # -> rg; same code as draw
list_item_2 = ListItem(List=draw_2, Index=0, Wrap=True)

# ----
# Output IK Solutions
number_slider = Slider(2, range=0..10)
ghpython_script_5 = GhPythonScript()  # -> out, configs
# ---------- ghpython_script_5: Python ----------
from compas.data import json_load
from compas_robots import Configuration

fp = r"C:\Users\jk6372\Desktop\00_princeton_projects\00_robotic_territories\00_git\compas_xr_robotic_territories\dev\python\configuration_data_testing.json"
#fp = r"C:\Users\jk6372\Desktop\00_princeton_projects\00_robotic_territories\00_git\compas_xr_robotic_territories\dev\python\frames.json"
frames = json_load(fp)
configs = []
for item in frames:
    print type(item)
    cfg = Configuration.__from_data__(item)
    configs.append(cfg)
# ---------- end ghpython_script_5 ----------
list_item_3 = ListItem(List=ghpython_script_5.configs, Index=number_slider, Wrap=True)

ghpython_script_6 = GhPythonScript()  # -> Out, A
ghpython_script_7 = GhPythonScript()  # -> out, a
# ---------- ghpython_script_7: Python ----------
a = [[0.5, -0.5, 0.25], [0.5, -0.5, 0.4], [0.5, -0.5, 0.55], [0.5, -0.5, 0.7], [0.5, -0.5, 0.85], [0.5, -0.5, 1.0], [0.5, -0.33333333333333337, 0.25], [0.5, -0.33333333333333337, 0.4], [0.5, -0.33333333333333337, 0.55], [0.5, -0.33333333333333337, 0.7], [0.5, -0.33333333333333337, 0.85], [0.5, -0.33333333333333337, 1.0], [0.5, -0.16666666666666669, 0.25], [0.5, -0.16666666666666669, 0.4], [0.5, -0.16666666666666669, 0.55], [0.5, -0.16666666666666669, 0.7], [0.5, -0.16666666666666669, 0.85], [0.5, -0.16666666666666669, 1.0], [0.5, 0.0, 0.25], [0.5, 0.0, 0.4], [0.5, 0.0, 0.55], [0.5, 0.0, 0.7], [0.5, 0.0, 0.85], [0.5, 0.0, 1.0], [0.5, 0.16666666666666663, 0.25], [0.5, 0.16666666666666663, 0.4], [0.5, 0.16666666666666663, 0.55], [0.5, 0.16666666666666663, 0.7], [0.5, 0.16666666666666663, 0.85], [0.5, 0.16666666666666663, 1.0], [0.5, 0.33333333333333326, 0.25], [0.5, 0.33333333333333326, 0.4], [0.5, 0.33333333333333326, 0.55], [0.5, 0.33333333333333326, 0.7], [0.5, 0.33333333333333326, 0.85], [0.5, 0.33333333333333326, 1.0], [0.5, 0.5, 0.25], [0.5, 0.5, 0.4], [0.5, 0.5, 0.55], [0.5, 0.5, 0.7], [0.5, 0.5, 0.85], [0.5, 0.5, 1.0]]
# ---------- end ghpython_script_7 ----------
plane_2 = Plane([Plane(origin=(0.5, -0.5, 0.25), x=(-1, 0, 0), y=(0, -1, 0)), Plane(origin=(0.5, -0.1666666667, 0.55), x=(-1, 0, 0), y=(0, -1, 0)), Plane(origin=(0.5, 0.1666666667, 0.85), x=(-1, 0, 0), y=(0, -1, 0)), Plane(origin=(0.5, 0.5, 0.7), x=(-1, 0, 0), y=(0, -1, 0))])
ghpython_script_8 = GhPythonScript()  # -> out, a
# ---------- ghpython_script_8: Python ----------
from compas.geometry import Quaternion,Frame, Point

quat = Quaternion(0,0,0,1)

a = Frame.from_quaternion(quat)
point = Point(0.5, -0.5, 0.4)
a.point = point
# ---------- end ghpython_script_8 ----------
ghpython_script_9 = GhPythonScript(x=ghpython_script_7.a)  # -> out, frames; inputs x: list
# ---------- ghpython_script_9: Python ----------
from compas.geometry import Point,Frame,Quaternion

frames = []

for list in x:
    point = Point(list[0], list[1], list[2])
    quat = Quaternion(0,0,0,1)
    frame = Frame.from_quaternion(quat)
    frame.point = point
    print('POINT', frame.point.__data__)
    frames.append(frame)
# ---------- end ghpython_script_9 ----------
ghpython_script_10 = GhPythonScript(x=plane_2)  # -> out, a; inputs x: list
# ---------- ghpython_script_10: Python ----------
from compas_rhino.conversions import plane_to_compas_frame
from compas.data import json_dump

frames = []

for plane in x:
    frame = plane_to_compas_frame(plane)
    frames.append(frame)

fp = r"C:\Users\jk6372\Desktop\00_princeton_projects\00_robotic_territories\00_git\ur20\frames_testing.json"
json_dump(frames, fp, True)
# ---------- end ghpython_script_10 ----------
draw_3 = Draw(cg=ghpython_script_8.a)  # -> rg; same code as draw
draw_4 = Draw(cg=ghpython_script_9.frames)  # -> rg; same code as draw

robot_4 = Data(robot)

zero_config_2 = Data(zero_config)
custom_config_2 = Data(custom_config)
value_list = ValueList({"0. zero config": 0, "1. custom config": 1}, selected="1. custom config")
stream_filter = StreamFilter(Gate=value_list, Stream0=zero_config_2, Stream1=custom_config_2)

# ----
# 4. Robot Visualization
compas_fab_robot_visualize = COMPASFABRobotVisualize(robot=robot_4, configuration=stream_filter, show_frames=Toggle(True), show_base_frame=True)  # -> visual, collision, collision_meshes, attached_meshes, frames, base_frame, ee_frame; inputs show_visual: Boolean, show_collision: Boolean, show_frames: Boolean, show_base_frame: Boolean, show_end_effector_frame: Boolean, show_cm: Boolean, show_acm: Boolean
#   port group: The planning group used for end-effector and base visualization.
#   port configuration: The robot's full configuration.
#   port show_visual: Whether or not to show the robot's visual meshes.
#   port show_collision: Whether or not to show the robot's collision meshes.
#   port show_frames: Whether or not to show the robot's joint frames.
#   port show_base_frame: Whether or not to show the robot's base frame.
#   port show_end_effector_frame: Whether or not to show the robot's end-effector frame.
#   port show_cm: Whether or not to show the collision meshes (if any).
#   port show_acm: Whether or not to show the attached collision meshes (if any).
#   port visual: Rhino meshes of the robot's visual geometry (if any).
#   port collision: Rhino meshes of the robot's collision geometry (if any).
#   port collision_meshes: Rhino meshes of the scene's collision meshes (if any).
#   port attached_meshes: Rhino meshes of the scene's attached collision meshes (if any).
#   port frames: The robot's joint frames as Rhino planes (if any).
#   port base_frame: The robot's base frame as a Rhino plane (if any).
#   port ee_frame: The robot's end-effector frame as a Rhino plane (if any).
# ---------- compas_fab_robot_visualize: Python ----------
"""
Visualizes the robot.

COMPAS FAB v1.0.2
"""

import time

from compas.geometry import Frame
from compas.geometry import Transformation
from compas.scene import SceneObject
from compas_ghpython import create_id
from compas_rhino.conversions import frame_to_rhino_plane
from ghpythonlib.componentbase import executingcomponent as component
from scriptcontext import sticky as st

from compas_fab.backends import BackendFeatureNotSupportedError
from compas_fab.robots import PlanningScene


class RobotVisualize(component):
    def RunScript(
        self,
        robot,
        group,
        configuration,
        show_visual,
        show_collision,
        show_frames,
        show_base_frame,
        show_end_effector_frame,
        show_cm,
        show_acm,
    ):
        visual = None
        collision = None
        collision_meshes = None
        attached_meshes = None
        frames = None
        base_frame = None
        ee_frame = None

        if robot:
            show_visual = True if show_visual is None else show_visual
            show_cm = True if show_cm is None else show_cm
            show_acm = True if show_acm is None else show_acm
            configuration = configuration or robot.zero_configuration()

            robot.update(configuration, visual=show_visual, collision=show_collision)
            compas_frames = robot.transformed_frames(configuration, group)

            if show_visual:
                visual = robot.scene_object.draw_visual()

            if show_collision:
                collision = robot.scene_object.draw_collision()

            if show_base_frame:
                base_compas_frame = compas_frames[0]
                base_frame = frame_to_rhino_plane(base_compas_frame)

            if show_end_effector_frame:
                options = dict(solver="model")
                if robot.attached_tool:
                    options["link"] = robot.attached_tool.connected_to

                ee_compas_frame = robot.forward_kinematics(configuration, group, options=options)
                ee_frame = frame_to_rhino_plane(ee_compas_frame)

            if show_frames:
                frames = []
                for compas_frame in compas_frames[1:]:
                    frame = frame_to_rhino_plane(compas_frame)
                    frames.append(frame)

            cached_scene_key = create_id(self, "cached_scene")

            if show_cm or show_acm:
                cached_scene = st.get(cached_scene_key)
                if not cached_scene:
                    cached_scene = {"time": 0}

                # expire cache if the component has not been executed in the last 2 seconds
                # this allows to slide through a list of configurations
                # without triggering refreshes of the scene in the middle of it
                if time.time() - cached_scene["time"] > 2:
                    update_scene = True
                else:
                    update_scene = False

                if update_scene:
                    scene = PlanningScene(robot)
                    try:
                        scene = robot.client.get_planning_scene()
                    except BackendFeatureNotSupportedError:
                        print(
                            "The selected backend does not support collision meshes. If you need collision mesh support, use a different backend."
                        )
                        scene = None
                        show_cm = False
                        show_acm = False

                if update_scene and show_cm:
                    collision_meshes = []

                    for co in scene.world.collision_objects:
                        header = co.header
                        frame_id = header.frame_id
                        cms = co.to_collision_meshes()

                        for cm in cms:
                            if cm.frame != Frame.worldXY():
                                t = Transformation.from_frame(cm.frame)
                                mesh = cm.mesh.transformed(t)
                            else:
                                mesh = cm.mesh

                            collision_meshes.extend(SceneObject(mesh).draw())

                        cached_scene["cm"] = collision_meshes

                collision_meshes = cached_scene.get("cm", [])

                if update_scene and show_acm:
                    attached_meshes = []

                    for aco in scene.robot_state.attached_collision_objects:
                        for acm in aco.to_attached_collision_meshes():
                            frame_id = aco.object["header"]["frame_id"]
                            frame = robot.forward_kinematics(configuration, options=dict(link=frame_id))
                            t = Transformation.from_frame(frame)

                            # Local CM frame
                            if acm.collision_mesh.frame and acm.collision_mesh.frame != Frame.worldXY():
                                t = t * Transformation.from_frame(acm.collision_mesh.frame)

                            mesh = acm.collision_mesh.mesh.transformed(t)

                            attached_meshes.extend(SceneObject(mesh).draw())

                    cached_scene["acm"] = attached_meshes

                attached_meshes = cached_scene.get("acm", [])

                cached_scene["time"] = time.time()
                st[cached_scene_key] = cached_scene

        return (
            visual,
            collision,
            collision_meshes,
            attached_meshes,
            frames,
            base_frame,
            ee_frame,
        )
# ---------- end compas_fab_robot_visualize ----------
mesh = Mesh(compas_fab_robot_visualize.visual)
