# Grasshopper definition 20250914_random_collision_mesh_testign.ghx (Grasshopper 1.0.7)

mesh = Mesh(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)
mesh_2 = Mesh(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)
ghpython_script = GhPythonScript(x=mesh_2)  # -> out, a, b; inputs x: Mesh, y: Mesh
# ---------- ghpython_script: Python ----------
from compas.data import json_load, json_dump
from compas_rhino.conversions import mesh_to_rhino, mesh_to_compas

fp = r"C:\Users\jk6372\Desktop\00_princeton_projects\00_robotic_territories\00_git\compas_xr_robotic_territories\dev\performance_operations\robots\setup_objects\endeffectors\ur20\piab_gripper.json"
fp2 = r"C:\Users\jk6372\Desktop\00_princeton_projects\00_robotic_territories\00_git\compas_xr_robotic_territories\dev\performance_operations\robots\setup_objects\endeffectors\ur20\piab_gripper_collision_update.json"
data =json_load(fp)
print data.keys()

a = mesh_to_rhino(data["collision_mesh"])
b = mesh_to_rhino(data["visual_mesh"])

new_data = {}
new_data["visual_mesh"] = data["visual_mesh"]
new_data["tcf"] = data["tcf"]
new_data["collision_mesh"] = mesh_to_compas(x)
json_dump(fp=fp2, data=new_data, pretty=True)
# ---------- end ghpython_script ----------
mesh_3 = Mesh(<mesh referenced from the Rhino model>)
ghpython_script_2 = GhPythonScript(x=mesh_3, y=mesh)  # -> out, a; inputs x: Mesh, y: Mesh
# ---------- ghpython_script_2: Python ----------
from compas.data import json_load, json_dump
from compas_rhino.conversions import mesh_to_rhino, mesh_to_compas


fp = r"C:\Users\jk6372\Desktop\00_princeton_projects\00_robotic_territories\00_git\compas_xr_robotic_territories\dev\performance_operations\robots\setup_objects\table\table_test.json"
#fp2 = r"C:\Users\jk6372\Desktop\00_princeton_projects\00_robotic_territories\00_git\compas_xr_robotic_territories\dev\performance_operations\robots\setup_objects\table\table_simple_list.json"
fp3 = r"C:\Users\jk6372\Desktop\00_princeton_projects\00_robotic_territories\00_git\compas_xr_robotic_territories\dev\performance_operations\robots\setup_objects\table\table_and_floor.json"

table = json_load(fp)
a = mesh_to_rhino(table)

c_mesh = mesh_to_compas(x)
data = {}
data["name"] = "table"
data["mesh"] = c_mesh
data_2 = {}
print type(y)
c_mesh_2 = mesh_to_compas(y)
data_2["name"] = "floor"
data_2["mesh"] = c_mesh_2

print data

mesh_list = [data, data_2]
print mesh_list

#json_dump(fp=fp2, data=mesh_list, pretty=True)
json_dump(fp=fp3, data=mesh_list, pretty=True)
# ---------- end ghpython_script_2 ----------
mesh_4 = Mesh(ghpython_script.a)
mesh_5 = Mesh(ghpython_script_2.a)
