# Grasshopper definition 00_planning_routine_testing.ghx (Grasshopper 1.0.7)

# ----
# 1. Load Robot From ROS
ros_connect = BooleanToggle(True)
robot_load = BooleanToggle(True)
compas_fab_ros_connect = COMPASFABROSConnect(connect=ros_connect)  # -> ros_client, is_connected; inputs port: Int32, connect: Boolean
#   port ip: The ip address ROS. Defaults to 127.0.0.1.
#   port port: The port of ROS. Defaults to 9090.
#   port connect: If True, connects to ROS. If False, disconnects from ROS. Defaults to False.
#   port ros_client: The ROS client.
#   port is_connected: True if connection established.
# ---------- compas_fab_ros_connect: Python ----------
"""
Connect or disconnect to ROS.

COMPAS FAB v1.0.2
"""

from ghpythonlib.componentbase import executingcomponent as component
from scriptcontext import sticky as st

from compas_fab.backends import RosClient
from compas_fab.ghpython.components import create_id


class ROSConnect(component):
    def RunScript(self, ip, port, connect):
        ros_client = None

        ip = ip or "127.0.0.1"
        port = port or 9090

        key = create_id(self, "ros_client")
        ros_client = st.get(key, None)

        if ros_client:
            st[key].close()
        if connect:
            st[key] = RosClient(ip, port)
            st[key].run(5)

        ros_client = st.get(key, None)
        is_connected = ros_client.is_connected if ros_client else False
        return (ros_client, is_connected)
# ---------- end compas_fab_ros_connect ----------
compas_fab_ros_robot = COMPASFABROSRobot(ros_client=compas_fab_ros_connect.ros_client, load=robot_load)  # -> robot; inputs load: Boolean
#   port ros_client: The ROS client.
#   port load: If True, loads the robot from ROS. Defaults to False.
# ---------- compas_fab_ros_robot: Python ----------
"""
Load robot directly from ROS.

COMPAS FAB v1.0.2
"""

from compas.scene import SceneObject
from ghpythonlib.componentbase import executingcomponent as component
from scriptcontext import sticky as st

from compas_fab.ghpython.components import create_id


class ROSRobot(component):
    def RunScript(self, ros_client, load):
        key = create_id(self, "robot")

        if ros_client and ros_client.is_connected and load:
            # Load URDF from ROS
            st[key] = ros_client.load_robot(load_geometry=True, precision=12)
            st[key].scene_object = SceneObject(st[key].model)

        robot = st.get(key, None)
        if robot:  # client sometimes need to be restarted, without needing to reload geometry
            robot.client = ros_client
        return robot
# ---------- end compas_fab_ros_robot ----------
robot = Data(compas_fab_ros_robot)

# ----
# 2. Get Robot Zero Configuration
robot_2 = Data(compas_fab_ros_robot)
compas_fab_zero_config = COMPASFABZeroConfig(robot=robot_2)  # -> config
#   port group: If assigned, it will return the zero configuration for the given group, otherwise a full zero configuration.
#   port config: The zero configuration.
# ---------- compas_fab_zero_config: Python ----------
"""
Get a zero configuration for a robot.

COMPAS FAB v1.0.2
"""

from ghpythonlib.componentbase import executingcomponent as component


class ConfigZero(component):
    def RunScript(self, robot, group):
        if robot:
            return robot.zero_configuration(group)

        return None
# ---------- end compas_fab_zero_config ----------
zero_config = Data(compas_fab_zero_config)

base = Slider(216, range=-360..360)
shoulder = Slider(302, range=-360..360)
elbow = Slider(-81, range=-180..180)
wrist1 = Slider(319, range=-360..360)
wrist2 = Slider(75, range=-360..360)
wrist3 = Slider(-305, range=-360..360)
# 3. Define Custom Configuration
robot_3 = Data(compas_fab_ros_robot)
ghpython_script = GhPythonScript(robot=robot_3, base=base, shoulder=shoulder, elbow=elbow, wrist_1=wrist1, wrist_2=wrist2, wrist_3=wrist3)  # -> out, config; inputs base: Int32, shoulder: Int32, elbow: Int32, wrist_1: Int32, wrist_2: Int32, wrist_3: Int32
# ---------- ghpython_script: Python ----------
from compas_robots import Configuration
import math

base_rad = math.radians(base)
shoulder_rad = math.radians(shoulder)
elbow_rad = math.radians(elbow)
wrist_1_rad = math.radians(wrist_1)
wrist_2_rad = math.radians(wrist_2)
wrist_3_rad = math.radians(wrist_3)

joint_values = [base_rad, shoulder_rad, elbow_rad, wrist_1_rad, wrist_2_rad, wrist_3_rad]
joint_names = ['shoulder_pan_joint', 'shoulder_lift_joint', 'elbow_joint', 'wrist_1_joint', 'wrist_2_joint', 'wrist_3_joint']
joint_types = [0, 0, 0, 0, 0, 0]

config = Configuration(joint_values, joint_types, joint_names)
# ---------- end ghpython_script ----------
custom_config = Data(ghpython_script.config)

panel = Panel("C:\Users\jk6372\Desktop\00_princeton_projects\00_robotic_territories\02_Production\01_SetUp\20250105_setup_working\01_random_trajectory_testing\config_data.json")
compas_fab_zero_config_2 = COMPASFABZeroConfig(robot=robot_2, fp=panel, dump=Button())  # -> config; inputs dump: Boolean
# ---------- compas_fab_zero_config_2: Python ----------
from compas.data import json_dump

if robot:
    robot.zero_configuration(group)

if dump:
    data = robot.zero_configuration(group).__data__
    json_dump(data, fp=fp, pretty=True)
# ---------- end compas_fab_zero_config_2 ----------
zero_config_2 = Data(zero_config)
custom_config_2 = Data(custom_config)

# ----
# Temp Testing
xy_plane = XYPlane(Origin=Point(0, 0, 0))
# Optitrack - Planning Transformations
plane = Plane(PlaneXY(-1.319669293, -0.3328066128, 0.7837677605))

plane_2 = Plane([Plane(origin=(-0.339782, -0.746000051, 1.00509739), x=(1, 0, 0), y=(0, -1.192092757e-07, -1)), Plane(origin=(-0.108781934, 0.02, 1.00509739), x=(1, 0, 0), y=(0, -1.192092757e-07, -1)), Plane(origin=(-0.152781963, 0.819000065, 1.00509739), x=(1, 0, 0), y=(0, -1.192092757e-07, -1))])
value_list = ValueList({"0. zero config": 0, "1. custom config": 1}, selected="0. zero config")
ghpython_script_2 = GhPythonScript(x=plane_2)  # -> out, frames; inputs x: list of Plane
# ---------- ghpython_script_2: Python ----------
from compas_rhino.conversions import plane_to_compas_frame

frames = []

for plane in x:
    frame = plane_to_compas_frame(plane)
    frames.append(frame)
# ---------- end ghpython_script_2 ----------
stream_filter = StreamFilter(Gate=value_list, Stream0=zero_config_2, Stream1=custom_config_2)

ghpython_script_3 = GhPythonScript(optitrack_robot_plane=plane, urdf_base_plane=xy_plane, base_transformation_dist=Slider(0.517, range=0..1))  # -> out, transform, inverse_transform, robot_base_frame; inputs optitrack_robot_plane: Plane, urdf_base_plane: Plane
# ---------- ghpython_script_3: Python ----------
from compas.geometry import Transformation
from compas.geometry import Translation
from compas_rhino.conversions import plane_to_compas_frame, frame_to_rhino_plane

optitrack_robot_frame = plane_to_compas_frame(optitrack_robot_plane)
urdf_base_frame = plane_to_compas_frame(urdf_base_plane)

translation_vec = optitrack_robot_frame.xaxis + optitrack_robot_frame.yaxis
trans_vec_unitized = translation_vec.unitized()
translation_vector = trans_vec_unitized*base_transformation_dist

translation = Translation.from_vector(translation_vector)
robot_base_frame = optitrack_robot_frame.transformed(translation)

transform = Transformation.from_frame_to_frame(urdf_base_frame, robot_base_frame)
inverse_transform = transform.inverse()
# ---------- end ghpython_script_3 ----------
draw = Draw(cg=ghpython_script_3.robot_base_frame)  # -> rg
#   port cg: The COMPAS geometry or datastructure to be drawn.
# ---------- draw: Python ----------
from compas_rhino.conversions import frame_to_rhino_plane

rg = frame_to_rhino_plane(cg)
# ---------- end draw ----------

# ----
# Get Current Config
button = Button()
get_config = GhPythonScript(send=button)  # -> config, frame
# ---------- get_config: Python ----------
import os
from scriptcontext import sticky as st
#sticky is a persistent dictionary which can save values and also be acessed by other GH components
#we use it here with a custom key to store values we read from the robot
from compas.rpc import Proxy
from compas.geometry import Frame
package_path = ghdoc.Path

config_key = 'config_{}'.format(str(ghenv.Component.InstanceGuid))
new_key = 'new_key_{}'.format(str(ghenv.Component.InstanceGuid))
frame_key = 'frame_{}'.format(str(ghenv.Component.InstanceGuid))

if config_key not in st:
    st[config_key] = None

if frame_key not in st:
    st[frame_key] = None

if send:
    canvas = ghenv.Component.OnPingDocument()
    path = os.path.abspath(os.path.join(package_path,"../fabrication", "control"))
    print (path)
    rtde = Proxy('fabrication', path=path)
    st[config_key] = rtde.get_config(ip=ip)
    st[new_key] = rtde.get_config(ip=ip)
    st[frame_key] = robot.forward_kinematics(st[config_key], group, options=dict(solver='model'))
#    a = rtde.get_config(ip=ip)

config = st[config_key]
frame = st[frame_key]

#print "joint values: ", config.joint_values

#frame_WCF = frame_RCF.transformed(robot.transformation_BCF_WCF())
#print frame_RCF
# ---------- end get_config ----------
draw_2 = Draw(cg=get_config.frame)  # -> rg
#   port cg: The COMPAS geometry or datastructure to be drawn.
#   port rg: The Rhino geometry object.
# ---------- draw_2: Python ----------
"""
Draws COMPAS geometry in Grasshopper.
"""
from ghpythonlib.componentbase import executingcomponent as component

from compas_rhino.conversions import frame_to_rhino_plane


class CompasToRhinoGeometry(component):
    def RunScript(self, cg):
        if not cg:
            return None

        return frame_to_rhino_plane(cg)
# ---------- end draw_2 ----------

# ----
# Requested Robot Frames
frames = Data(ghpython_script_2.frames)
# FIXED
inversetx = Data(ghpython_script_3.inverse_transform)
requested_planes = GhPythonScript(frames=frames, inverse_transform=inversetx)  # -> out, frames_trans; inputs frames: list
# ---------- requested_planes: Python ----------
frames_trans = []

for frame in frames:
    transformed_frame = frame.transformed(inverse_transform)
    frames_trans.append(transformed_frame)
# ---------- end requested_planes ----------

# ----
# Config Storage
ghpython_script_4 = GhPythonScript(config=get_config.config)  # -> data
# ---------- ghpython_script_4: Python ----------
from compas.data import json_dumps

data_dict = {}
data_dict["config"] = config.__data__
print type(data_dict["config"])
a = [data_dict]
# ---------- end ghpython_script_4 ----------
data = Data("Grasshopper.Kernel.Types.GH_ObjectWrapper")
ghpython_script_5 = GhPythonScript(data=data)  # -> config
# ---------- ghpython_script_5: Python ----------
from compas_robots import Configuration

a = Configuration.__from_data__(data["config"])
# ---------- end ghpython_script_5 ----------

# ----
# Trajectory Testing Components
compas_fab_zero_config_3 = COMPASFABZeroConfig(robot=robot)  # -> config; same code as compas_fab_zero_config

# ----
# 4. COMPAS FAB - Plan Trajectories - Double Check
# 5) Solve IK for Planes
# 6) Plan trajectories
robot_4 = Data(robot)
current_config = Data(compas_fab_zero_config_3)
approach_place_config = Data(current_config)
robot_5 = Data(robot)
motion_planes = Data(requested_planes.frames_trans)
plan_place = GhPythonScript(robot=robot_5, current_config=current_config, requested_ik_frames=motion_planes, update=Button())  # -> motion_ik_solutions, motion_frames; inputs requested_ik_frames: list
# ---------- plan_place: Python ----------
"""
Calculate placement of a part.
"""
from ghpythonlib.componentbase import executingcomponent as component
from scriptcontext import sticky as st

#from compas.artists import Artist
from compas.scene import Scene
from compas.geometry import Frame
from compas.geometry import Transformation
from compas_rhino.conversions import plane_to_compas_frame
from compas_fab.ghpython.components import create_id
from compas_fab.robots import PlanningScene
from compas.geometry import scale_vector, add_vectors

class PlacePart(component):
    
    
    def RunScript(self, robot, group, current_config, requested_ik_frames, planner_id, collision_meshes, update):

        motion_ik_solutions = None
        free_motion_trajectories = None
        

        self.Message = ""
        if not current_config or not requested_ik_frames:
            print ('here')
            self.Message = "Missing current config or ik planes"
            return motion_ik_solutions, free_motion_trajectories

        if (update or not motion_ik_solutions or not motion_ik_solutions) and robot and robot.client and robot.client.is_connected:
            scene = PlanningScene(robot)

            frames_list = requested_ik_frames

            try:
                ik_solutions = []

                for i, frame in enumerate(frames_list):
                    if i== 0:
                        start_configuration = current_config
                    else:
                        start_configuration = ik_solutions[-1]
                    ik_solution = robot.inverse_kinematics(frame, start_configuration, group)
                    ik_solutions.append(ik_solution)

                motion_ik_solutions = ik_solutions

            except Exception as e:
                import traceback  # Import traceback for detailed error reporting
                print("Error occurred while solving IK:\n", traceback.format_exc())  # Print full traceback for debugging
                raise Exception("Could not solve IK solution. See error details above.")

        self.Message = "Found IK Solutions for Requested Planes"
        return motion_ik_solutions, free_motion_trajectories

    def _convert_planes_list_to_frames_list(self, planes_list):
        return [plane_to_compas_frame(plane) for plane in planes_list]

    def _generate_default_tolerances(self, joints):
        DEFAULT_TOLERANCE_METERS = .001
        DEFAULT_TOLERANCE_RADIANS = math.radians(1)

        return [
            DEFAULT_TOLERANCE_METERS if j.is_scalable()
            else DEFAULT_TOLERANCE_RADIANS
            for j in joints
        ]
# ---------- end plan_place ----------
place_config = Data(plan_place.motion_ik_solutions)
plan_trajectories = GhPythonScript(robot=robot_4, current_config=approach_place_config, ik_solutions=place_config, compute=Toggle(True))  # -> motion_trajectories, motion_trajectory_frames; inputs ik_solutions: list, compute: Boolean
# ---------- plan_trajectories: Python ----------
"""
Calculate pickup trajectory of a part.
"""
import math
from ghpythonlib.componentbase import executingcomponent as component
from scriptcontext import sticky as st

#from compas.artists import Artist
from compas.scene import Scene
from compas.geometry import Frame
from compas.geometry import Transformation
from compas_rhino.conversions import plane_to_compas_frame, frame_to_rhino_plane
from compas_fab.ghpython.components import create_id
from compas_fab.robots import AttachedCollisionMesh
from compas_fab.robots import CollisionMesh
from compas_fab.robots import PlanningScene

#from helpers import get_assembly_sequence

class PlanPartPickupTrajectory(component):
    def RunScript(self, robot, group, current_config, ik_solutions, planner_id, compute):
        self.Message = ""

        motion_trajectories = []
        motion_frames = []

        # Clean scene
        if compute and robot and robot.client and robot.client.is_connected:
            scene = PlanningScene(robot)

        if not current_config or not ik_solutions:
            self.Message = "No current_config & ik_solutions defined"
            return motion_trajectories, motion_frames

        try:
            
            for i,ik_solution in enumerate(ik_solutions):
                # Compute MOVE trajectory

                if i == 0:
                    start_config = current_config
                else:
                    start_config = ik_solutions[(i-1)]
                goal_config = ik_solutions[i]
                if compute and robot and robot.client and robot.client.is_connected:
                    planner_id = planner_id or 'TRRT'
        
                    tolerance_above = self._generate_default_tolerances(robot.get_configurable_joints(group))
                    tolerance_below = self._generate_default_tolerances(robot.get_configurable_joints(group))
                    goal_constraints = robot.constraints_from_configuration(
                        configuration=goal_config,
                        tolerances_above=tolerance_above,
                        tolerances_below=tolerance_below,
                        group=group
                    )
        
                    trajectory = robot.plan_motion(goal_constraints,
                                                       start_configuration=start_config,
                                                       group=group,
                                                       options=dict(
                                                       planner_id=planner_id,
            #                                               attached_collision_meshes=attached_collision_meshes
                                                       ))
        
                    motion_trajectory = trajectory
                    motion_trajectories.append(motion_trajectory)

                    if motion_trajectory:
                        for c in motion_trajectory.points:
                            frame = robot.forward_kinematics(c, group, options=dict(solver='model'))
                            motion_plane = frame_to_rhino_plane(frame)
                            motion_frames.append(motion_plane)

            if len(motion_trajectories) > 0:
                self.Message = "Found Trajectories ({} individual trajectories)".format(len(motion_trajectories))

        except Exception as e:
            import traceback  # Import traceback for detailed error reporting
            print("Error occurred while solving IK:\n", traceback.format_exc())  # Print full traceback for debugging
            raise Exception("Could not solve IK solution. See error details above.")

        return motion_trajectories, motion_frames

    def _generate_default_tolerances(self, joints):
        DEFAULT_TOLERANCE_METERS = .001
        DEFAULT_TOLERANCE_RADIANS = math.radians(1)

        return [
            DEFAULT_TOLERANCE_METERS if j.is_scalable()
            else DEFAULT_TOLERANCE_RADIANS
            for j in joints
        ]
# ---------- end plan_trajectories ----------
place_config_2 = Data(plan_place.motion_ik_solutions)
approach_place_config_2 = Data()
place_trajectory = Data(plan_trajectories.motion_trajectory_frames)
move_trajectory = Data(plan_trajectories.motion_trajectories)

# ----
# Vis Selection
vis = ValueList({"ik_solutions": 0, "trajectories": 1}, selected="ik_solutions")
stream_filter_2 = StreamFilter(Gate=vis, Stream0=place_config_2, Stream1=move_trajectory)

# ----
# Selection - Trajectory or Config List
number_slider = Slider(0, range=0..1)
ghpython_script_6 = GhPythonScript(selected_list=stream_filter_2, i=number_slider)  # -> config; inputs selected_list: list
# ---------- ghpython_script_6: Python ----------
import ghpythonlib.components as ghcomp
import compas_fab
from compas_fab.robots.robot import Configuration

def remap(value, source_min, source_max, target_min, target_max):
    normalized_value = (value - source_min) / (source_max - source_min)
    remapped_value = target_min + normalized_value * (target_max - target_min)
    return remapped_value

def trajectory_points_to_configs(trajectory_points):
    configs = [] 
    for trajectory_point in trajectory_points:
        config = Configuration(trajectory_point.joint_values, trajectory_point.joint_types, trajectory_point.joint_names)
        configs.append(config)
    return configs

for test in selected_list:
    print type(test)
if isinstance(selected_list[0], compas_fab.robots.trajectory.JointTrajectory):
    combined_trajectory_points = []
    for trajectory in selected_list:
        combined_trajectory_points.extend(trajectory.points)
    combined_trajectory_configs = trajectory_points_to_configs (combined_trajectory_points)
    index = int(remap(i, 0.001, 1.00, 0, len(combined_trajectory_configs) - 1))
    index = min(max(0, index), len(combined_trajectory_configs) - 1)
    result = combined_trajectory_configs[index]
elif isinstance(selected_list[0], compas_fab.robots.trajectory.JointTrajectoryPoint):
    index = int(remap(i, 0.001, 1.00, 0, len(selected_list) - 1))
    index = min(max(0, index), len(selected_list) - 1)
    result = selected_list[index]
elif isinstance(selected_list[0], Configuration):
    index = int(remap(i, 0.001, 1.00, 0, len(selected_list) - 1))
    index = min(max(0, index), len(selected_list) - 1)
    result = selected_list[index]
else:
    result = None  

config = result
# ---------- end ghpython_script_6 ----------

# ----
# 4. Robot Visualization
robot_6 = Data(robot)
compas_fab_robot_visualize = COMPASFABRobotVisualize(robot=robot_6, configuration=ghpython_script_6, show_base_frame=True)  # -> visual, collision, collision_meshes, attached_meshes, frames, base_frame, ee_frame; inputs show_visual: Boolean, show_collision: Boolean, show_frames: Boolean, show_base_frame: Boolean, show_end_effector_frame: Boolean, show_cm: Boolean, show_acm: Boolean
#   port group: The planning group used for end-effector and base visualization.
#   port configuration: The robot's full configuration.
#   port show_visual: Whether or not to show the robot's visual meshes.
#   port show_collision: Whether or not to show the robot's collision meshes.
#   port show_frames: Whether or not to show the robot's joint frames.
#   port show_base_frame: Whether or not to show the robot's base frame.
#   port show_end_effector_frame: Whether or not to show the robot's end-effector frame.
#   port show_cm: Whether or not to show the collision meshes (if any).
#   port show_acm: Whether or not to show the attached collision meshes (if any).
#   port visual: Rhino meshes of the robot's visual geometry (if any).
#   port collision: Rhino meshes of the robot's collision geometry (if any).
#   port collision_meshes: Rhino meshes of the scene's collision meshes (if any).
#   port attached_meshes: Rhino meshes of the scene's attached collision meshes (if any).
#   port frames: The robot's joint frames as Rhino planes (if any).
#   port base_frame: The robot's base frame as a Rhino plane (if any).
#   port ee_frame: The robot's end-effector frame as a Rhino plane (if any).
# ---------- compas_fab_robot_visualize: Python ----------
"""
Visualizes the robot.

COMPAS FAB v1.0.2
"""

import time

from compas.geometry import Frame
from compas.geometry import Transformation
from compas.scene import SceneObject
from compas_ghpython import create_id
from compas_rhino.conversions import frame_to_rhino_plane
from ghpythonlib.componentbase import executingcomponent as component
from scriptcontext import sticky as st

from compas_fab.backends import BackendFeatureNotSupportedError
from compas_fab.robots import PlanningScene


class RobotVisualize(component):
    def RunScript(
        self,
        robot,
        group,
        configuration,
        show_visual,
        show_collision,
        show_frames,
        show_base_frame,
        show_end_effector_frame,
        show_cm,
        show_acm,
    ):
        visual = None
        collision = None
        collision_meshes = None
        attached_meshes = None
        frames = None
        base_frame = None
        ee_frame = None

        if robot:
            show_visual = True if show_visual is None else show_visual
            show_cm = True if show_cm is None else show_cm
            show_acm = True if show_acm is None else show_acm
            configuration = configuration or robot.zero_configuration()

            robot.update(configuration, visual=show_visual, collision=show_collision)
            compas_frames = robot.transformed_frames(configuration, group)

            if show_visual:
                visual = robot.scene_object.draw_visual()

            if show_collision:
                collision = robot.scene_object.draw_collision()

            if show_base_frame:
                base_compas_frame = compas_frames[0]
                base_frame = frame_to_rhino_plane(base_compas_frame)

            if show_end_effector_frame:
                options = dict(solver="model")
                if robot.attached_tool:
                    options["link"] = robot.attached_tool.connected_to

                ee_compas_frame = robot.forward_kinematics(configuration, group, options=options)
                ee_frame = frame_to_rhino_plane(ee_compas_frame)

            if show_frames:
                frames = []
                for compas_frame in compas_frames[1:]:
                    frame = frame_to_rhino_plane(compas_frame)
                    frames.append(frame)

            cached_scene_key = create_id(self, "cached_scene")

            if show_cm or show_acm:
                cached_scene = st.get(cached_scene_key)
                if not cached_scene:
                    cached_scene = {"time": 0}

                # expire cache if the component has not been executed in the last 2 seconds
                # this allows to slide through a list of configurations
                # without triggering refreshes of the scene in the middle of it
                if time.time() - cached_scene["time"] > 2:
                    update_scene = True
                else:
                    update_scene = False

                if update_scene:
                    scene = PlanningScene(robot)
                    try:
                        scene = robot.client.get_planning_scene()
                    except BackendFeatureNotSupportedError:
                        print(
                            "The selected backend does not support collision meshes. If you need collision mesh support, use a different backend."
                        )
                        scene = None
                        show_cm = False
                        show_acm = False

                if update_scene and show_cm:
                    collision_meshes = []

                    for co in scene.world.collision_objects:
                        header = co.header
                        frame_id = header.frame_id
                        cms = co.to_collision_meshes()

                        for cm in cms:
                            if cm.frame != Frame.worldXY():
                                t = Transformation.from_frame(cm.frame)
                                mesh = cm.mesh.transformed(t)
                            else:
                                mesh = cm.mesh

                            collision_meshes.extend(SceneObject(mesh).draw())

                        cached_scene["cm"] = collision_meshes

                collision_meshes = cached_scene.get("cm", [])

                if update_scene and show_acm:
                    attached_meshes = []

                    for aco in scene.robot_state.attached_collision_objects:
                        for acm in aco.to_attached_collision_meshes():
                            frame_id = aco.object["header"]["frame_id"]
                            frame = robot.forward_kinematics(configuration, options=dict(link=frame_id))
                            t = Transformation.from_frame(frame)

                            # Local CM frame
                            if acm.collision_mesh.frame and acm.collision_mesh.frame != Frame.worldXY():
                                t = t * Transformation.from_frame(acm.collision_mesh.frame)

                            mesh = acm.collision_mesh.mesh.transformed(t)

                            attached_meshes.extend(SceneObject(mesh).draw())

                    cached_scene["acm"] = attached_meshes

                attached_meshes = cached_scene.get("acm", [])

                cached_scene["time"] = time.time()
                st[cached_scene_key] = cached_scene

        return (
            visual,
            collision,
            collision_meshes,
            attached_meshes,
            frames,
            base_frame,
            ee_frame,
        )
# ---------- end compas_fab_robot_visualize ----------
mesh = Mesh(compas_fab_robot_visualize.visual)

orient = Orient(Geometry=mesh, Source=xy_plane, Target=draw)  # -> Geometry, Transform
