# Grasshopper definition 20250125_optitrackread_alone.ghx (Grasshopper 1.0.7)
# plug-ins: MoCap

# ----
# Optitrack Streaming Info
toggle = BooleanToggle(False)
mocap_stream = MoCap(Activate=toggle, LocalIP="169.254.24.199", ServerIP="169.254.24.199")  # -> Status, RBID, RBName, RBPlane
panel = Panel(mocap_stream.Status)
panel_2 = Panel(mocap_stream.RBPlane)
panel_3 = Panel(mocap_stream.RBID)
panel_4 = Panel(mocap_stream.RBName)

# ----
# RH Origin
pln = Plane(PlaneXY(0.1524, -1.8192, 0.005))

number_slider = Slider(0.3, range=0..1)
# Opti - Track Transformations
data = Data(mocap_stream.RBID)
pln_2 = Plane(mocap_stream.RBPlane)
data_2 = Data(mocap_stream.RBName)
python = GhPythonScript(
    rb_ids=data,
    rb_names=data_2,
    rb_planes=pln_2,
    alignment_plane=pln,
    xsize=number_slider,
    ysize=number_slider,
    zsize=number_slider)  # -> out, planes, boxes_rhino, transformed_planes, robot_plane; inputs rb_ids: list, rb_names: list, rb_planes: list, alignment_plane: Plane
# ---------- python: Python ----------
from compas_rhino import unload_modules
from compas_rhino.conversions import plane_to_compas_frame, box_to_rhino
import Rhino.Geometry as rg

unload_modules("compas_xr")

from compas_xr.project import OptitrackItems, OptiTrackConversions


if not (rb_ids):
    ghenv.Component.Message = "Missing rb_ids"

elif not (rb_names):
    ghenv.Component.Message = "Missing rb_names"

elif not (alignment_plane):
    ghenv.Component.Message = "Missing alignment plane"

elif not (xsize and ysize and zsize):
    ghenv.Component.Message = "Missing box definition"

else:
    ghenv.Component.Message = None
    converted_planes = OptiTrackConversions().convert_to_rhino_planes(rb_planes)
    oi = OptitrackItems(rb_ids, rb_names, converted_planes)
    planes = oi.planes
    alignment_frame = plane_to_compas_frame(alignment_plane)
    transformed_class = oi.transformed_to_alignment_frame(alignment_frame)
    boxes = transformed_class.create_box_geometry_from_items_dict(transformed_class.dict, xsize, ysize, zsize)
    boxes_rhino = [box_to_rhino(b) for b in boxes]
    robot_plane = transformed_class.dict["Robot"]["rhino_plane"]
    
    transformed_planes = transformed_class.planes
# ---------- end python ----------
pln_3 = Plane(python.transformed_planes)
geo = Geometry(python.boxes_rhino)
