# Grasshopper definition 20250811_workcell_optitrack_test.ghx (Grasshopper 1.0.7)

panel = Panel("C:\Users\jk6372\Desktop\00_princeton_projects\00_robotic_territories\00_git\compas_xr_robotic_territories\dev\performance_operations\recordings\motive_recordings\2025_optitrack_workcell_testing\recordings\20250811_001737\rigid_bodies_by_timestamp.json")
boolean_toggle = BooleanToggle(True)
plane = Plane(Plane(origin=(-1.261218467, 0.51, 0.0345), x=(0, -1, 0), y=(0.9999942541, 0, -0.003389961836)))
panel_2 = Panel("robotic_territories_testing_base_frame_geo_tracking")

ghpython_script = GhPythonScript(input_key="Cube01", fp=panel, to_tx_origin=plane, tx=boolean_toggle)  # -> out, marker_frames, geo_frames, geo; inputs to_tx_origin: Plane, tx: Boolean
# ---------- ghpython_script: Python ----------
from compas.data import json_load
from compas.geometry import Frame
from compas_rhino.conversions import frame_to_rhino_plane, box_to_rhino, plane_to_compas_frame
from compas.geometry import Transformation, Box, Frame

#fp = r"C:\Users\jk6372\Desktop\00_princeton_projects\00_robotic_territories\00_git\compas_xr_robotic_territories\dev\performance_operations\recordings\motive_recordings\2025_anchor_block_test\recordings\20250805_194653\rigid_bodies_by_timestamp.json"
#fp = r"C:\Users\jk6372\Desktop\00_princeton_projects\00_robotic_territories\00_git\compas_xr_robotic_territories\dev\performance_operations\recordings\motive_recordings\2025_anchor_block_test\recordings\20250805_225331\rigid_bodies_by_timestamp.json"
#fp = r"C:\Users\jk6372\Desktop\00_princeton_projects\00_robotic_territories\00_git\compas_xr_robotic_territories\dev\performance_operations\recordings\motive_recordings\2025_anchor_block_test\recordings\20250805_231118\rigid_bodies_by_timestamp.json"
#fp = r"C:\Users\jk6372\Desktop\00_princeton_projects\00_robotic_territories\00_git\compas_xr_robotic_territories\dev\performance_operations\recordings\motive_recordings\2025_anchor_block_test\recordings\20250806_152136\rigid_bodies_by_timestamp.json"
#fp = r"C:\Users\jk6372\Desktop\00_princeton_projects\00_robotic_territories\00_git\compas_xr_robotic_territories\dev\performance_operations\recordings\motive_recordings\2025_anchor_block_test\recordings\20250806_162612\rigid_bodies_by_timestamp.json"
#fp = r"C:\Users\jk6372\Desktop\00_princeton_projects\00_robotic_territories\00_git\compas_xr_robotic_territories\dev\performance_operations\recordings\motive_recordings\2025_anchor_block_test\recordings\20250806_164509\rigid_bodies_by_timestamp.json"
#fp = r"C:\Users\jk6372\Desktop\00_princeton_projects\00_robotic_territories\00_git\compas_xr_robotic_territories\dev\performance_operations\recordings\motive_recordings\2025_anchor_block_test\recordings\20250806_170112\rigid_bodies_by_timestamp.json"

data = json_load(fp)

data_requested = data[input_key]

marker_frames = []
geo_frames = []
geo = []

origin = data["Origin"][0]["marker_rhino_frame"]
trans = Transformation.from_frame_to_frame(Frame.__from_data__(origin), plane_to_compas_frame(to_tx_origin))

for i in range(len(data_requested)):
    f_data = data[input_key][i]["marker_rhino_frame"]
    geo_frame_data = data[input_key][i]["geometry_rhino_frame"]

    frame = Frame.__from_data__(f_data)
    geo_frame = Frame.__from_data__(geo_frame_data)

    if tx:
        frame = frame.transformed(trans)
        geo_frame = geo_frame.transformed(trans)

    box = Box(0.3, 0.3, 0.3, geo_frame)

    marker_frames.append(frame_to_rhino_plane(frame))
    geo_frames.append(frame_to_rhino_plane(geo_frame))
    geo.append(box_to_rhino(box))
# ---------- end ghpython_script ----------
ghpython_script_2 = GhPythonScript(input_key="Cube03", fp=panel, to_tx_origin=plane, tx=boolean_toggle)  # -> out, marker_frames, geo_frames, geo; inputs to_tx_origin: Plane, tx: Boolean; same code as ghpython_script
ghpython_script_3 = GhPythonScript(input_key="Cube04", fp=panel, to_tx_origin=plane, tx=boolean_toggle)  # -> out, marker_frames, geo_frames, geo; inputs to_tx_origin: Plane, tx: Boolean; same code as ghpython_script
ghpython_script_4 = GhPythonScript(input_key="AnchorCube", fp=panel, to_tx_origin=plane, tx=boolean_toggle)  # -> out, marker_frames, geo_frames, geo; inputs to_tx_origin: Plane, tx: Boolean; same code as ghpython_script
ghpython_script_5 = GhPythonScript(input_key="Cube02", fp=panel, to_tx_origin=plane, tx=boolean_toggle)  # -> out, marker_frames, geo_frames, geo; inputs to_tx_origin: Plane, tx: Boolean; same code as ghpython_script
ghpython_script_6 = GhPythonScript(input_key="Cube05", fp=panel, to_tx_origin=plane, tx=boolean_toggle)  # -> out, marker_frames, geo_frames, geo; inputs to_tx_origin: Plane; same code as ghpython_script
ghpython_script_7 = GhPythonScript(input_key="Cube06", fp=panel, to_tx_origin=plane, tx=boolean_toggle)  # -> out, marker_frames, geo_frames, geo; inputs to_tx_origin: Plane, tx: Boolean; same code as ghpython_script
ghpython_script_8 = GhPythonScript(input_key="Cube07", fp=panel, to_tx_origin=plane, tx=boolean_toggle)  # -> out, marker_frames, geo_frames, geo; inputs to_tx_origin: Plane; same code as ghpython_script
ghpython_script_9 = GhPythonScript(input_key="Cube08", fp=panel, to_tx_origin=plane, tx=boolean_toggle)  # -> out, marker_frames, geo_frames, geo; inputs to_tx_origin: Plane, tx: Boolean; same code as ghpython_script
number_slider = Slider(0, range=0..62)
number_slider_2 = Slider(16, range=0..62)
number_slider_3 = Slider(23, range=0..62)
number_slider_4 = Slider(0, range=0..62)
number_slider_5 = Slider(0, range=0..62)
number_slider_6 = Slider(0, range=0..62)
number_slider_7 = Slider(0, range=0..62)
number_slider_8 = Slider(22, range=0..62)
number_slider_9 = Slider(22, range=0..62)
plane_2 = Plane(ghpython_script.geo_frames)
geometry = Geometry(ghpython_script.geo)
plane_3 = Plane(ghpython_script.marker_frames)
plane_4 = Plane(ghpython_script_2.geo_frames)
geometry_2 = Geometry(ghpython_script_2.geo)
plane_5 = Plane(ghpython_script_3.geo_frames)
geometry_3 = Geometry(ghpython_script_3.geo)
plane_6 = Plane(ghpython_script_2.marker_frames)
plane_7 = Plane(ghpython_script_4.geo_frames)
geometry_4 = Geometry(ghpython_script_4.geo)
plane_8 = Plane(ghpython_script_3.marker_frames)
plane_9 = Plane(ghpython_script_4.marker_frames)
plane_10 = Plane(ghpython_script_5.geo_frames)
geometry_5 = Geometry(ghpython_script_5.geo)
plane_11 = Plane(ghpython_script_5.marker_frames)
plane_12 = Plane(ghpython_script_6.geo_frames)
geometry_6 = Geometry(ghpython_script_6.geo)
plane_13 = Plane(ghpython_script_6.marker_frames)
plane_14 = Plane(ghpython_script_7.geo_frames)
geometry_7 = Geometry(ghpython_script_7.geo)
plane_15 = Plane(ghpython_script_7.marker_frames)
plane_16 = Plane(ghpython_script_8.geo_frames)
geometry_8 = Geometry(ghpython_script_8.geo)
plane_17 = Plane(ghpython_script_8.marker_frames)
plane_18 = Plane(ghpython_script_9.geo_frames)
geometry_9 = Geometry(ghpython_script_9.geo)
plane_19 = Plane(ghpython_script_9.marker_frames)
list_item = ListItem(List=plane_3, Index=number_slider, Wrap=True)
list_item_2 = ListItem(List=geometry, Index=number_slider, Wrap=True)
list_item_3 = ListItem(List=plane_2, Index=number_slider, Wrap=True)
list_item_4 = ListItem(List=plane_6, Index=number_slider_2, Wrap=True)
list_item_5 = ListItem(List=geometry_2, Index=number_slider_2, Wrap=True)
list_item_6 = ListItem(List=plane_8, Index=number_slider_3, Wrap=True)
list_item_7 = ListItem(List=plane_4, Index=number_slider_2, Wrap=True)
list_item_8 = ListItem(List=geometry_3, Index=number_slider_3, Wrap=True)
list_item_9 = ListItem(List=plane_5, Index=number_slider_3, Wrap=True)
list_item_10 = ListItem(List=plane_9, Index=number_slider_4, Wrap=True)
list_item_11 = ListItem(List=plane_7, Index=number_slider_4, Wrap=True)
list_item_12 = ListItem(List=geometry_4, Index=number_slider_4, Wrap=True)
list_item_13 = ListItem(List=plane_11, Index=number_slider_5, Wrap=True)
list_item_14 = ListItem(List=geometry_5, Index=number_slider_5, Wrap=True)
list_item_15 = ListItem(List=plane_10, Index=number_slider_5, Wrap=True)
list_item_16 = ListItem(List=plane_13, Index=number_slider_6, Wrap=True)
list_item_17 = ListItem(List=geometry_6, Index=number_slider_6, Wrap=True)
list_item_18 = ListItem(List=plane_12, Index=number_slider_6, Wrap=True)
list_item_19 = ListItem(List=plane_15, Index=number_slider_7, Wrap=True)
list_item_20 = ListItem(List=geometry_7, Index=number_slider_7, Wrap=True)
list_item_21 = ListItem(List=plane_14, Index=number_slider_7, Wrap=True)
list_item_22 = ListItem(List=plane_17, Index=number_slider_8, Wrap=True)
list_item_23 = ListItem(List=geometry_8, Index=number_slider_8, Wrap=True)
list_item_24 = ListItem(List=plane_16, Index=number_slider_8, Wrap=True)
list_item_25 = ListItem(List=plane_19, Index=number_slider_9, Wrap=True)
list_item_26 = ListItem(List=geometry_9, Index=number_slider_9, Wrap=True)
list_item_27 = ListItem(List=plane_18, Index=number_slider_9, Wrap=True)
